# Grasshopper definition chamfer-rail-generator.gh (Grasshopper 0.9.76)
# Copyright: Creative commons attribution share-a-like

# ---- group: Nema 17 award plotter config
roller_rack_and_pinion_maker = RollerRackAndPinionMaker_2(rack_length=328, milling_bit_diameter=2.1, number_of_pinion_teeth=10, motor_shaft_diameter=5)  # -> rack_teeth_4, rack_edge_2, pinion_teeth_4, pinion_center_hole_3, pinion_edge_3, pinion_movement_preview_3, distance_covered_per_step_5, maxium_pinion_milling_bit_diamter_4

# ---- group: Old default config
roller_rack_and_pinion_maker_2 = RollerRackAndPinionMaker()  # -> rack_teeth_4, pinion_teeth_4, pinion_center_hole_3, pinion_edge_3, steps_per_mm_2, maxium_pinion_milling_bit_diamter_4, pinion_movement_preview_3

# ----
axis_length = Panel("500")
material_thickness = Panel("10")
chamfer_distance = Panel("4")
axis_width = Panel("123")
rack_tooth_height = Panel("4")
pinion_clearance_margin = Panel("2")
roller_rack_and_pinion_maker_3 = RollerRackAndPinionMaker()  # -> rack_teeth_4, pinion_teeth_4, pinion_center_hole_3, pinion_edge_3, steps_per_mm_2, maxium_pinion_milling_bit_diamter_4, pinion_movement_preview_3
panel = Panel(roller_rack_and_pinion_maker.distance_covered_per_step_5)
crv = Curve([roller_rack_and_pinion_maker.pinion_teeth_4, roller_rack_and_pinion_maker.rack_teeth_4])
panel_2 = Panel(roller_rack_and_pinion_maker_2.steps_per_mm_2)
crv_2 = Curve([roller_rack_and_pinion_maker_2.rack_teeth_4, roller_rack_and_pinion_maker_2.pinion_teeth_4])
division = Division(A="1", B=panel_2)
division_2 = Division(A="1", B=panel)
steps_per_mm = Panel(division)
steps_per_mm_2 = Panel(division_2)
_2d_curves = Curve([roller_rack_and_pinion_maker_3.pinion_teeth_4, roller_rack_and_pinion_maker_3.pinion_center_hole_3, roller_rack_and_pinion_maker_3.pinion_edge_3, roller_rack_and_pinion_maker_3.rack_teeth_4])
axis_length_2 = Panel(axis_length)
rack_teeth = Curve(roller_rack_and_pinion_maker_3.rack_teeth_4)

# ---- group: Make points for axis profile
material_thickness_2 = Panel(material_thickness)
chamfer_distance_2 = Panel(chamfer_distance)
axis_width_2 = Panel(axis_width)
multiplication = Multiplication(A=axis_width_2, B="0.5")
subtraction = Subtraction(A=multiplication, B=chamfer_distance_2)
neg = Negative(Value=multiplication)
neg_2 = Negative(Value=chamfer_distance_2)
neg_3 = Negative(Value=multiplication)
neg_4 = Negative(Value=material_thickness_2)
neg_5 = Negative(Value=subtraction)
pt = ConstructPoint(XCoordinate=0, YCoordinate=subtraction, ZCoordinate=0)
pt_2 = ConstructPoint(XCoordinate=0, YCoordinate=neg_5, ZCoordinate=0)
pt_3 = ConstructPoint(XCoordinate=0, YCoordinate=multiplication, ZCoordinate=neg_4)
pt_4 = ConstructPoint(XCoordinate=0, YCoordinate=neg_3, ZCoordinate=neg_4)
pt_5 = ConstructPoint(XCoordinate=0, YCoordinate=multiplication, ZCoordinate=neg_2)
pt_6 = ConstructPoint(XCoordinate=0, YCoordinate=neg, ZCoordinate=neg_2)
merge = Merge(Data1=pt, Data2=pt_2, Data3=pt_6, Data4=pt_4, Data5=pt_3, Data6=pt_5)
pline = PolyLine(Vertices=merge, Closed=True)
axis_profile = Curve(pline)

# ----
item = ListItem(List=flatten(rack_teeth), Index=0, Wrap=True)

# ---- group: Find number of teeth needed for axis length
end = EndPoints(Curve=item)  # -> Start, End
dist = Distance(PointA=end.Start, PointB=end.End)
tooth_spacing = Panel(dist)
division_3 = Division(A=axis_length_2, B=tooth_spacing)
round = Round(Number=division_3)  # -> Nearest, Floor, Ceiling
number_of_teeth_in_axis = Panel(round.Ceiling)

# ----
distance_covered_per_step = Panel()

# ---- group: Move first tooth to axis edge
pdecon = Deconstruct(Point=end.Start)  # -> XComponent, YComponent, ZComponent
pt_7 = ConstructPoint(XCoordinate=0, YCoordinate=pdecon.YComponent, ZCoordinate=pdecon.ZComponent)
vec2pt = Vector2Pt(PointA=end.Start, PointB=pt_7, Unitize=False)  # -> Vector, Length
move = Move(Geometry=item, Motion=vec2pt.Vector)  # -> Geometry, Transform

# ----
panel_3 = Panel("2")
division_4 = Division(A="1", B=distance_covered_per_step)
steps_per_mm_3 = Panel(division_4)
move_2 = Move(Geometry=roller_rack_and_pinion_maker_3.pinion_teeth_4, Motion=vec2pt.Vector)  # -> Geometry, Transform
move_3 = Move(Geometry=roller_rack_and_pinion_maker_3.pinion_center_hole_3, Motion=vec2pt.Vector)  # -> Geometry, Transform
division_5 = Division(A=distance_covered_per_step, B="5")
multiplication_2 = Multiplication(A="5", B="200")
pinion = Curve(flatten([move_2.Geometry, move_3.Geometry]))
multiplication_3 = Multiplication(A=division_5, B=multiplication_2)
speed_mm_s = Panel("150")
mm_per_revolution = Panel(multiplication_3)

# ---- group: Copy and join teeth for axis
series = Series(Start=0, Step=tooth_spacing, Count=number_of_teeth_in_axis)
X = UnitX(Factor=series)
move_4 = Move(Geometry=move.Geometry, Motion=X)  # -> Geometry, Transform
join = JoinCurves(Curves=move_4.Geometry, Preserve=False)
rack_teeth_2 = Curve(join)

# ----
multiplication_4 = Multiplication(A=speed_mm_s, B="60")
multiplication_5 = Multiplication()
division_6 = Division(A=multiplication_4, B=mm_per_revolution)
rpm = Panel(division_6)

# ---- group: Extrude axis
axis_length_3 = Panel(axis_length)
axis_profile_2 = Curve(axis_profile)
X_2 = UnitX(Factor=axis_length_3)
extr = Extrude(Base=axis_profile_2, Direction=X_2)
cap = CapHoles(Brep=extr)
axis_stock = Brep(cap)

# ---- group: Make rack pocket outline
pinion_clearance_margin_2 = Panel(pinion_clearance_margin)
rack_teeth_3 = Curve(rack_teeth_2)
pinion_2 = Curve(pinion)
bbox = BoundingBox(Content=flatten([pinion_2, rack_teeth_3]), Plane=PlaneXY(0, 0, 0), UnionBox=True)  # -> Box, Box_2
edges = BrepEdges(Brep=bbox.Box)  # -> Naked, Interior, NonManifold
Y = UnitY(Factor=pinion_clearance_margin_2)
item_2 = ListItem(List=edges.Naked, Index="2", Wrap=True)
move_5 = Move(Geometry=item_2, Motion=Y)  # -> Geometry, Transform
end_2 = EndPoints(Curve=move_5.Geometry)  # -> Start, End
end_3 = EndPoints(Curve=rack_teeth_3)  # -> Start, End
merge_2 = Merge(Data1=flatten(end_3.Start), Data2=flatten(end_2.End), Data3=flatten(end_2.Start), Data4=flatten(end_3.End))
pline_2 = PolyLine(Vertices=merge_2, Closed=False)
join_2 = JoinCurves(Curves=flatten([rack_teeth_3, pline_2]), Preserve=False)

# ----
multiplication_6 = Multiplication(A=pinion_clearance_margin_2, B="0.5")
neg_6 = Negative(Value=multiplication_6)
Y_2 = UnitY(Factor=neg_6)
move_6 = Move(Geometry=join_2, Motion=Y_2)  # -> Geometry, Transform

# ---- group: Make rack pocket outline (continued)
rack_pocket_outline = Curve(move_6.Geometry)

# ---- group: Subtract pocket from axis extrusion
rack_tooth_height_2 = Panel(rack_tooth_height)
rack_pocket_outline_2 = Curve(rack_pocket_outline)
axis_stock_2 = Brep(axis_stock)
neg_7 = Negative(Value=rack_tooth_height_2)
Z = UnitZ(Factor=neg_7)
extr_2 = Extrude(Base=rack_pocket_outline_2, Direction=Z)
cap_2 = CapHoles(Brep=extr_2)
rack_pocket = Brep(cap_2)
sdiff = SolidDifference(BrepsA=axis_stock_2, BrepsB=rack_pocket)
axis = Brep(sdiff)

# ==== cluster RollerRackAndPinionMaker: Makes rack and pinion gemetry suitable for 3 axis CNC milling. Has low backlash, but is vulnerable to contamination. More options inside component.
pinion_tooth_spacing_factor = ClusterInput()
number_of_pinion_teeth = ClusterInput()
motor_shaft_diameter = ClusterInput()
milling_bit_diameter = ClusterInput()
rack_length = ClusterInput()
tooth_fillet_ratio = ClusterInput()

# ---- group: Determines the travel distance of pinion
rack_length_2 = Panel("200")
rack_length_3 = Number(rack_length)
null = NullItem(Item=rack_length_3)  # -> NullFlags, InvalidFlags, Description
filter = StreamFilter(Gate=null.NullFlags, Stream0=rack_length_3, Stream1=rack_length_2)
rack_length_4 = Panel(filter)

# ---- group: Smaller amount of teeth gives higher resolution and more torque
number_of_pinion_teeth_2 = Panel("9")
number_of_pinion_teeth_3 = Number(number_of_pinion_teeth)
# default config for nema 23 and nema 17 stepper motors - january 2017: bit diamter: 2.8
# pinion tooth spacing factor: -0.1071428
# (gives optimal pinion size and 5mm rack tooth spacing)
# number of pinion teeth: 9
# fillet ratio: 0.2
# earlier config for 2mm pinion milling and 3mm rack milling - august 2016: bit diamter: 3.1
# pinion tooth spacing factor: -0.14
# number of pinion teeth: 10
# fillet ratio: 0.15
null_2 = NullItem(Item=number_of_pinion_teeth_3)  # -> NullFlags, InvalidFlags, Description
filter_2 = StreamFilter(Gate=null_2.NullFlags, Stream0=number_of_pinion_teeth_3, Stream1=number_of_pinion_teeth_2)
number_of_pinion_teeth_4 = Panel(filter_2)

# ---- group: Determines the tooth spacing, some margin recommended
milling_bit_diameter_2 = Panel("2.8")
milling_bit_diameter_3 = Number(milling_bit_diameter)
null_3 = NullItem(Item=milling_bit_diameter_3)  # -> NullFlags, InvalidFlags, Description
filter_3 = StreamFilter(Gate=null_3.NullFlags, Stream0=milling_bit_diameter_3, Stream1=milling_bit_diameter_2)
milling_bit_diameter_4 = Panel(filter_3)

# ---- group: Can be used to reduce or increase the pinion tooth spacing
pinion_tooth_spacing_factor_2 = Panel("-0.1071428")
pinion_tooth_spacing_factor_3 = Number(pinion_tooth_spacing_factor)
null_4 = NullItem(Item=pinion_tooth_spacing_factor_3)  # -> NullFlags, InvalidFlags, Description
filter_4 = StreamFilter(Gate=null_4.NullFlags, Stream0=pinion_tooth_spacing_factor_3, Stream1=pinion_tooth_spacing_factor_2)
pinion_tooth_spacing_factor_4 = Panel(filter_4)

# ---- group: The shaft diameter of the motor driving the pinion
motor_shaft_diameter_2 = Panel("8")
motor_shaft_diameter_3 = Number(motor_shaft_diameter)
null_5 = NullItem(Item=motor_shaft_diameter_3)  # -> NullFlags, InvalidFlags, Description
filter_5 = StreamFilter(Gate=null_5.NullFlags, Stream0=motor_shaft_diameter_3, Stream1=motor_shaft_diameter_2)
motor_shaft_diameter_4 = Panel(filter_5)

# ---- group: Low fillet ratio gives smoother motion, but makes a less robust pinion
tooth_fillet_ratio_2 = Panel("0.2")
tooth_fillet_ratio_3 = Number(tooth_fillet_ratio)
null_6 = NullItem(Item=tooth_fillet_ratio_3)  # -> NullFlags, InvalidFlags, Description
filter_6 = StreamFilter(Gate=null_6.NullFlags, Stream0=tooth_fillet_ratio_3, Stream1=tooth_fillet_ratio_2)
tooth_fillet_ratio_4 = Panel(filter_6)

# ----
preview_position_0_1 = ClusterInput()
preview_position = Slider(0.25, range=0..1)

# ---- group: Controlls pinion tooth blending
rounding_factor_pinion_outside = Slider(20, range=0..100)
rounding_factor_pinion_inside = Slider(70, range=0..100)

# ---- group: Start numbers to help calculte pinion tooth path through rack
number_of_curve_sample_points = Slider(20, range=0..1000)
sample_tooth_position = Panel("0.26")

# ---- group: Lower number gives more clearene between rack tooth and pinion valley
pinion_corner_tolerance_factor = Panel("15")

# ---- group: Fill in for correct step statistics
number_of_stepper_motor_steps = Panel("200")
microstep_level = Panel("4")

# ----
preview_position_0_1_2 = Number(preview_position_0_1)

# ---- group: Prepare properties
multiplication = Multiplication(A=milling_bit_diameter_4, B=pinion_tooth_spacing_factor_4)
multiplication_2 = Multiplication(A=number_of_pinion_teeth_4, B=sample_tooth_position)
division = Division(A=milling_bit_diameter_4, B=pinion_corner_tolerance_factor)
addition = Addition(A=milling_bit_diameter_4, B=multiplication)
multiplication_3 = Multiplication(A=milling_bit_diameter_4, B="0.5")
multiplication_4 = Multiplication(A=motor_shaft_diameter_4, B="0.5")
round = Round(Number=multiplication_2)  # -> Nearest, Floor, Ceiling
multiplication_5 = Multiplication(A=number_of_pinion_teeth_4, B="2")
neg = Negative(Value=division)
multiplication_6 = Multiplication(A=milling_bit_diameter_4, B=tooth_fillet_ratio_4)
milling_bit_radius = Panel(multiplication_3)
xy = XYPlane(Origin=Point(0, 0, 0))
sample_tooth_number = Panel(round.Ceiling)
multiplication_7 = Multiplication(A=addition, B=multiplication_5)
tooth_fillet_radius = Panel(multiplication_6)
pinion_circumference = Panel(multiplication_7)
cir = Circle(Plane=xy, Radius=milling_bit_radius)
pi = Pi(Factor=1)
division_2 = Division(A=pinion_circumference, B=pi)
number_of_pinion_teeth_5 = Panel(number_of_pinion_teeth_4)
pinion_diameter = Panel(division_2)
sample_tooth_number_2 = Panel(sample_tooth_number)
number_of_curve_sample_points_2 = Panel(number_of_curve_sample_points)
multiplication_8 = Multiplication(A=pinion_diameter, B="0.5")
division_3 = Division(A=sample_tooth_number_2, B=number_of_pinion_teeth_5)
pinion_radius = Panel(multiplication_8)
pinion_circumference_2 = Panel(pinion_circumference)
multiplication_9 = Multiplication(A="360", B=division_3)
Y = UnitY(Factor=pinion_radius)
division_4 = Division(A="360", B=number_of_pinion_teeth_5)
division_5 = Division(A=multiplication_9, B=number_of_curve_sample_points_2)
multiplication_10 = Multiplication(A=pinion_circumference_2, B=division_3)
division_6 = Division(A=pinion_circumference, B=number_of_pinion_teeth_4)
move = Move(Geometry=xy, Motion=Y)  # -> Geometry, Transform
series = Series(Start=0, Step=division_4, Count=number_of_pinion_teeth_5)
division_7 = Division(A=multiplication_10, B=number_of_curve_sample_points_2)
series_2 = Series(Start=0, Step=division_5, Count=number_of_curve_sample_points_2)
tooth_spacing = Panel(division_6)
rad = Radians(Degrees=series)
circle = Circle(cir)
series_3 = Series(Start=0, Step=division_7, Count=number_of_curve_sample_points_2)
neg_2 = Negative(Value=series_2)
rad_2 = Radians(Degrees=neg_2)
rotate = Rotate(Geometry=circle, Angle=rad, Plane=move.Geometry)  # -> Geometry, Transform

# ---- group: Make step resolution statisitics
number_of_stepper_motor_steps_2 = Panel(number_of_stepper_motor_steps)
microstep_level_2 = Panel(microstep_level)
division_8 = Division(A=pinion_circumference, B=number_of_stepper_motor_steps_2)
distance_covered_per_step = Panel(division_8)
division_9 = Division(A=distance_covered_per_step, B=microstep_level_2)
distance_covered_per_micro_step = Panel(division_9)

# ---- group: Step statsistics
distance_covered_per_step_2 = Panel(distance_covered_per_step)
distance_covered_per_micro_step_2 = Panel(distance_covered_per_micro_step)

# ---- group: Create rack tooth geometry
sample_tooth_number_3 = Panel(sample_tooth_number_2)
tooth_spacing_2 = Panel(tooth_spacing)
item = ListItem(List=rotate.Geometry, Index=sample_tooth_number_3, Wrap=True)
rotate_2 = Rotate(Geometry=graft(item), Angle=rad_2, Plane=move.Geometry)  # -> Geometry, Transform
tooth_spacing_3 = Panel(tooth_spacing)
X = UnitX(Factor=series_3)
sample_tooth_number_4 = Panel(sample_tooth_number_3)
milling_it_radius = Panel(multiplication_3)
subtraction = Subtraction(A=sample_tooth_number_3, B="0.5")
move_2 = Move(Geometry=rotate_2.Geometry, Motion=X)  # -> Geometry, Transform
multiplication_11 = Multiplication(A=sample_tooth_number_4, B=tooth_spacing_3)
area = Area(Geometry=move_2.Geometry)  # -> Area, Centroid
pt = ConstructPoint(XCoordinate=multiplication_11, YCoordinate=0, ZCoordinate=0)
multiplication_12 = Multiplication(A=subtraction, B=tooth_spacing_2)
multiplication_13 = Multiplication(A=sample_tooth_number_3, B=tooth_spacing_2)
deplane = DeconstructPlane(Plane=xy)  # -> Origin, XAxis, YAxis, ZAxis
merge = Merge(Data1=flatten(area.Centroid), Data2=flatten(pt))
amp = Amplitude(Vector=deplane.YAxis, Amplitude=milling_it_radius)
amp_2 = Amplitude(Vector=deplane.XAxis, Amplitude=multiplication_12)
amp_3 = Amplitude(Vector=deplane.XAxis, Amplitude=multiplication_13)
intcrv = Interpolate(Vertices=merge, Degree=3, Periodic=False, KnotStyle=1)  # -> Curve, Length, Domain
rev = Reverse(Vector=amp)
move_3 = Move(Geometry=deplane.Origin, Motion=amp_2)  # -> Geometry, Transform
move_4 = Move(Geometry=deplane.Origin, Motion=amp_3)  # -> Geometry, Transform
move_5 = Move(Geometry=move_3.Geometry, Motion=rev)  # -> Geometry, Transform
yz = YZPlane(Origin=move_5.Geometry)
crv = Curve(intcrv.Curve)
mirror = Mirror(Geometry=crv, Plane=yz)  # -> Geometry, Transform
ccx = CurveCurve(CurveA=crv, CurveB=mirror.Geometry)  # -> Points, ParamsA, ParamsB
shatter = Shatter(Curve=crv, Parameters=ccx.ParamsA)
rev_2 = ReverseList(List=shatter)
milling_it_radius_2 = Panel(milling_it_radius)
tooth_fillet_radius_2 = Panel(tooth_fillet_radius)
item_2 = ListItem(List=rev_2, Index=0, Wrap=True)
mirror_2 = Mirror(Geometry=item_2, Plane=yz)  # -> Geometry, Transform
pt_2 = Point(move_4.Geometry)
pt_3 = Point(deplane.Origin)
addition_2 = Addition(A=tooth_fillet_radius_2, B=milling_it_radius_2)
join = JoinCurves(Curves=[item_2, mirror_2.Geometry], Preserve=False)
vec2pt = Vector2Pt(PointA=pt_2, PointB=pt_3, Unitize=False)  # -> Vector, Length
fillet = Fillet(Curve=join, Radius=addition_2)
move_6 = Move(Geometry=fillet, Motion=vec2pt.Vector)  # -> Geometry, Transform

# ---- group: Offset tooth profile to prepare for copying
tooth_spacing_4 = Panel(tooth_spacing)
milling_it_radius_3 = Panel(milling_it_radius)
tooth_profile_for_offset = Curve(move_6.Geometry)
xy_2 = XYPlane(Origin=Point(0, 0, 0))
neg_3 = Negative(Value=tooth_spacing_4)
X_2 = UnitX(Factor=tooth_spacing_4)
X_3 = UnitX(Factor=neg_3)
move_7 = Move(Geometry=tooth_profile_for_offset, Motion=X_2)  # -> Geometry, Transform
move_8 = Move(Geometry=tooth_profile_for_offset, Motion=X_3)  # -> Geometry, Transform
end = EndPoints(Curve=tooth_profile_for_offset)  # -> Start, End
join_2 = JoinCurves(Curves=flatten([move_8.Geometry, tooth_profile_for_offset, move_7.Geometry]), Preserve=False)
yz_2 = YZPlane(Origin=[end.Start, end.End])
offset = Offset(Curve=join_2, Distance=milling_it_radius_3, Plane=xy_2, Corners=2)
pcx = CurvePlane(Curve=offset, Plane=yz_2)  # -> Points, ParamsC, ParamsP
shatter_2 = Shatter(Curve=offset, Parameters=flatten(pcx.ParamsC))
item_3 = ListItem(List=shatter_2, Index="1", Wrap=True)
offset_tooth_for_copy_and_join = Curve(item_3)

# ----
distance_covered_per_step_3 = Panel(distance_covered_per_step)
division_10 = Division(A="1", B=distance_covered_per_step_3)
steps_per_mm = Number(division_10)
steps_per_mm_2 = ClusterOutput(steps_per_mm)

# ---- group: Create and blend pinion teeth
eval = EvaluateLength(Curve=fillet, Length="0.5", Normalized=True)  # -> Point, Tangent, Parameter
pdecon = Deconstruct(Point=eval.Point)  # -> XComponent, YComponent, ZComponent
milling_it_radius_4 = Panel(milling_bit_radius)
pinion_corner_tolerance = Panel(neg)
subtraction_2 = Subtraction(A=pdecon.YComponent, B=milling_it_radius_4)
subtraction_3 = Subtraction(A=subtraction_2, B=milling_it_radius_4)
subtraction_4 = Subtraction(A=subtraction_3, B=pinion_corner_tolerance)
pt_4 = ConstructPoint(XCoordinate=0, YCoordinate=subtraction_4, ZCoordinate=0)
rounding_factor_pinion_outside_2 = Panel(rounding_factor_pinion_outside)
xy_3 = XYPlane(Origin=pt_4)
division_11 = Division(A="360", B=multiplication_5)
rounding_factor_pinion_inside_2 = Panel(rounding_factor_pinion_inside)
subtraction_5 = Subtraction(A="0", B=rounding_factor_pinion_outside_2)
addition_3 = Addition(A="180", B=rounding_factor_pinion_outside_2)
rad_3 = Radians(Degrees=addition_3)
rad_4 = Radians(Degrees=subtraction_5)
subtraction_6 = Subtraction(A="180", B=rounding_factor_pinion_inside_2)
addition_4 = Addition(A="0", B=rounding_factor_pinion_inside_2)
milling_it_radius_5 = Panel(milling_it_radius_4)
dom = ConstructDomain(DomainStart=rad_4, DomainEnd=rad_3)
xy_4 = XYPlane(Origin=Point(0, 0, 0))
rad_5 = Radians(Degrees=subtraction_6)
rad_6 = Radians(Degrees=addition_4)
dom_2 = ConstructDomain(DomainStart=rad_6, DomainEnd=rad_5)
pi_2 = Pi(Factor=1)
arc = Arc(Plane=xy_4, Radius=milling_it_radius_5, Angle=dom)  # -> Arc, Length
arc_2 = Arc(Plane=xy_3, Radius=milling_it_radius_5, Angle=dom_2)  # -> Arc, Length
rad_7 = Radians(Degrees=division_11)
rotate_3 = Rotate(Geometry=arc.Arc, Angle=pi_2, Plane=xy_4)  # -> Geometry, Transform
addition_5 = Addition(A=rad, B=rad_7)
number_slider = Slider(0.5, range=0..1)
rotate_4 = Rotate(Geometry=rotate_3.Geometry, Angle=rad, Plane=move.Geometry)  # -> Geometry, Transform
rotate_5 = Rotate(Geometry=arc_2.Arc, Angle=addition_5, Plane=move.Geometry)  # -> Geometry, Transform
flip = FlipCurve(Curve=rotate_4.Geometry)  # -> Curve, Flag
flip_2 = FlipCurve(Curve=rotate_5.Geometry)  # -> Curve, Flag
pinion_radius_2 = Panel(pinion_radius)
shift = ShiftList(List=flip.Curve, Shift=1, Wrap=True)
blendc = BlendCurve(CurveA=rotate_4.Geometry, CurveB=flip_2.Curve, BulgeA=number_slider, BulgeB=number_slider, Continuity=2)
blendc_2 = BlendCurve(CurveA=shift, CurveB=rotate_5.Geometry, BulgeA=number_slider, BulgeB=number_slider, Continuity=2)
neg_4 = Negative(Value=pinion_radius_2)
Y_2 = UnitY(Factor=neg_4)
cir_2 = Circle(Plane=move.Geometry, Radius=multiplication_4)
join_3 = JoinCurves(Curves=flatten([rotate_4.Geometry, rotate_5.Geometry, blendc, blendc_2]), Preserve=False)
move_9 = Move(Geometry=join_3, Motion=Y_2)  # -> Geometry, Transform
pinion_teeth = Curve(move_9.Geometry)

# ----
move_10 = Move(Geometry=cir_2, Motion=Y_2)  # -> Geometry, Transform

# ---- group: Create and blend pinion teeth (continued)
pinion_center_hole = Curve(move_10.Geometry)

# ---- group: Create pinion movement preview
preview_position_0_1_3 = Number(preview_position_0_1_2)
pinion_radius_3 = Panel(pinion_radius)
pinion_circumference_3 = Panel(pinion_circumference)
multiplication_14 = Multiplication(A="360", B=preview_position_0_1_3)
multiplication_15 = Multiplication(A=pinion_circumference_3, B=preview_position_0_1_3)
neg_5 = Negative(Value=multiplication_14)
X_4 = UnitX(Factor=multiplication_15)
rad_8 = Radians(Degrees=neg_5)
rotate_6 = Rotate(Geometry=flatten([join_3, cir_2]), Angle=rad_8, Plane=move.Geometry)  # -> Geometry, Transform
move_11 = Move(Geometry=rotate_6.Geometry, Motion=X_4)  # -> Geometry, Transform
neg_6 = Negative(Value=pinion_radius_3)
Y_3 = UnitY(Factor=neg_6)
move_12 = Move(Geometry=move_11.Geometry, Motion=Y_3)  # -> Geometry, Transform
pinion_movement_preview = Curve(move_12.Geometry)

# ---- group: Make pinion bit statisitics
pinion_radius_4 = Panel(pinion_radius)
rotate_7 = Rotate(Geometry=move.Geometry, Angle=4.71238898, Plane=move.Geometry)  # -> Geometry, Transform
pinion_teeth_2 = Curve(join_3)
cir_3 = Circle(Plane=rotate_7.Geometry, Radius=pinion_radius_4)
trim = TrimWithRegion(Curve=cir_3, Region=pinion_teeth_2)  # -> Inside, Outside
item_4 = ListItem(List=trim.Outside, Index=0, Wrap=True)
len = Length(Curve=flatten(item_4))
maxium_pinion_milling_bit_diamter = Panel(len)

# ----
maxium_pinion_milling_bit_diamter_2 = Panel(maxium_pinion_milling_bit_diamter)
maxium_pinion_milling_bit_diamter_3 = Number(maxium_pinion_milling_bit_diamter_2)
pinion_movement_preview_2 = Curve(pinion_movement_preview)
pinion_center_hole_2 = Curve(pinion_center_hole)
pinion_teeth_3 = Curve(pinion_teeth)
pinion_teeth_4 = ClusterOutput(pinion_teeth_3)
pinion_center_hole_3 = ClusterOutput(pinion_center_hole_2)
maxium_pinion_milling_bit_diamter_4 = ClusterOutput(maxium_pinion_milling_bit_diamter_3)
pinion_movement_preview_3 = ClusterOutput(pinion_movement_preview_2)

# ---- group: Create rack by copying and offsetting rack tooth
tooth_spacing_5 = Panel(tooth_spacing)
rack_length_5 = Panel(rack_length_4)
milling_bit_radius_2 = Panel(multiplication_3)
tooth_profile_for_copy_and_join = Curve(offset_tooth_for_copy_and_join)
pinion_radius_5 = Panel(pinion_radius)
addition_6 = Addition(A=pinion_radius_5, B=milling_bit_radius_2)
multiplication_16 = Multiplication(A=addition_6, B="2")
addition_7 = Addition(A=rack_length_5, B=multiplication_16)
division_12 = Division(A=addition_6, B=tooth_spacing_5)
actual_rack_length = Panel(addition_7)
round_2 = Round(Number=division_12)  # -> Nearest, Floor, Ceiling
multiplication_17 = Multiplication(A=round_2.Ceiling, B=tooth_spacing_5)
division_13 = Division(A=actual_rack_length, B=tooth_spacing_5)
neg_7 = Negative(Value=addition_6)
neg_8 = Negative(Value=multiplication_17)
round_3 = Round(Number=division_13)  # -> Nearest, Floor, Ceiling
rack_start_distance = Panel(neg_8)
rack_cut_start_distance = Panel(neg_7)
addition_8 = Addition(A=round_3.Ceiling, B="1")
series_4 = Series(Start=0, Step=tooth_spacing_5, Count=addition_8)
X_5 = UnitX(Factor=rack_start_distance)
move_13 = Move(Geometry=tooth_profile_for_copy_and_join, Motion=X_5)  # -> Geometry, Transform
X_6 = UnitX(Factor=series_4)
move_14 = Move(Geometry=move_13.Geometry, Motion=X_6)  # -> Geometry, Transform
pinion_radius_6 = Panel(pinion_radius)
join_4 = JoinCurves(Curves=move_14.Geometry, Preserve=False)
neg_9 = Negative(Value=pinion_radius_6)
Y_4 = UnitY(Factor=neg_9)
move_15 = Move(Geometry=join_4, Motion=Y_4)  # -> Geometry, Transform; disabled
rack_teeth = Curve(move_15.Geometry)

# ----
end_2 = EndPoints(Curve=move_13.Geometry)  # -> Start, End
dist = Distance(PointA=end_2.Start, PointB=end_2.End)
panel = Panel(dist)
move_16 = Move(Geometry=move_14.Geometry, Motion=Y_4)  # -> Geometry, Transform

# ---- group: Create rack by copying and offsetting rack tooth (continued)
rack_teeth_unjoined = Curve(move_16.Geometry)

# ---- group: Trim rack to specified length
rack_cut_start_distance_2 = Panel(rack_cut_start_distance)
actual_rack_length_2 = Panel(actual_rack_length)
pinion_diameter_2 = Panel(pinion_diameter)
rack_teeth_2 = Curve(rack_teeth)
pt_5 = ConstructPoint(XCoordinate=rack_cut_start_distance_2, YCoordinate=0, ZCoordinate=0)
xy_5 = XYPlane(Origin=pt_5)
neg_10 = Negative(Value=pinion_diameter_2)
rectangle = Rectangle(Plane=xy_5, XSize=actual_rack_length_2, YSize=neg_10, Radius=0)  # -> Rectangle, Length
trim_2 = TrimWithRegion(Curve=rack_teeth_2, Region=rectangle.Rectangle)  # -> Inside, Outside
bbox = BoundingBox(Content=trim_2.Inside, Plane=PlaneXY(0, 0, 0))  # -> Box, Box_2
edges = BrepEdges(Brep=bbox.Box)  # -> Naked, Interior, NonManifold
item_5 = ListItem(List=edges.Naked, Index="2", Wrap=True)
flip_3 = FlipCurve(Curve=item_5)  # -> Curve, Flag
rack_tooth_edge = Curve(flip_3.Curve)
trimmed_rack_teeth = Curve(trim_2.Inside)

# ----
rack_teeth_trimmed_and_joined = Curve(trimmed_rack_teeth)
rack_teeth_3 = Curve(rack_teeth_unjoined)
rack_teeth_4 = ClusterOutput(rack_teeth_3)

pinion_radius_7 = Panel(pinion_radius)
milling_bit_radius_3 = Panel(multiplication_3)
addition_9 = Addition(A=pinion_radius_7, B=milling_bit_radius_3)
cir_4 = Circle(Plane=move.Geometry, Radius=addition_9)

move_17 = Move(Geometry=cir_4, Motion=Y_2)  # -> Geometry, Transform

pinion_edge = Curve(move_17.Geometry)

pinion_edge_2 = Curve(pinion_edge)
pinion_edge_3 = ClusterOutput(pinion_edge_2)

# ==== cluster RollerRackAndPinionMaker_2: Makes rack and pinion gemetry suitable for 3 axis CNC milling. Has low backlash, but is vulnerable to contamination. More options inside component.
number_of_pinion_teeth = ClusterInput()
milling_bit_diameter = ClusterInput()
motor_shaft_diameter = ClusterInput()
rack_length = ClusterInput()

# ---- group: Smaller amount of teeth gives higher resolution and more torque
number_of_pinion_teeth_2 = Panel("10")
number_of_pinion_teeth_3 = Number(number_of_pinion_teeth)
null = NullItem(Item=number_of_pinion_teeth_3)  # -> NullFlags, InvalidFlags, Description
filter = StreamFilter(Gate=null.NullFlags, Stream0=number_of_pinion_teeth_3, Stream1=number_of_pinion_teeth_2)
number_of_pinion_teeth_4 = Panel(filter)

# ---- group: Determines the tooth sppacing, some margin recommended
milling_bit_diameter_2 = Panel("3.1")
milling_bit_diameter_3 = Number(milling_bit_diameter)
null_2 = NullItem(Item=milling_bit_diameter_3)  # -> NullFlags, InvalidFlags, Description
filter_2 = StreamFilter(Gate=null_2.NullFlags, Stream0=milling_bit_diameter_3, Stream1=milling_bit_diameter_2)
milling_bit_diameter_4 = Panel(filter_2)

# ---- group: Determines the travel distance of pinion
rack_length_2 = Panel("200")
rack_length_3 = Number(rack_length)
# default config for 2mm pinion milling and 3mm rack milling: bit diamter: 3.1
# margin factor: -0.14
# number of pinion teeth: 10
# fillet ratio: 0.15
null_3 = NullItem(Item=rack_length_3)  # -> NullFlags, InvalidFlags, Description
filter_3 = StreamFilter(Gate=null_3.NullFlags, Stream0=rack_length_3, Stream1=rack_length_2)
rack_length_4 = Panel(filter_3)

# ---- group: The shaft diameter of the motor driving the pinion
motor_shaft_diameter_2 = Panel("5")
motor_shaft_diameter_3 = Number(motor_shaft_diameter)
null_4 = NullItem(Item=motor_shaft_diameter_3)  # -> NullFlags, InvalidFlags, Description
filter_4 = StreamFilter(Gate=null_4.NullFlags, Stream0=motor_shaft_diameter_3, Stream1=motor_shaft_diameter_2)
motor_shaft_diameter_4 = Panel(filter_4)

# ----
preview_position_0_1 = ClusterInput()
preview_position = Slider(0.25, range=0..1)

# ---- group: Low fillet ratio gives smoother motion, but makes a less robust pinion
tooth_fillet_ratio = Slider(0.15, range=0..1)
tooth_fillet_ratio_2 = Panel(tooth_fillet_ratio)

# ---- group: Controlls pinion tooth blending
rounding_factor_pinion_outside = Slider(20, range=0..100)
rounding_factor_pinion_inside = Slider(70, range=0..100)

# ---- group: Start numbers to help calculte pinion tooth path through rack
number_of_curve_sample_points = Slider(20, range=0..1000)
sample_tooth_position = Panel("0.26")

# ---- group: Lower number gives more clearene between rack tooth and pinion valley
pinion_corner_tolerance_factor = Panel("15")

# ---- group: Fill in for correct step statistics
number_of_stepper_motor_steps = Panel("200")
microstep_level = Panel("4")

# ----
preview_position_0_1_2 = Number(preview_position_0_1)

# ---- group: Can be used to reduce or increase the pinion tooth spacing
pinion_tooth_spacing_factor = Panel("-0.14")

# ---- group: Prepare properties
multiplication = Multiplication(A=milling_bit_diameter_4, B=pinion_tooth_spacing_factor)
multiplication_2 = Multiplication(A=number_of_pinion_teeth_4, B=sample_tooth_position)
division = Division(A=milling_bit_diameter_4, B=pinion_corner_tolerance_factor)
addition = Addition(A=milling_bit_diameter_4, B=multiplication)
multiplication_3 = Multiplication(A=milling_bit_diameter_4, B="0.5")
multiplication_4 = Multiplication(A=motor_shaft_diameter_4, B="0.5")
round = Round(Number=multiplication_2)  # -> Nearest, Floor, Ceiling
multiplication_5 = Multiplication(A=number_of_pinion_teeth_4, B="2")
neg = Negative(Value=division)
multiplication_6 = Multiplication(A=milling_bit_diameter_4, B=tooth_fillet_ratio_2)
milling_bit_radius = Panel(multiplication_3)
xy = XYPlane(Origin=Point(0, 0, 0))
sample_tooth_number = Panel(round.Ceiling)
multiplication_7 = Multiplication(A=addition, B=multiplication_5)
tooth_fillet_radius = Panel(multiplication_6)
pinion_circumference = Panel(multiplication_7)
cir = Circle(Plane=xy, Radius=milling_bit_radius)
pi = Pi(Factor=1)
division_2 = Division(A=pinion_circumference, B=pi)
number_of_pinion_teeth_5 = Panel(number_of_pinion_teeth_4)
pinion_diameter = Panel(division_2)
sample_tooth_number_2 = Panel(sample_tooth_number)
number_of_curve_sample_points_2 = Panel(number_of_curve_sample_points)
multiplication_8 = Multiplication(A=pinion_diameter, B="0.5")
division_3 = Division(A=sample_tooth_number_2, B=number_of_pinion_teeth_5)
pinion_radius = Panel(multiplication_8)
pinion_circumference_2 = Panel(pinion_circumference)
multiplication_9 = Multiplication(A="360", B=division_3)
Y = UnitY(Factor=pinion_radius)
division_4 = Division(A="360", B=number_of_pinion_teeth_5)
multiplication_10 = Multiplication(A=pinion_circumference_2, B=division_3)
division_5 = Division(A=multiplication_9, B=number_of_curve_sample_points_2)
division_6 = Division(A=pinion_circumference, B=number_of_pinion_teeth_4)
move = Move(Geometry=xy, Motion=Y)  # -> Geometry, Transform
series = Series(Start=0, Step=division_4, Count=number_of_pinion_teeth_5)
division_7 = Division(A=multiplication_10, B=number_of_curve_sample_points_2)
series_2 = Series(Start=0, Step=division_5, Count=number_of_curve_sample_points_2)
tooth_spacing = Panel(division_6)
rad = Radians(Degrees=series)
circle = Circle(cir)
series_3 = Series(Start=0, Step=division_7, Count=number_of_curve_sample_points_2)
neg_2 = Negative(Value=series_2)
rotate = Rotate(Geometry=circle, Angle=rad, Plane=move.Geometry)  # -> Geometry, Transform
rad_2 = Radians(Degrees=neg_2)

# ---- group: Make step resolution statisitics
number_of_stepper_motor_steps_2 = Panel(number_of_stepper_motor_steps)
microstep_level_2 = Panel(microstep_level)
division_8 = Division(A=pinion_circumference, B=number_of_stepper_motor_steps_2)
distance_covered_per_step = Panel(division_8)
division_9 = Division(A=distance_covered_per_step, B=microstep_level_2)
distance_covered_per_micro_step = Panel(division_9)

# ---- group: Step statsistics
distance_covered_per_step_2 = Panel(distance_covered_per_step)
distance_covered_per_micro_step_2 = Panel(distance_covered_per_micro_step)

# ---- group: Create rack tooth geometry
sample_tooth_number_3 = Panel(sample_tooth_number_2)
tooth_spacing_2 = Panel(tooth_spacing)
item = ListItem(List=rotate.Geometry, Index=sample_tooth_number_3, Wrap=True)
rotate_2 = Rotate(Geometry=graft(item), Angle=rad_2, Plane=move.Geometry)  # -> Geometry, Transform
tooth_spacing_3 = Panel(tooth_spacing)
X = UnitX(Factor=series_3)
sample_tooth_number_4 = Panel(sample_tooth_number_3)
milling_it_radius = Panel(multiplication_3)
subtraction = Subtraction(A=sample_tooth_number_3, B="0.5")
move_2 = Move(Geometry=rotate_2.Geometry, Motion=X)  # -> Geometry, Transform
multiplication_11 = Multiplication(A=sample_tooth_number_4, B=tooth_spacing_3)
area = Area(Geometry=move_2.Geometry)  # -> Area, Centroid
pt = ConstructPoint(XCoordinate=multiplication_11, YCoordinate=0, ZCoordinate=0)
multiplication_12 = Multiplication(A=subtraction, B=tooth_spacing_2)
multiplication_13 = Multiplication(A=sample_tooth_number_3, B=tooth_spacing_2)
deplane = DeconstructPlane(Plane=xy)  # -> Origin, XAxis, YAxis, ZAxis
merge = Merge(Data1=flatten(area.Centroid), Data2=flatten(pt))
amp = Amplitude(Vector=deplane.YAxis, Amplitude=milling_it_radius)
amp_2 = Amplitude(Vector=deplane.XAxis, Amplitude=multiplication_12)
amp_3 = Amplitude(Vector=deplane.XAxis, Amplitude=multiplication_13)
intcrv = Interpolate(Vertices=merge, Degree=3, Periodic=False, KnotStyle=1)  # -> Curve, Length, Domain
rev = Reverse(Vector=amp)
move_3 = Move(Geometry=deplane.Origin, Motion=amp_2)  # -> Geometry, Transform
move_4 = Move(Geometry=deplane.Origin, Motion=amp_3)  # -> Geometry, Transform
move_5 = Move(Geometry=move_3.Geometry, Motion=rev)  # -> Geometry, Transform
yz = YZPlane(Origin=move_5.Geometry)
crv = Curve(intcrv.Curve)
mirror = Mirror(Geometry=crv, Plane=yz)  # -> Geometry, Transform
ccx = CurveCurve(CurveA=crv, CurveB=mirror.Geometry)  # -> Points, ParamsA, ParamsB
shatter = Shatter(Curve=crv, Parameters=ccx.ParamsA)
rev_2 = ReverseList(List=shatter)
milling_it_radius_2 = Panel(milling_it_radius)
tooth_fillet_radius_2 = Panel(tooth_fillet_radius)
item_2 = ListItem(List=rev_2, Index=0, Wrap=True)
mirror_2 = Mirror(Geometry=item_2, Plane=yz)  # -> Geometry, Transform
pt_2 = Point(move_4.Geometry)
pt_3 = Point(deplane.Origin)
addition_2 = Addition(A=tooth_fillet_radius_2, B=milling_it_radius_2)
join = JoinCurves(Curves=[item_2, mirror_2.Geometry], Preserve=False)
vec2pt = Vector2Pt(PointA=pt_2, PointB=pt_3, Unitize=False)  # -> Vector, Length
fillet = Fillet(Curve=join, Radius=addition_2)
move_6 = Move(Geometry=fillet, Motion=vec2pt.Vector)  # -> Geometry, Transform

# ---- group: Offset tooth profile to prepare for copying
tooth_spacing_4 = Panel(tooth_spacing)
milling_it_radius_3 = Panel(milling_it_radius)
tooth_profile_for_offset = Curve(move_6.Geometry)
xy_2 = XYPlane(Origin=Point(0, 0, 0))
neg_3 = Negative(Value=tooth_spacing_4)
X_2 = UnitX(Factor=tooth_spacing_4)
X_3 = UnitX(Factor=neg_3)
move_7 = Move(Geometry=tooth_profile_for_offset, Motion=X_2)  # -> Geometry, Transform
move_8 = Move(Geometry=tooth_profile_for_offset, Motion=X_3)  # -> Geometry, Transform
end = EndPoints(Curve=tooth_profile_for_offset)  # -> Start, End
join_2 = JoinCurves(Curves=flatten([move_8.Geometry, tooth_profile_for_offset, move_7.Geometry]), Preserve=False)
yz_2 = YZPlane(Origin=[end.Start, end.End])
offset = Offset(Curve=join_2, Distance=milling_it_radius_3, Plane=xy_2, Corners=2)
pcx = CurvePlane(Curve=offset, Plane=yz_2)  # -> Points, ParamsC, ParamsP
shatter_2 = Shatter(Curve=offset, Parameters=flatten(pcx.ParamsC))
item_3 = ListItem(List=shatter_2, Index="1", Wrap=True)
offset_tooth_for_copy_and_join = Curve(item_3)

# ---- group: Create rack by copying and offsetting rack tooth
tooth_spacing_5 = Panel(tooth_spacing)
rack_length_5 = Panel(rack_length_4)
milling_bit_radius_2 = Panel(multiplication_3)
tooth_profile_for_copy_and_join = Curve(offset_tooth_for_copy_and_join)
pinion_radius_2 = Panel(pinion_radius)
addition_3 = Addition(A=pinion_radius_2, B=milling_bit_radius_2)
multiplication_14 = Multiplication(A=addition_3, B="2")
addition_4 = Addition(A=rack_length_5, B=multiplication_14)
division_10 = Division(A=addition_3, B=tooth_spacing_5)
actual_rack_length = Panel(addition_4)
round_2 = Round(Number=division_10)  # -> Nearest, Floor, Ceiling
multiplication_15 = Multiplication(A=round_2.Ceiling, B=tooth_spacing_5)
division_11 = Division(A=actual_rack_length, B=tooth_spacing_5)
neg_4 = Negative(Value=addition_3)
neg_5 = Negative(Value=multiplication_15)
round_3 = Round(Number=division_11)  # -> Nearest, Floor, Ceiling
rack_start_distance = Panel(neg_5)
rack_cut_start_distance = Panel(neg_4)
addition_5 = Addition(A=round_3.Ceiling, B="1")
series_4 = Series(Start=0, Step=tooth_spacing_5, Count=addition_5)
X_4 = UnitX(Factor=rack_start_distance)
move_9 = Move(Geometry=tooth_profile_for_copy_and_join, Motion=X_4)  # -> Geometry, Transform
X_5 = UnitX(Factor=series_4)
move_10 = Move(Geometry=move_9.Geometry, Motion=X_5)  # -> Geometry, Transform
pinion_radius_3 = Panel(pinion_radius)
join_3 = JoinCurves(Curves=move_10.Geometry, Preserve=False)
neg_6 = Negative(Value=pinion_radius_3)
Y_2 = UnitY(Factor=neg_6)
move_11 = Move(Geometry=join_3, Motion=Y_2)  # -> Geometry, Transform
rack_teeth = Curve(move_11.Geometry)

# ---- group: Trim rack to specified length
rack_cut_start_distance_2 = Panel(rack_cut_start_distance)
actual_rack_length_2 = Panel(actual_rack_length)
pinion_diameter_2 = Panel(pinion_diameter)
rack_teeth_2 = Curve(rack_teeth)
pt_4 = ConstructPoint(XCoordinate=rack_cut_start_distance_2, YCoordinate=0, ZCoordinate=0)
xy_3 = XYPlane(Origin=pt_4)
neg_7 = Negative(Value=pinion_diameter_2)
rectangle = Rectangle(Plane=xy_3, XSize=actual_rack_length_2, YSize=neg_7, Radius=0)  # -> Rectangle, Length
trim = TrimWithRegion(Curve=rack_teeth_2, Region=rectangle.Rectangle)  # -> Inside, Outside
bbox = BoundingBox(Content=trim.Inside, Plane=PlaneXY(0, 0, 0))  # -> Box, Box_2
edges = BrepEdges(Brep=bbox.Box)  # -> Naked, Interior, NonManifold
item_4 = ListItem(List=edges.Naked, Index="2", Wrap=True)
flip = FlipCurve(Curve=item_4)  # -> Curve, Flag
rack_tooth_edge = Curve(flip.Curve)
trimmed_rack_teeth = Curve(trim.Inside)

# ----
distance_covered_per_step_3 = Panel(distance_covered_per_step)
distance_covered_per_step_4 = Number(distance_covered_per_step_3)
rack_teeth_3 = Curve(trimmed_rack_teeth)
rack_edge = Curve(rack_tooth_edge)
rack_teeth_4 = ClusterOutput(rack_teeth_3)
rack_edge_2 = ClusterOutput(rack_edge)
distance_covered_per_step_5 = ClusterOutput(distance_covered_per_step_4)

# ---- group: Create and blend pinion teeth
eval = EvaluateLength(Curve=fillet, Length="0.5", Normalized=True)  # -> Point, Tangent, Parameter
pdecon = Deconstruct(Point=eval.Point)  # -> XComponent, YComponent, ZComponent
milling_it_radius_4 = Panel(milling_bit_radius)
pinion_corner_tolerance = Panel(neg)
subtraction_2 = Subtraction(A=pdecon.YComponent, B=milling_it_radius_4)
subtraction_3 = Subtraction(A=subtraction_2, B=milling_it_radius_4)
subtraction_4 = Subtraction(A=subtraction_3, B=pinion_corner_tolerance)
pt_5 = ConstructPoint(XCoordinate=0, YCoordinate=subtraction_4, ZCoordinate=0)
rounding_factor_pinion_outside_2 = Panel(rounding_factor_pinion_outside)
xy_4 = XYPlane(Origin=pt_5)
division_12 = Division(A="360", B=multiplication_5)
rounding_factor_pinion_inside_2 = Panel(rounding_factor_pinion_inside)
subtraction_5 = Subtraction(A="0", B=rounding_factor_pinion_outside_2)
addition_6 = Addition(A="180", B=rounding_factor_pinion_outside_2)
rad_3 = Radians(Degrees=addition_6)
rad_4 = Radians(Degrees=subtraction_5)
subtraction_6 = Subtraction(A="180", B=rounding_factor_pinion_inside_2)
addition_7 = Addition(A="0", B=rounding_factor_pinion_inside_2)
milling_it_radius_5 = Panel(milling_it_radius_4)
dom = ConstructDomain(DomainStart=rad_4, DomainEnd=rad_3)
xy_5 = XYPlane(Origin=Point(0, 0, 0))
rad_5 = Radians(Degrees=subtraction_6)
rad_6 = Radians(Degrees=addition_7)
dom_2 = ConstructDomain(DomainStart=rad_6, DomainEnd=rad_5)
pi_2 = Pi(Factor=1)
arc = Arc(Plane=xy_5, Radius=milling_it_radius_5, Angle=dom)  # -> Arc, Length
arc_2 = Arc(Plane=xy_4, Radius=milling_it_radius_5, Angle=dom_2)  # -> Arc, Length
rad_7 = Radians(Degrees=division_12)
rotate_3 = Rotate(Geometry=arc.Arc, Angle=pi_2, Plane=xy_5)  # -> Geometry, Transform
addition_8 = Addition(A=rad, B=rad_7)
number_slider = Slider(0.5, range=0..1)
rotate_4 = Rotate(Geometry=rotate_3.Geometry, Angle=rad, Plane=move.Geometry)  # -> Geometry, Transform
rotate_5 = Rotate(Geometry=arc_2.Arc, Angle=addition_8, Plane=move.Geometry)  # -> Geometry, Transform
flip_2 = FlipCurve(Curve=rotate_4.Geometry)  # -> Curve, Flag
flip_3 = FlipCurve(Curve=rotate_5.Geometry)  # -> Curve, Flag
pinion_radius_4 = Panel(pinion_radius)
shift = ShiftList(List=flip_2.Curve, Shift=1, Wrap=True)
blendc = BlendCurve(CurveA=rotate_4.Geometry, CurveB=flip_3.Curve, BulgeA=number_slider, BulgeB=number_slider, Continuity=2)
blendc_2 = BlendCurve(CurveA=shift, CurveB=rotate_5.Geometry, BulgeA=number_slider, BulgeB=number_slider, Continuity=2)
neg_8 = Negative(Value=pinion_radius_4)
Y_3 = UnitY(Factor=neg_8)
cir_2 = Circle(Plane=move.Geometry, Radius=multiplication_4)
join_4 = JoinCurves(Curves=flatten([rotate_4.Geometry, rotate_5.Geometry, blendc, blendc_2]), Preserve=False)
move_12 = Move(Geometry=join_4, Motion=Y_3)  # -> Geometry, Transform
pinion_teeth = Curve(move_12.Geometry)

# ----
move_13 = Move(Geometry=cir_2, Motion=Y_3)  # -> Geometry, Transform

# ---- group: Create and blend pinion teeth (continued)
pinion_center_hole = Curve(move_13.Geometry)

# ---- group: Create pinion movement preview
preview_position_0_1_3 = Number(preview_position_0_1_2)
pinion_radius_5 = Panel(pinion_radius)
pinion_circumference_3 = Panel(pinion_circumference)
multiplication_16 = Multiplication(A="360", B=preview_position_0_1_3)
multiplication_17 = Multiplication(A=pinion_circumference_3, B=preview_position_0_1_3)
neg_9 = Negative(Value=multiplication_16)
X_6 = UnitX(Factor=multiplication_17)
rad_8 = Radians(Degrees=neg_9)
rotate_6 = Rotate(Geometry=flatten([join_4, cir_2]), Angle=rad_8, Plane=move.Geometry)  # -> Geometry, Transform
move_14 = Move(Geometry=rotate_6.Geometry, Motion=X_6)  # -> Geometry, Transform
neg_10 = Negative(Value=pinion_radius_5)
Y_4 = UnitY(Factor=neg_10)
move_15 = Move(Geometry=move_14.Geometry, Motion=Y_4)  # -> Geometry, Transform
pinion_movement_preview = Curve(move_15.Geometry)

# ---- group: Make pinion bit statisitics
pinion_radius_6 = Panel(pinion_radius)
rotate_7 = Rotate(Geometry=move.Geometry, Angle=4.71238898, Plane=move.Geometry)  # -> Geometry, Transform
pinion_teeth_2 = Curve(join_4)
cir_3 = Circle(Plane=rotate_7.Geometry, Radius=pinion_radius_6)
trim_2 = TrimWithRegion(Curve=cir_3, Region=pinion_teeth_2)  # -> Inside, Outside
item_5 = ListItem(List=trim_2.Outside, Index=0, Wrap=True)
len = Length(Curve=flatten(item_5))
maxium_pinion_milling_bit_diamter = Panel(len)

# ----
maxium_pinion_milling_bit_diamter_2 = Panel(maxium_pinion_milling_bit_diamter)
maxium_pinion_milling_bit_diamter_3 = Number(maxium_pinion_milling_bit_diamter_2)
pinion_movement_preview_2 = Curve(pinion_movement_preview)
pinion_center_hole_2 = Curve(pinion_center_hole)
pinion_teeth_3 = Curve(pinion_teeth)
pinion_teeth_4 = ClusterOutput(pinion_teeth_3)
pinion_center_hole_3 = ClusterOutput(pinion_center_hole_2)
pinion_movement_preview_3 = ClusterOutput(pinion_movement_preview_2)
maxium_pinion_milling_bit_diamter_4 = ClusterOutput(maxium_pinion_milling_bit_diamter_3)

pinion_radius_7 = Panel(pinion_radius)
milling_bit_radius_3 = Panel(multiplication_3)
addition_9 = Addition(A=pinion_radius_7, B=milling_bit_radius_3)
cir_4 = Circle(Plane=move.Geometry, Radius=addition_9)

move_16 = Move(Geometry=cir_4, Motion=Y_3)  # -> Geometry, Transform

pinion_edge = Curve(move_16.Geometry)

pinion_edge_2 = Curve(pinion_edge)
pinion_edge_3 = ClusterOutput(pinion_edge_2)
