# Grasshopper definition chamfer-rail-generator-for-humphito-axes.gh (Grasshopper 0.9.76)
# Copyright: Creative commons attribution share-a-like

# ---- group: Geometry type
rack_and_pinion_geometry_type = ValueList({"Nema17, max torque": 0, "Nema23, max torque": 1, "Nema23, stronger teeth": 2}, selected="Nema23, stronger teeth")
chamfer_geometry_for_2d = ValueList({"Open curve for v-bit": 0, "Surface for ballnose 3D mill": 1}, selected="Surface for ballnose 3D mill")
output_geometry_type = ValueList({"2D curves": 0, "3D brep": 1}, selected="2D curves")

# ---- group: Attachment holes
make_hole_pattern_along_center = ValueList({"No": 0, "Yes": 1}, selected="No")
# to do: fix hex nut in pocket
# make motor plate 2d nesting
# make axis plate 2d nesting
# make bake with metadata system
# make option for round corners on 3D axis?
# make option for ?
make_hole_pattern_along_edges = ValueList({"No": 0, "Yes": 1}, selected="Yes")
hole_grid_distance = Panel("70")
hole_diameter = Panel("5.2")
screw_pocket_diameter = Panel("12.5")
center_screw_pocket_depth = Panel("8")
edge_screw_pocket_depth = Panel("6")

# ---- group: Glideblock geometry
use_custom_hole_pattern = ValueList({"No": False, "Yes": True}, selected="No")
clearnace_from_axis_to_axis_plate = Panel("2")
glide_block_length = Panel("200")
distance_from_flat_pad_o_edge = Panel("1.5")
flat_pad_clerance = Panel("0.5")
milling_bit_diamter_for_clearing_flat_pa = Panel("6")  # "Milling bit diamter for clearing flat pad slot"
hole_diamter_for_tapping = Panel("4.5")
hole_diamter_for_slip_fit = Panel("5.15")
clamp_area_width = Panel("14")
hole_spacing = Panel("90")
first_hole_distance_from_edge = Panel("10")
custom_hole_pattern = Panel("""8
53
78""")
glide_block_fillet_radius = Panel("2")

# ---- group: Pinion geometry
default_pinion_outer_edge_diamter_to_sha = Panel("3")  # "Default pinion outer edge diamter to shaft diameter factor"
minimum_pinion_pipe_wall_thickness = Panel("5")
minimum_clearlance_from_tooth_to_outer_e = Panel("0.6")  # "Minimum clearlance from tooth to outer edge"
add_flat = Panel("False")
pinion_material_thickness = Panel("12.7")
extra_tooth_height_compared_to_rack_toot = Panel("0.2")  # "Extra tooth height compared to rack tooth heigth"
milling_bit_diameter_for_hole_marking = Panel("3")
hole_diamter_for_set_screws = Panel("3")
number_off_set_screws = Panel("3")

# ---- group: Axis dimensions
pinion_clearance_margin = Panel("3")
rack_tooth_height = Panel("4")
axis_length = Panel("320")
axis_width = Panel("127")
material_thickness = Panel("8")
# Standard dimensions: Axis width: 58mm or 127mm
# Material thickness: 8mm
# Chamfer distance: 4mm
# Hole grid distance: 70mm
# 
# Pinion clearance margin: 2mm
# Rack tooth height: 4mm
chamfer_distance = Panel("4")
corner_fillet_radius = Panel("5")

# ---- group: Edge chamfer
chamfer_line_overshoot = Panel("0.6")

# ---- group: Axis and motor plate geometry
motor_type = ValueList({"Nema17": 31, "Nema23": 47.14, "Oriental 60mm": 50}, selected="Nema23")
flange_hole_diameter = Panel("39")
adjustment_range_glideblock_and_motorpla = Panel("6")  # "Adjustment range glideblock and motorplate"
extra_offset_adjustable_holes = Panel("0.1")
pinon_distance_from_axis_edge = Panel("30")
motorplate_mount_spacing_x = Panel("46")
motorplate_mount_spacing_y = Panel("77")
motorplate_edge_thickness_from_holes = Panel("5")
motor_plate_attachment_type = ValueList({"Threaded holes": 0, "Trapped nut": 1}, selected="Threaded holes")
hex_nut_width_inc_margin = Panel("13.2")

# ---- group: Settings for Nema23, stronger teeth geometry
pinion_tooth_spacing_factor = Slider(-0.20635, range=-1..1)
motor_shaft_diameter = Slider(8, range=0..10)
tooth_fillet_ratio = Slider(0.1, range=0..1)
milling_bit_diameter = Panel("6.3")

# ---- group: Settings for Nema23, max resolution geometry
pinion_tooth_spacing_factor_2 = Slider(-0.107142, range=-1..1)
motor_shaft_diameter_2 = Slider(8, range=0..10)
tooth_fillet_ratio_2 = Slider(0.29, range=0..1)
milling_bit_diameter_2 = Panel("4.2")

# ---- group: Settings for Nema17, max resolution geometry
pinion_tooth_spacing_factor_3 = Slider(-0.131945, range=-1..1)
motor_shaft_diameter_3 = Slider(5, range=0..10)
tooth_fillet_ratio_3 = Slider(0.22, range=0..1)
milling_bit_diameter_3 = Panel("3.2")

# ----
number_of_pinion_teeth = Panel("6")
filter = StreamFilter(
    Gate=rack_and_pinion_geometry_type,
    Stream0=milling_bit_diameter_3,
    Stream1=milling_bit_diameter_2,
    Stream2=milling_bit_diameter)
filter_2 = StreamFilter(
    Gate=rack_and_pinion_geometry_type,
    Stream0=pinion_tooth_spacing_factor_3,
    Stream1=pinion_tooth_spacing_factor_2,
    Stream2=pinion_tooth_spacing_factor)
filter_3 = StreamFilter(
    Gate=rack_and_pinion_geometry_type,
    Stream0=tooth_fillet_ratio_3,
    Stream1=tooth_fillet_ratio_2,
    Stream2=tooth_fillet_ratio)
filter_4 = StreamFilter(
    Gate=rack_and_pinion_geometry_type,
    Stream0=motor_shaft_diameter_3,
    Stream1=motor_shaft_diameter_2,
    Stream2=motor_shaft_diameter)

# ---- group: Make rack and pinion geometry
roller_rack_and_pinion_maker = RollerRackAndPinionMaker(
    number_of_pinion_teeth=number_of_pinion_teeth,
    milling_bit_diameter=filter,
    tooth_fillet_ratio=filter_3,
    pinion_tooth_spacing_factor=filter_2,
    motor_shaft_diameter=filter_4)  # -> rack_teeth_4, pinion_teeth_4, pinion_center_hole_3, pinion_edge_3, steps_per_mm_2, maxium_pinion_milling_bit_diamter_4, pinion_movement_preview_3

# ---- group: Use this value in your motion controll
steps_per_mm_with_200_step_motor = Panel(roller_rack_and_pinion_maker.steps_per_mm_2)

# ---- group: Find rack tooth height and clearance margin needed
rack_teeth = Curve(roller_rack_and_pinion_maker.rack_teeth_4)
item = ListItem(List=flatten(rack_teeth), Index=0, Wrap=True)
bbox = BoundingBox(Content=item, Plane=PlaneXY(0, 0, 0))  # -> Box, Box_2
dim = Dimensions(Surface=bbox.Box)  # -> UDimension, VDimension
rack_tooth_height_2 = Panel(dim.VDimension)
addition = Addition(A=rack_tooth_height_2, B=pinion_clearance_margin)

# ---- group: Make grid spacing half for narrow rails
smaller = SmallerThan(FirstNumber=axis_width, SecondNumber=hole_grid_distance)  # -> SmallerThan, OrEqualTo
division = Division(A=hole_grid_distance, B="2")
filter_5 = StreamFilter(Gate=smaller.SmallerThan, Stream0=hole_grid_distance, Stream1=division)
hole_grid_distance_x = Panel(hole_grid_distance)
hole_grid_distance_y = Panel(filter_5)

# ----
gear_ratio_rotary_axis = Panel("8")

# ---- group: Make inside gear for rotary axis
slide_to_preview = Slider(0.32, range=0..1)
panel = Panel(filter_3)
multiplication = Multiplication(A=number_of_pinion_teeth, B=gear_ratio_rotary_axis)
inside_gear_for_pinion_maker = InsideGearForPinionMaker(
    number_of_gear_teeth=multiplication,
    milling_bit_diameter=filter,
    number_of_input_pinion_teeth=number_of_pinion_teeth,
    pinion_teeth_curve=roller_rack_and_pinion_maker.pinion_teeth_4,
    pinion_center_hole_curve=roller_rack_and_pinion_maker.pinion_center_hole_3,
    tooth_fillet_ratio=panel,
    preview_position_0_1=slide_to_preview)  # -> gear_teeth_4, gear_center_hole_3, gear_movement_preview_3, pinion_movement_preview_3; disabled
crv = Curve(inside_gear_for_pinion_maker.pinion_movement_preview_3)
crv_2 = Curve([inside_gear_for_pinion_maker.gear_movement_preview_3, inside_gear_for_pinion_maker.gear_center_hole_3])

# ---- group: Find number of teeth needed for axis length
rack_teeth_2 = Curve(roller_rack_and_pinion_maker.rack_teeth_4)
item_2 = ListItem(List=flatten(rack_teeth_2), Index=0, Wrap=True)
end = EndPoints(Curve=item_2)  # -> Start, End
dist = Distance(PointA=end.Start, PointB=end.End)
axis_length_2 = Panel(axis_length)
tooth_spacing = Panel(dist)
division_2 = Division(A=axis_length_2, B=tooth_spacing)
round = Round(Number=division_2)  # -> Nearest, Floor, Ceiling
number_of_teeth_in_axis = Panel(round.Nearest)

# ---- group: Make points for axis profile
material_thickness_2 = Panel(material_thickness)
chamfer_distance_2 = Panel(chamfer_distance)
axis_width_2 = Panel(axis_width)
multiplication_2 = Multiplication(A=axis_width_2, B="0.5")
subtraction = Subtraction(A=multiplication_2, B=chamfer_distance_2)
neg = Negative(Value=multiplication_2)
neg_2 = Negative(Value=chamfer_distance_2)
neg_3 = Negative(Value=multiplication_2)
neg_4 = Negative(Value=material_thickness_2)
neg_5 = Negative(Value=subtraction)
pt = ConstructPoint(XCoordinate=0, YCoordinate=subtraction, ZCoordinate=0)
pt_2 = ConstructPoint(XCoordinate=0, YCoordinate=neg_5, ZCoordinate=0)
pt_3 = ConstructPoint(XCoordinate=0, YCoordinate=multiplication_2, ZCoordinate=neg_4)
pt_4 = ConstructPoint(XCoordinate=0, YCoordinate=neg_3, ZCoordinate=neg_4)
pt_5 = ConstructPoint(XCoordinate=0, YCoordinate=multiplication_2, ZCoordinate=neg_2)
pt_6 = ConstructPoint(XCoordinate=0, YCoordinate=neg, ZCoordinate=neg_2)
merge = Merge(Data1=pt, Data2=pt_2, Data3=pt_6, Data4=pt_4, Data5=pt_3, Data6=pt_5)
pline = PolyLine(Vertices=merge, Closed=True)
axis_profile = Curve(pline)

# ---- group: Move first tooth to axis edge
pdecon = Deconstruct(Point=end.Start)  # -> XComponent, YComponent, ZComponent
pt_7 = ConstructPoint(XCoordinate=0, YCoordinate=pdecon.YComponent, ZCoordinate=pdecon.ZComponent)
vec2pt = Vector2Pt(PointA=end.Start, PointB=pt_7, Unitize=False)  # -> Vector, Length
move = Move(Geometry=item_2, Motion=vec2pt.Vector)  # -> Geometry, Transform

# ---- group: Prep pinion position
move_2 = Move(Geometry=roller_rack_and_pinion_maker.pinion_center_hole_3, Motion=vec2pt.Vector)  # -> Geometry, Transform
move_3 = Move(Geometry=roller_rack_and_pinion_maker.pinion_teeth_4, Motion=vec2pt.Vector)  # -> Geometry, Transform
pinion = Curve(flatten([move_3.Geometry, move_2.Geometry]))

# ---- group: Copy and join teeth for axis
series = Series(Start=0, Step=tooth_spacing, Count=number_of_teeth_in_axis)
X = UnitX(Factor=series)
move_4 = Move(Geometry=move.Geometry, Motion=X)  # -> Geometry, Transform
join = JoinCurves(Curves=move_4.Geometry, Preserve=False)
rack_teeth_3 = Curve(join)

# ---- group: Extrude axis
axis_length_3 = Panel(axis_length)
axis_profile_2 = Curve(axis_profile)
X_2 = UnitX(Factor=axis_length_3)
extr = Extrude(Base=axis_profile_2, Direction=X_2)
cap = CapHoles(Brep=extr)
axis_stock = Brep(cap)

# ---- group: Make rack pocket outline
pinion_clearance_margin_2 = Panel(addition)
rack_teeth_4 = Curve(rack_teeth_3)
pinion_2 = Curve(pinion)
bbox_2 = BoundingBox(Content=flatten([pinion_2, rack_teeth_4]), Plane=PlaneXY(0, 0, 0), UnionBox=True)  # -> Box, Box_2
edges = BrepEdges(Brep=bbox_2.Box)  # -> Naked, Interior, NonManifold
Y = UnitY(Factor=pinion_clearance_margin_2)
item_3 = ListItem(List=edges.Naked, Index="2", Wrap=True)
move_5 = Move(Geometry=item_3, Motion=Y)  # -> Geometry, Transform
end_2 = EndPoints(Curve=move_5.Geometry)  # -> Start, End
end_3 = EndPoints(Curve=rack_teeth_4)  # -> Start, End
merge_2 = Merge(Data1=flatten(end_3.Start), Data2=flatten(end_2.End), Data3=flatten(end_2.Start), Data4=flatten(end_3.End))
multiplication_3 = Multiplication(A=pinion_clearance_margin_2, B="0.5")
pline_2 = PolyLine(Vertices=merge_2, Closed=False)
neg_6 = Negative(Value=multiplication_3)
join_2 = JoinCurves(Curves=flatten([rack_teeth_4, pline_2]), Preserve=False)
Y_2 = UnitY(Factor=neg_6)
move_6 = Move(Geometry=join_2, Motion=Y_2)  # -> Geometry, Transform
rack_pocket_outline = Curve(move_6.Geometry)

# ---- group: Create holes
pinion_clearance_margin_3 = Panel(addition)
hole_diameter_2 = Panel(hole_diameter)
screw_pocket_diameter_2 = Panel(screw_pocket_diameter)
hole_grid_distance_x_2 = Panel(hole_grid_distance_x)
hole_grid_distance_y_2 = Panel(hole_grid_distance_y)
axis_length_4 = Panel(axis_length)
rack_pocket_outline_2 = Curve(rack_pocket_outline)
rack_teeth_5 = Curve(rack_teeth_3)
multiplication_4 = Multiplication(A=pinion_clearance_margin_3, B="0.5")
bbox_3 = BoundingBox(Content=flatten(rack_pocket_outline_2), Plane=PlaneXY(0, 0, 0), UnionBox=True)  # -> Box, Box_2
neg_7 = Negative(Value=multiplication_4)
division_3 = Division(A=axis_length_4, B=hole_grid_distance_x_2)
bbox_4 = BoundingBox(Content=flatten(rack_teeth_5), Plane=PlaneXY(0, 0, 0), UnionBox=True)  # -> Box, Box_2
multiplication_5 = Multiplication(A=hole_diameter_2, B="0.5")
multiplication_6 = Multiplication(A=screw_pocket_diameter_2, B="0.5")
Y_3 = UnitY(Factor=neg_7)
round_2 = Round(Number=division_3)  # -> Nearest, Floor, Ceiling
addition_2 = Addition(A=round_2.Floor, B="1")
move_7 = Move(Geometry=bbox_4.Box, Motion=Y_3)  # -> Geometry, Transform
multiplication_7 = Multiplication(A=round_2.Floor, B=hole_grid_distance_x_2)
edges_2 = BrepEdges(Brep=bbox_3.Box)  # -> Naked, Interior, NonManifold
edges_3 = BrepEdges(Brep=move_7.Geometry)  # -> Naked, Interior, NonManifold
subtraction_2 = Subtraction(A=axis_length_4, B=multiplication_7)
item_4 = ListItem(List=edges_2.Naked, Index=2, Wrap=True)
item_5 = ListItem(List=edges_3.Naked, Index=2, Wrap=True)
multiplication_8 = Multiplication(A=subtraction_2, B="0.5")
multiplication_9 = Multiplication(A=hole_grid_distance_y_2, B="0.5")
bbox_5 = BoundingBox(Content=flatten([item_4, item_5]), Plane=PlaneXY(0, 0, 0), UnionBox=True)  # -> Box, Box_2
neg_8 = Negative(Value=multiplication_9)
area = Area(Geometry=bbox_5.Box)  # -> Area, Centroid
pt_8 = ConstructPoint(XCoordinate=multiplication_8, YCoordinate=neg_8, ZCoordinate=0)
xy = XYPlane(Origin=pt_8)
pdecon_2 = Deconstruct(Point=area.Centroid)  # -> XComponent, YComponent, ZComponent
recgrid = Rectangular(Plane=xy, SizeX=hole_grid_distance_x_2, SizeY=hole_grid_distance_y_2, ExtentX=round_2.Floor, ExtentY="1")  # -> Cells, Points
addition_3 = Addition(A=multiplication_9, B=pdecon_2.YComponent)
xy_2 = XYPlane(Origin=recgrid.Points)
Y_4 = UnitY(Factor=addition_3)
cir = Circle(Plane=xy_2, Radius=multiplication_6)
cir_2 = Circle(Plane=xy_2, Radius=multiplication_5)
item_6 = ListItem(List=cir_2, Index=0, Wrap=True)
item_7 = ListItem(List=cir, Index=0, Wrap=True)
move_8 = Move(Geometry=item_7, Motion=Y_4)  # -> Geometry, Transform
move_9 = Move(Geometry=item_6, Motion=Y_4)  # -> Geometry, Transform
screw_pockets_edges = Curve(cir)
screw_pockets_center = Curve(move_8.Geometry)
screw_holes_center = Curve(move_9.Geometry)
screw_holes_edges = Curve(cir_2)
hole_pattern_along_edges = Panel(make_hole_pattern_along_edges)
hole_pattern_along_center = Panel(make_hole_pattern_along_center)
filter_6 = StreamFilter(Gate=hole_pattern_along_center, Stream1=screw_holes_center)
filter_7 = StreamFilter(Gate=hole_pattern_along_center, Stream1=screw_pockets_center)
filter_8 = StreamFilter(Gate=hole_pattern_along_edges, Stream1=screw_holes_edges)
filter_9 = StreamFilter(Gate=hole_pattern_along_edges, Stream1=screw_pockets_edges)

# ----
move_10 = Move(Geometry=pinion_2, Motion=Y_2)  # -> Geometry, Transform

# ---- group: Make glideblock points and profiles
lower_point = Point(pt_4)
clearnace_from_axis_to_axis_plate_2 = Panel(clearnace_from_axis_to_axis_plate)
mid_point = Point(pt_6)
chamfer_distance_3 = Panel(chamfer_distance)
top_point = Point(pt_2)
flat_pad_clerance_2 = Panel(flat_pad_clerance)
milling_bit_diamter_for_clearing_flat_pa_2 = Panel(milling_bit_diamter_for_clearing_flat_pa)  # "Milling bit diamter for clearing flat pad slot"
distance_from_flat_pad_o_edge_2 = Panel(distance_from_flat_pad_o_edge)
clamp_area_width_2 = Panel(clamp_area_width)
material_thickness_3 = Panel(material_thickness)
multiplication_10 = Multiplication(A=clamp_area_width_2, B=".5")
ln = Line(StartPoint=top_point, EndPoint=mid_point)
multiplication_11 = Multiplication(A=chamfer_distance_3, B=".5")
Y_5 = UnitY(Factor=distance_from_flat_pad_o_edge_2)
neg_9 = Negative(Value=multiplication_10)
len = Length(Curve=ln)
Y_6 = UnitY(Factor=multiplication_11)
neg_10 = Negative(Value=flat_pad_clerance_2)
addition_4 = Addition(A=milling_bit_diamter_for_clearing_flat_pa_2, B="0.1")
multiplication_12 = Multiplication(A=addition_4, B=".5")
neg_11 = Negative(Value=multiplication_12)
Y_7 = UnitY(Factor=neg_11)
Y_8 = UnitY(Factor=neg_9)
eval = EvaluateCurve()  # -> Point, Tangent, Angle
eval_2 = EvaluateCurve(Curve=ln)  # -> Point, Tangent, Angle
division_4 = Division(A=chamfer_distance_3, B=len)
move_11 = Move(Geometry=lower_point, Motion=Y_5)  # -> Geometry, Transform
Y_9 = UnitY(Factor=chamfer_distance_3)
move_12 = Move(Geometry=move_11.Geometry, Motion=Y_6)  # -> Geometry, Transform
multiplication_13 = Multiplication()
Z = UnitZ(Factor=neg_10)
eval_3 = EvaluateLength(Curve=ln, Length=".5", Normalized=True)  # -> Point, Tangent, Parameter
neg_12 = Negative(Value=addition_4)
move_13 = Move(Geometry=move_11.Geometry, Motion=Y_9)  # -> Geometry, Transform
addition_5 = Addition(A=clearnace_from_axis_to_axis_plate_2, B=flat_pad_clerance_2)
trimline_point1 = Point(move_12.Geometry)
Y_10 = UnitY(Factor=neg_12)
move_14 = Move(Geometry=move_11.Geometry, Motion=Z)  # -> Geometry, Transform
move_15 = Move(Geometry=move_14.Geometry, Motion=Y_7)  # -> Geometry, Transform
trimline_point2 = Point(move_15.Geometry)
scale = Scale(Geometry=mid_point, Center=eval_3.Point, Factor=division_4)  # -> Geometry, Transform
scale_2 = Scale(Geometry=top_point, Center=eval_3.Point, Factor=division_4)  # -> Geometry, Transform
subtraction_3 = Subtraction(A=material_thickness_3, B=clearnace_from_axis_to_axis_plate_2)
move_16 = Move(Geometry=move_14.Geometry, Motion=Y_10)  # -> Geometry, Transform
Z_2 = UnitZ(Factor=addition_5)
neg_13 = Negative(Value=subtraction_3)
neg_14 = Negative(Value=clamp_area_width_2)
move_17 = Move(Geometry=move_16.Geometry, Motion=Z_2)  # -> Geometry, Transform
move_18 = Move(Geometry=move_17.Geometry, Motion=Y_8)  # -> Geometry, Transform
hole_midline_point = Point(move_18.Geometry)
neg_15 = Negative(Value=material_thickness_3)
Y_11 = UnitY(Factor=neg_14)
Z_3 = UnitZ(Factor=neg_13)
pdecon_3 = Deconstruct(Point=scale_2.Geometry)  # -> XComponent, YComponent, ZComponent
pdecon_4 = Deconstruct(Point=move_17.Geometry)  # -> XComponent, YComponent, ZComponent
pdecon_5 = Deconstruct(Point=scale.Geometry)  # -> XComponent, YComponent, ZComponent
Z_4 = UnitZ(Factor=neg_15)
move_19 = Move(Geometry=move_17.Geometry, Motion=Y_11)  # -> Geometry, Transform
pdecon_6 = Deconstruct(Point=move_19.Geometry)  # -> XComponent, YComponent, ZComponent
move_20 = Move(Geometry=move_13.Geometry, Motion=Z_3)  # -> Geometry, Transform
pt_9 = ConstructPoint(XCoordinate=pdecon_6.XComponent, YCoordinate=pdecon_6.YComponent, ZCoordinate=clearnace_from_axis_to_axis_plate_2)
pt_10 = ConstructPoint(XCoordinate=pdecon_3.XComponent, YCoordinate=pdecon_3.YComponent, ZCoordinate=clearnace_from_axis_to_axis_plate_2)
pt_11 = ConstructPoint(XCoordinate=pdecon_4.XComponent, YCoordinate=pdecon_4.YComponent, ZCoordinate=pdecon_5.ZComponent)
move_21 = Move(Geometry=move_19.Geometry, Motion=Z_4)  # -> Geometry, Transform
pt_12 = Point(move_19.Geometry)
pt_13 = Point(pt_9)
pt_14 = Point(pt_10)
pt_15 = Point(scale_2.Geometry)
pt_16 = Point(pt_11)
pt_17 = Point(move_17.Geometry)
pt_18 = Point(move_19.Geometry)
pt_19 = Point(scale.Geometry)
pt_20 = Point(move_20.Geometry)
pt_21 = Point(move_13.Geometry)
pt_22 = Point(move_14.Geometry)
pt_23 = Point(move_16.Geometry)
pt_24 = Point(move_17.Geometry)
pt_25 = Point(move_19.Geometry)
pt_26 = Point(move_21.Geometry)
pt_27 = Point(move_11.Geometry)
xz = XZPlane(Origin=pt_12)
xy_3 = XYPlane(Origin=pt_12)
mirror = Mirror(Geometry=xy_3, Plane=xz)  # -> Geometry, Transform
lower_glideblock_plane = Plane(mirror.Geometry)
upper_glideblock_plane = Plane(mirror.Geometry)
merge_3 = Merge(Data1=pt_20, Data2=pt_21, Data3=pt_27, Data4=pt_22, Data5=pt_23, Data6=pt_24, Data7=pt_25, Data8=pt_26)
merge_4 = Merge(Data1=pt_13, Data2=pt_14, Data3=pt_15, Data4=pt_19, Data5=pt_16, Data6=pt_17, Data7=pt_18)
pline_3 = PolyLine(Vertices=merge_3, Closed=True)
pline_4 = PolyLine(Vertices=merge_4, Closed=True)
chamfer_glideblock_profile = Curve(pline_4)
flat_pad_glideblock_profile = Curve(pline_3)

# ----
pinion_on_rack = Curve(move_10.Geometry)

# ---- group: Filter geometry
gemotry_output_type = Panel(output_geometry_type)
gate = StreamGate(Stream=filter_7, Gate=gemotry_output_type)  # -> Target0, Target1
gate_2 = StreamGate(Stream=rack_pocket_outline, Gate=gemotry_output_type)  # -> Target0, Target1
gate_3 = StreamGate(Stream=filter_8, Gate=gemotry_output_type)  # -> Target0, Target1
gate_4 = StreamGate(Stream=filter_9, Gate=gemotry_output_type)  # -> Target0, Target1
gate_5 = StreamGate(Stream=filter_6, Gate=gemotry_output_type)  # -> Target0, Target1

# ----
glide_block_length_2 = Panel(glide_block_length)
hole_spacing_2 = Panel(hole_spacing)
first_hole_distance_from_edge_2 = Panel(first_hole_distance_from_edge)
hole_diamter_upper_glideblock = Panel(hole_diamter_for_tapping)
hole_diamter_lower_glideblock = Panel(hole_diamter_for_slip_fit)
use_custom_hole_pattern_2 = Panel(use_custom_hole_pattern)
custom_hole_pattern_2 = Panel(custom_hole_pattern)
hole_midline_point_2 = Point(hole_midline_point)
subtraction_4 = Subtraction(A=glide_block_length_2, B=first_hole_distance_from_edge_2)
pdecon_7 = Deconstruct(Point=hole_midline_point_2)  # -> XComponent, YComponent, ZComponent
multiplication_14 = Multiplication(A=hole_diamter_lower_glideblock, B=".5")
multiplication_15 = Multiplication(A=hole_diamter_upper_glideblock, B=".5")
subtraction_5 = Subtraction(A=subtraction_4, B=first_hole_distance_from_edge_2)
division_5 = Division(A=subtraction_5, B=hole_spacing_2)
round_3 = Round(Number=division_5)  # -> Nearest, Floor, Ceiling
division_6 = Division(A=subtraction_5, B=round_3.Ceiling)
addition_6 = Addition(A=round_3.Ceiling, B="1")
series_2 = Series(Start=first_hole_distance_from_edge_2, Step=division_6, Count=addition_6)
filter_10 = StreamFilter(Gate=use_custom_hole_pattern_2, Stream0=series_2, Stream1=custom_hole_pattern_2)
pt_28 = ConstructPoint(XCoordinate=filter_10, YCoordinate=pdecon_7.YComponent, ZCoordinate=pdecon_7.ZComponent)
xy_4 = XYPlane(Origin=pt_28)
planes_for_holes = Plane(xy_4)
cir_3 = Circle(Plane=planes_for_holes, Radius=multiplication_15)
cir_4 = Circle(Plane=planes_for_holes, Radius=multiplication_14)

# ---- group: Subtract pocket from axis extrusion
material_thickness_4 = Panel(material_thickness)
rack_pocket_outline_3 = Curve(gate_2.Target1)
rack_tooth_height_3 = Panel(rack_tooth_height)
axis_stock_2 = Brep(axis_stock)
screw_holes_edges_2 = Curve(gate_3.Target1)
screw_pockets_edges_2 = Curve(gate_4.Target1)
screw_holes_center_2 = Curve(gate_5.Target1)
screw_pockets_center_2 = Curve(gate.Target1)
edge_screw_pocket_depth_2 = Panel(edge_screw_pocket_depth)
center_screw_pocket_depth_2 = Panel(center_screw_pocket_depth)
neg_16 = Negative(Value=material_thickness_4)
neg_17 = Negative(Value=rack_tooth_height_3)
neg_18 = Negative(Value=edge_screw_pocket_depth_2)
neg_19 = Negative(Value=center_screw_pocket_depth_2)
Z_5 = UnitZ(Factor=neg_16)
Z_6 = UnitZ(Factor=neg_17)
Z_7 = UnitZ(Factor=neg_18)
Z_8 = UnitZ(Factor=neg_19)
extr_2 = Extrude(Base=[screw_holes_edges_2, screw_holes_center_2], Direction=Z_5)
extr_3 = Extrude(Base=rack_pocket_outline_3, Direction=Z_6)
extr_4 = Extrude(Base=screw_pockets_edges_2, Direction=Z_7)
extr_5 = Extrude(Base=screw_pockets_center_2, Direction=Z_8)
cap_2 = CapHoles(Brep=extr_3)
cap_3 = CapHoles(Brep=extr_2)
cap_4 = CapHoles(Brep=[extr_4, extr_5])
rack_pocket = Brep(cap_2)
sdiff = SolidDifference(BrepsA=axis_stock_2, BrepsB=rack_pocket)
sdiff_2 = SolidDifference(BrepsA=sdiff, BrepsB=flatten(cap_3))
sdiff_3 = SolidDifference(BrepsA=sdiff_2, BrepsB=flatten(cap_4))
item_8 = ListItem(List=flatten(sdiff_3), Index=0, Wrap=True)
null = NullItem(Item=item_8)  # -> NullFlags, InvalidFlags, Description
filter_11 = StreamFilter(Gate=null.NullFlags, Stream0=sdiff_3, Stream1=sdiff)
axis_brep = Brep(filter_11)

# ---- group: Extend rack pocket
tooth_spacing_2 = Panel(tooth_spacing)
rack_pocket_outline_4 = Curve(gate_2.Target0)
bbox_6 = BoundingBox(Content=rack_pocket_outline_4, Plane=PlaneXY(0, 0, 0))  # -> Box, Box_2
neg_20 = Negative(Value=tooth_spacing_2)
debrep = DeconstructBrep(Brep=bbox_6.Box)  # -> Faces, Edges, Vertices
X_3 = UnitX(Factor=neg_20)
item_9 = ListItem(List=debrep.Edges, Index=3, Wrap=True)
end_4 = EndPoints(Curve=item_9)  # -> Start, End
area_2 = Area(Geometry=bbox_6.Box)  # -> Area, Centroid
move_22 = Move(Geometry=end_4.Start, Motion=X_3)  # -> Geometry, Transform
move_23 = Move(Geometry=end_4.End, Motion=X_3)  # -> Geometry, Transform
yz = YZPlane(Origin=area_2.Centroid)
merge_5 = Merge(Data2=end_4.End, Data3=move_23.Geometry, Data4=move_22.Geometry, Data5=end_4.Start)
pline_5 = PolyLine(Vertices=merge_5, Closed=False)
mirror_2 = Mirror(Geometry=pline_5, Plane=yz)  # -> Geometry, Transform
rack_pocket_outline_5 = Curve(rack_pocket_outline_4)
end_5 = EndPoints(Curve=flatten([mirror_2.Geometry, pline_5]))  # -> Start, End
runion = RegionUnion(Curves=flatten([mirror_2.Geometry, pline_5, rack_pocket_outline_4]))  # disabled
crv_cp = CurveClosestPoint(Point=flatten([end_5.Start, end_5.End]), Curve=flatten(rack_pocket_outline_5))  # -> Point, Parameter, Distance
shatter = Shatter(Curve=rack_pocket_outline_5, Parameters=crv_cp.Parameter)
dispatch = Dispatch(List=shatter, DispatchPattern=[True, False])  # -> ListA, ListB
join_3 = JoinCurves(Curves=flatten([dispatch.ListB, pline_5, mirror_2.Geometry]), Preserve=False)
item_10 = ListItem(List=dispatch.ListB, Index=1, Wrap=True)
rack_engrave_curve = Curve(item_10)
rack_pocket_extended = Curve(join_3)

# ---- group: Make clerance pocket
glide_block_length_3 = Panel(glide_block_length)
pocket_side_overshoot = Panel("0.5")
lower_glideblock_plane_2 = Plane(lower_glideblock_plane)
milling_bit_diamter_with_clearance = Panel(addition_4)
pt_29 = Point(pt_11)
pt_30 = Point(scale.Geometry)
dist_2 = Distance(PointA=pt_30, PointB=pt_29)
multiplication_16 = Multiplication(A=milling_bit_diamter_with_clearance, B="0.5")
addition_7 = Addition(A=dist_2, B=pocket_side_overshoot)
addition_8 = Addition(A=multiplication_16, B=pocket_side_overshoot)
project = Project(Geometry=pt_29, Plane=lower_glideblock_plane_2)  # -> Geometry, Transform
smaller_2 = SmallerThan(FirstNumber=addition_7, SecondNumber=milling_bit_diamter_with_clearance)  # -> SmallerThan, OrEqualTo
X_4 = UnitX(Factor=addition_8)
dist_3 = Distance(PointA=pt_29, PointB=project.Geometry)
addition_9 = Addition(A=addition_8, B=glide_block_length_3, C=addition_8)
filter_12 = StreamFilter(Gate=smaller_2.SmallerThan, Stream0=addition_7, Stream1=milling_bit_diamter_with_clearance)
neg_21 = Negative(Value=X_4)
X_5 = UnitX(Factor=addition_9)
Y_12 = UnitY(Factor=filter_12)
move_24 = Move(Geometry=project.Geometry, Motion=neg_21)  # -> Geometry, Transform
move_25 = Move(Geometry=move_24.Geometry, Motion=Y_12)  # -> Geometry, Transform
move_26 = Move(Geometry=move_25.Geometry, Motion=X_5)  # -> Geometry, Transform
move_27 = Move(Geometry=move_24.Geometry, Motion=X_5)  # -> Geometry, Transform
pline_6 = PolyLine(Vertices=[move_24.Geometry, move_27.Geometry, move_26.Geometry, move_25.Geometry], Closed=True)
pocket_depth = Panel(dist_3)
clearance_pocket = Curve(pline_6)

# ---- group: Make lower glieblock outline
pt_31 = Point(pt_10)
glide_block_length_4 = Panel(glide_block_length)
glide_block_fillet_radius_2 = Panel(glide_block_fillet_radius)
material_thickness_5 = Panel(material_thickness_3)
pt_32 = Point(pt_9)
X_6 = UnitX(Factor=glide_block_length_4)
move_28 = Move(Geometry=pt_31, Motion=X_6)  # -> Geometry, Transform
move_29 = Move(Geometry=pt_32, Motion=X_6)  # -> Geometry, Transform
pline_7 = PolyLine(Vertices=[pt_32, move_29.Geometry, move_28.Geometry, pt_31], Closed=True)
neg_22 = Negative(Value=material_thickness_5)
Z_9 = UnitZ(Factor=neg_22)
fillet = Fillet(Curve=pline_7, Radius=glide_block_fillet_radius_2)
move_30 = Move(Geometry=fillet, Motion=Z_9)  # -> Geometry, Transform
outline_lower_glideblock = Curve(move_30.Geometry)

# ----
chamfer_line_overshoot_2 = Panel(chamfer_line_overshoot)
pt_33 = Point(scale_2.Geometry)
pt_34 = Point(scale.Geometry)
lower_glideblock_plane_3 = Plane(lower_glideblock_plane)
ln_2 = Line(StartPoint=pt_33, EndPoint=pt_34)
addition_10 = Addition(A=chamfer_line_overshoot_2, B=glide_block_length_4, C=chamfer_line_overshoot_2)
addition_11 = Addition(A=chamfer_line_overshoot_2, B=glide_block_length_4)
ext = ExtendCurve(Curve=ln_2, Type=0, Start=chamfer_line_overshoot_2, End=chamfer_line_overshoot_2)
neg_23 = Negative(Value=addition_10)
X_7 = UnitX(Factor=addition_11)
X_8 = UnitX(Factor=neg_23)
move_31 = Move(Geometry=ext, Motion=X_7)  # -> Geometry, Transform
extr_6 = Extrude(Base=move_31.Geometry, Direction=X_8)
end_6 = EndPoints(Curve=move_31.Geometry)  # -> Start, End
project_2 = Project(Geometry=end_6.Start, Plane=lower_glideblock_plane_3)  # -> Geometry, Transform
move_32 = Move(Geometry=project_2.Geometry, Motion=X_8)  # -> Geometry, Transform
dist_4 = Distance(PointA=project_2.Geometry, PointB=end_6.Start)
pt_35 = Point(project_2.Geometry)
ln_3 = Line(StartPoint=pt_35, EndPoint=move_32.Geometry)
chamfer_engrave_depth = Panel(dist_4)
glideblock_chamfer_surface = Surface(extr_6)
chamfer_line = Curve(ln_3)

# ---- group: Make upper glideblock outline
glide_block_length_5 = Panel(glide_block_length)
glide_block_fillet_radius_3 = Panel(glide_block_fillet_radius)
material_thickness_6 = Panel(material_thickness_3)
pt_36 = Point(move_21.Geometry)
pt_37 = Point(move_20.Geometry)
X_9 = UnitX(Factor=glide_block_length_5)
move_33 = Move(Geometry=pt_36, Motion=X_9)  # -> Geometry, Transform
move_34 = Move(Geometry=pt_37, Motion=X_9)  # -> Geometry, Transform
pline_8 = PolyLine(Vertices=[pt_37, move_34.Geometry, move_33.Geometry, pt_36], Closed=True)
Z_10 = UnitZ(Factor=material_thickness_6)
fillet_2 = Fillet(Curve=pline_8, Radius=glide_block_fillet_radius_3)
move_35 = Move(Geometry=fillet_2, Motion=Z_10)  # -> Geometry, Transform
outline_upper_glideblock = Curve(move_35.Geometry)

# ---- group: Make 3D glide block geometry
glide_block_length_6 = Panel(glide_block_length)
material_thickness_7 = Panel(material_thickness_3)
gemotry_output_type_2 = Panel(output_geometry_type)
X_10 = UnitX(Factor=glide_block_length_6)
Z_11 = UnitZ(Factor=material_thickness_7)
filter_13 = StreamFilter(Gate=gemotry_output_type_2, Stream1=cir_3)
filter_14 = StreamFilter(Gate=gemotry_output_type_2, Stream1=cir_4)
filter_15 = StreamFilter(Gate=gemotry_output_type_2, Stream1=flat_pad_glideblock_profile)
filter_16 = StreamFilter(Gate=gemotry_output_type_2, Stream1=chamfer_glideblock_profile)
neg_24 = Negative(Value=Z_11)
extr_7 = Extrude(Base=filter_15, Direction=X_10)
extr_8 = Extrude(Base=filter_13, Direction=neg_24)
extr_9 = Extrude(Base=filter_16, Direction=X_10)
extr_10 = Extrude(Base=filter_14, Direction=Z_11)
cap_5 = CapHoles(Brep=extr_7)
cap_6 = CapHoles(Brep=extr_8)
cap_7 = CapHoles(Brep=extr_9)
cap_8 = CapHoles(Brep=extr_10)
xz_2 = XZPlane(Origin=Point(0, 0, 0))
sdiff_4 = SolidDifference(BrepsA=cap_7, BrepsB=cap_8)
sdiff_5 = SolidDifference(BrepsA=cap_5, BrepsB=cap_6)
mirror_3 = Mirror(Geometry=[sdiff_4, sdiff_5], Plane=xz_2)  # -> Geometry, Transform
glideblock_breps = Brep([mirror_3.Geometry, sdiff_4, sdiff_5])

# ---- group: Make chamfer pad pocket
milling_bit_diamter_with_clearance_2 = Panel(addition_4)
pocket_side_overshoot_2 = Panel("0.5")
glide_block_length_7 = Panel(glide_block_length)
upper_glideblock_plane_2 = Plane(upper_glideblock_plane)
pt_38 = Point(move_11.Geometry)
pt_39 = Point(move_13.Geometry)
dist_5 = Distance(PointA=pt_39, PointB=pt_38)
addition_12 = Addition(A=pocket_side_overshoot_2, B=dist_5, C=pocket_side_overshoot_2)
subtraction_6 = Subtraction(A=milling_bit_diamter_with_clearance_2, B=dist_5)
smaller_3 = SmallerThan(FirstNumber=addition_12, SecondNumber=milling_bit_diamter_with_clearance_2)  # -> SmallerThan, OrEqualTo
multiplication_17 = Multiplication(A=subtraction_6, B="0.5")
filter_17 = StreamFilter(Gate=smaller_3.SmallerThan, Stream0=pocket_side_overshoot_2, Stream1=multiplication_17)
neg_25 = Negative(Value=filter_17)
Y_13 = UnitY(Factor=filter_17)
Y_14 = UnitY(Factor=neg_25)
move_36 = Move(Geometry=pt_39, Motion=Y_13)  # -> Geometry, Transform
move_37 = Move(Geometry=pt_38, Motion=Y_14)  # -> Geometry, Transform
multiplication_18 = Multiplication(A=milling_bit_diamter_with_clearance_2, B="0.5")
project_3 = Project(Geometry=move_37.Geometry, Plane=upper_glideblock_plane_2)  # -> Geometry, Transform
project_4 = Project(Geometry=move_36.Geometry, Plane=upper_glideblock_plane_2)  # -> Geometry, Transform
addition_13 = Addition(A=multiplication_18, B=pocket_side_overshoot_2)
X_11 = UnitX(Factor=addition_13)
dist_6 = Distance(PointA=move_36.Geometry, PointB=project_4.Geometry)
addition_14 = Addition(A=addition_13, B=glide_block_length_7, C=addition_13)
neg_26 = Negative(Value=X_11)
neg_27 = Negative(Value=X_11)
X_12 = UnitX(Factor=addition_14)
move_38 = Move(Geometry=project_4.Geometry, Motion=neg_26)  # -> Geometry, Transform
move_39 = Move(Geometry=project_3.Geometry, Motion=neg_27)  # -> Geometry, Transform
move_40 = Move(Geometry=move_39.Geometry, Motion=X_12)  # -> Geometry, Transform
move_41 = Move(Geometry=move_38.Geometry, Motion=X_12)  # -> Geometry, Transform
pline_9 = PolyLine(Vertices=[move_38.Geometry, move_41.Geometry, move_40.Geometry, move_39.Geometry], Closed=True)
chamfer_pad_pocket = Curve(pline_9)
pocket_depth_2 = Panel(dist_6)

# ---- group: Make dogbone pad pocket
pocket_side_overshoot_3 = Panel("0.5")
glide_block_length_8 = Panel(glide_block_length)
upper_glideblock_plane_3 = Plane(upper_glideblock_plane)
milling_bit_diamter_with_clearance_3 = Panel(addition_4)
pt_40 = Point(move_14.Geometry)
pt_41 = Point(move_16.Geometry)
multiplication_19 = Multiplication(A=milling_bit_diamter_with_clearance_3, B="0.5")
project_5 = Project(Geometry=pt_41, Plane=upper_glideblock_plane_3)  # -> Geometry, Transform
project_6 = Project(Geometry=pt_40, Plane=upper_glideblock_plane_3)  # -> Geometry, Transform
addition_15 = Addition(A=multiplication_19, B=pocket_side_overshoot_3)
X_13 = UnitX(Factor=addition_15)
dist_7 = Distance(PointA=pt_40, PointB=project_6.Geometry)
addition_16 = Addition(A=addition_15, B=glide_block_length_8, C=addition_15)
neg_28 = Negative(Value=X_13)
neg_29 = Negative(Value=X_13)
X_14 = UnitX(Factor=addition_16)
move_42 = Move(Geometry=project_6.Geometry, Motion=neg_28)  # -> Geometry, Transform
move_43 = Move(Geometry=project_5.Geometry, Motion=neg_29)  # -> Geometry, Transform
move_44 = Move(Geometry=move_43.Geometry, Motion=X_14)  # -> Geometry, Transform
move_45 = Move(Geometry=move_42.Geometry, Motion=X_14)  # -> Geometry, Transform
pline_10 = PolyLine(Vertices=[move_42.Geometry, move_45.Geometry, move_44.Geometry, move_43.Geometry], Closed=True)
pocket_depth_3 = Panel(dist_7)
dogbone_pocket = Curve(pline_10)

# ----
motorplate_edge_fillet_radius = Panel("2")
motorplate_edge_thickness_from_holes_2 = Panel(motorplate_edge_thickness_from_holes)
pinon_distance_from_axis_edge_2 = Panel(pinon_distance_from_axis_edge)
motorplate_mount_spacing_x_2 = Panel(motorplate_mount_spacing_x)
motorplate_mount_spacing_y_2 = Panel(motorplate_mount_spacing_y)
pinion_positioned_in_rack = Curve(flatten(pinion_on_rack))
clearnace_from_axis_to_axis_plate_3 = Panel(clearnace_from_axis_to_axis_plate)
hole_diamter_for_tapping_2 = Panel(hole_diamter_for_tapping)
hole_diamter_for_slip_fit_2 = Panel(hole_diamter_for_slip_fit)
motor_plate_attachment_type_2 = Panel(motor_plate_attachment_type)
extra_offset_adjustable_holes_2 = Panel(extra_offset_adjustable_holes)
adjustment_range_glideblock_and_motorpla_2 = Panel(adjustment_range_glideblock_and_motorpla)  # "Adjustment range glideblock and motorplate"
flange_hole_diameter_2 = Panel(flange_hole_diameter)
motor_mount_hole_spacing = Panel(motor_type)
material_thickness_8 = Panel(material_thickness_3)
hole_diamter_lower_glideblock_2 = Panel(hole_diamter_for_slip_fit)
planes_for_holes_2 = Plane(planes_for_holes)
outline_upper_glideblock_2 = Curve(outline_upper_glideblock)
gemotry_output_type_3 = Panel(output_geometry_type)
item_11 = ListItem(List=pinion_positioned_in_rack, Index=0, Wrap=True)
Z_12 = UnitZ(Factor=material_thickness_8)
area_3 = Area(Geometry=item_11)  # -> Area, Centroid
filter_18 = StreamFilter(Gate=motor_plate_attachment_type_2, Stream0=hole_diamter_for_tapping_2, Stream1=hole_diamter_for_slip_fit_2)
multiplication_20 = Multiplication(A=adjustment_range_glideblock_and_motorpla_2, B=".5")
panel_2 = Panel("""4
5
6""")
multiplication_21 = Multiplication(A=flange_hole_diameter_2, B=".5")
pdecon_8 = Deconstruct(Point=area_3.Centroid)  # -> XComponent, YComponent, ZComponent
multiplication_22 = Multiplication(A=hole_diamter_lower_glideblock_2, B=".5")
move_46 = Move(Geometry=planes_for_holes_2, Motion=Z_12)  # -> Geometry, Transform
explode = Explode(Curve=outline_upper_glideblock_2, Recursive=True)  # -> Segments, Vertices
multiplication_23 = Multiplication(A=filter_18, B=".5")
neg_30 = Negative(Value=multiplication_20)
deplane = DeconstructPlane(Plane=planes_for_holes_2)  # -> Origin, XAxis, YAxis, ZAxis
pt_42 = ConstructPoint(
    XCoordinate=pinon_distance_from_axis_edge_2,
    YCoordinate=pdecon_8.YComponent,
    ZCoordinate=clearnace_from_axis_to_axis_plate_3)
xz_3 = XZPlane(Origin=deplane.Origin)
item_12 = ListItem(List=explode.Segments, Index=panel_2, Wrap=True)
Y_15 = UnitY(Factor=neg_30)
Y_16 = UnitY(Factor=multiplication_20)
xy_5 = XYPlane(Origin=pt_42)
cir_5 = Circle(Plane=move_46.Geometry, Radius=multiplication_22)
join_4 = JoinCurves(Curves=item_12, Preserve=False)
pinion_center_plane = Plane(xy_5)
multiplication_24 = Multiplication(A=motorplate_mount_spacing_y_2, B=".5")
pcx = CurvePlane(Curve=cir_5, Plane=xz_3)  # -> Points, ParamsC, ParamsP
multiplication_25 = Multiplication(A=motorplate_mount_spacing_x_2, B=".5")
pinion_center_plane_2 = Plane(pinion_center_plane)
move_47 = Move(Geometry=join_4, Motion=Z_12)  # -> Geometry, Transform
multiplication_26 = Multiplication(A=motor_mount_hole_spacing, B=".5")
xz_4 = XZPlane(Origin=Point(0, 0, 0))
neg_31 = Negative(Value=multiplication_24)
neg_32 = Negative(Value=multiplication_25)
neg_33 = Negative(Value=multiplication_26)
shatter_2 = Shatter(Curve=graft(cir_5), Parameters=pcx.ParamsC)
mirror_4 = Mirror(Geometry=move_47.Geometry, Plane=xz_4)  # -> Geometry, Transform
deplane_2 = DeconstructPlane(Plane=pinion_center_plane_2)  # -> Origin, XAxis, YAxis, ZAxis
pt_43 = ConstructPoint(XCoordinate=multiplication_26, YCoordinate=multiplication_26, ZCoordinate=0)
pt_44 = ConstructPoint(XCoordinate=multiplication_26, YCoordinate=neg_33, ZCoordinate=0)
pt_45 = ConstructPoint(XCoordinate=neg_33, YCoordinate=multiplication_26, ZCoordinate=0)
pt_46 = ConstructPoint(XCoordinate=neg_33, YCoordinate=neg_33, ZCoordinate=0)
xy_6 = XYPlane(Origin=Point(0, 0, 0))
pt_47 = ConstructPoint(XCoordinate=multiplication_25, YCoordinate=multiplication_24, ZCoordinate=0)
pt_48 = ConstructPoint(XCoordinate=neg_32, YCoordinate=multiplication_24, ZCoordinate=0)
pt_49 = ConstructPoint(XCoordinate=multiplication_25, YCoordinate=neg_31, ZCoordinate=0)
pt_50 = ConstructPoint(XCoordinate=neg_32, YCoordinate=neg_31, ZCoordinate=0)
cir_6 = Circle(Plane=pinion_center_plane_2, Radius=multiplication_21)
xz_5 = XZPlane(Origin=deplane_2.Origin)
end_7 = EndPoints(Curve=move_47.Geometry)  # -> Start, End
end_8 = EndPoints(Curve=mirror_4.Geometry)  # -> Start, End
item_13 = ListItem(List=shatter_2, Index=0, Wrap=True)
item_14 = ListItem(List=shatter_2, Index=1, Wrap=True)
pcx_2 = CurvePlane(Curve=cir_6, Plane=xz_5)  # -> Points, ParamsC, ParamsP
move_48 = Move(Geometry=item_13, Motion=Y_16)  # -> Geometry, Transform
move_49 = Move(Geometry=item_14, Motion=Y_15)  # -> Geometry, Transform
pl = ConstructPlane(Origin=[pt_43, pt_44, pt_45, pt_46], XAxis=Vector(1, 0, 0), YAxis=Vector(0, 1, 0))
pl_2 = ConstructPlane(Origin=[pt_47, pt_48, pt_49, pt_50], XAxis=Vector(1, 0, 0), YAxis=Vector(0, 1, 0))
ln_4 = Line(StartPoint=end_7.Start, EndPoint=end_8.Start)
ln_5 = Line(StartPoint=end_7.End, EndPoint=end_8.End)
end_9 = EndPoints(Curve=move_48.Geometry)  # -> Start, End
end_10 = EndPoints(Curve=move_49.Geometry)  # -> Start, End
xy_7 = XYPlane(Origin=Point(0, 0, 0))
shatter_3 = Shatter(Curve=cir_6, Parameters=pcx_2.ParamsC)
orient = Orient(Geometry=pl, Source=xy_6, Target=pinion_center_plane)  # -> Geometry, Transform
join_5 = JoinCurves(Curves=flatten([move_47.Geometry, mirror_4.Geometry, ln_4, ln_5]), Preserve=False)
orient_2 = Orient(Geometry=pl_2, Source=xy_7, Target=pinion_center_plane)  # -> Geometry, Transform
ln_6 = Line(StartPoint=end_9.End, EndPoint=end_10.Start)
ln_7 = Line(StartPoint=end_9.Start, EndPoint=end_10.End)
item_15 = ListItem(List=shatter_3, Index=0, Wrap=True)
item_16 = ListItem(List=shatter_3, Index=1, Wrap=True)
join_6 = JoinCurves(Curves=flatten([ln_7, ln_6, move_48.Geometry, move_49.Geometry]), Preserve=False)
cir_7 = Circle(Plane=orient_2.Geometry, Radius=multiplication_23)
polygon = Polygon(Plane=orient_2.Geometry, Radius=3, Segments=3, FilletRadius=0)  # -> Polygon, Length
move_50 = Move(Geometry=item_15, Motion=Y_16)  # -> Geometry, Transform
move_51 = Move(Geometry=item_16, Motion=Y_15)  # -> Geometry, Transform
offset = Offset(Curve=join_6, Distance=extra_offset_adjustable_holes_2, Plane=PlaneXY(0, 0, 0), Corners=1)
end_11 = EndPoints(Curve=move_50.Geometry)  # -> Start, End
end_12 = EndPoints(Curve=move_51.Geometry)  # -> Start, End
xz_6 = XZPlane(Origin=Point(0, 0, 0))
item_17 = ListItem(List=flatten(offset), Index=0, Wrap=True)
item_18 = ListItem(List=cir_5, Index=0, Wrap=True)
item_19 = ListItem(List=move_46.Geometry, Index=0, Wrap=True)
ln_8 = Line(StartPoint=end_11.End, EndPoint=end_12.Start)
ln_9 = Line(StartPoint=end_11.Start, EndPoint=end_12.End)
mirror_5 = Mirror(Geometry=flatten(offset), Plane=xz_6)  # -> Geometry, Transform
join_7 = JoinCurves(Curves=flatten([ln_9, ln_8, move_50.Geometry, move_51.Geometry]), Preserve=False)
fixed_hole = Curve(item_18)
adjustable_hole = Curve(item_17)
plane = Plane(item_19)
piion_hole = Curve(join_7)
orient_3 = Orient(Geometry=adjustable_hole, Source=plane, Target=orient_2.Geometry)  # -> Geometry, Transform
orient_4 = Orient(Geometry=fixed_hole, Source=plane, Target=orient.Geometry)  # -> Geometry, Transform
xy_8 = XYPlane(Origin=Point(0, 0, 0))
adjustable_motor_mount_holes = Curve(orient_3.Geometry)
motorplate_edge_fillet_radius_2 = Panel(motorplate_edge_fillet_radius)
motorplate_edge_thickness_from_holes_3 = Panel(motorplate_edge_thickness_from_holes_2)
motor_mount_holes = Curve(orient_4.Geometry)
flange_hole = Curve(cir_6)
bbox_7 = BoundingBox(Content=adjustable_motor_mount_holes, Plane=PlaneXY(0, 0, 0), UnionBox=True)  # -> Box, Box_2

# ---- group: Add pocket?
offset_2 = Offset(Curve=motor_mount_holes, Distance=1, Plane=PlaneXY(0, 0, 0), Corners=1)  # disabled

# ----
debrep_2 = DeconstructBrep(Brep=bbox_7.Box)  # -> Faces, Edges, Vertices
item_20 = ListItem(List=debrep_2.Faces, Index="4", Wrap=True)
edges_4 = BrepEdges(Brep=item_20)  # -> Naked, Interior, NonManifold
join_8 = JoinCurves(Curves=edges_4.Naked, Preserve=False)
offset_3 = Offset(Curve=join_8, Distance=motorplate_edge_thickness_from_holes_3, Plane=PlaneXY(0, 0, 0), Corners=4)
fillet_3 = Fillet(Curve=offset_3, Radius=motorplate_edge_fillet_radius_2)
pinion_material_thickness_2 = Panel(pinion_material_thickness)
pinion_center_hole = Curve(roller_rack_and_pinion_maker.pinion_center_hole_3)
pinion_clearance_to_pocket_floor = Panel("0.5")
rack_tooth_height_4 = Panel(rack_tooth_height)
motorplate_outline = Curve(fillet_3)
motor_mount_holes_2 = Curve(motor_mount_holes)
adjustable_motor_mount_holes_2 = Curve(adjustable_motor_mount_holes)
flange_hole_2 = Curve(flange_hole)
adjustable_glideblock_holes = Curve(mirror_5.Geometry)
pinion_hole = Curve(piion_hole)
axis_plate_outline = Curve(join_5)

# ---- group: Needs proper radius
hex_nut_pocket = Curve(polygon.Polygon)

# ----
attachment_holes = Curve(cir_7)
fixed_glideblock_holes = Curve(cir_5)
subtraction_7 = Subtraction(A=rack_tooth_height_4, B=pinion_clearance_to_pocket_floor)
xz_7 = XZPlane(Origin=Point(0, 0, 0))
pt_51 = ConstructPoint(XCoordinate=0, YCoordinate=0, ZCoordinate=subtraction_7)
xy_9 = XYPlane(Origin=Point(0, 0, 0))
xy_10 = XYPlane(Origin=pt_51)
rotate = Rotate(Geometry=xy_10, Angle=3.141592654, Plane=xz_7)  # -> Geometry, Transform
gemotry_output_type_4 = Panel(output_geometry_type)
gemotry_output_type_5 = Panel(output_geometry_type)

# ---- group: Prep set screw markings
addition_17 = Addition(A=rack_tooth_height, B=extra_tooth_height_compared_to_rack_toot)
multiplication_27 = Multiplication(A=milling_bit_diameter_for_hole_marking, B="0.5")
subtraction_8 = Subtraction(A=minimum_clearlance_from_tooth_to_outer_e, B="0.1")
pinion_tooth_heigth = Panel(addition_17)
subtraction_9 = Subtraction(A=multiplication_27, B=subtraction_8)
subtraction_10 = Subtraction(A=pinion_material_thickness, B=pinion_tooth_heigth)
pinion_wall_height = Panel(subtraction_10)
multiplication_28 = Multiplication(A=hole_diamter_for_set_screws, B="0.5")
multiplication_29 = Multiplication(A=pinion_wall_height, B="0.5")
xy_11 = XYPlane(Origin=Point(0, 0, 0))
addition_18 = Addition(A=multiplication_29, B=multiplication_28)
addition_19 = Addition(A=pinion_tooth_heigth, B=addition_18)
pinion_tooth_heigth_2 = Panel(pinion_tooth_heigth)
drill_depths = Panel(addition_19)

# ----
pinion_tooth_heigth_3 = Panel(pinion_tooth_heigth_2)
drill_depths_2 = Panel(drill_depths)

# ---- group: Make outer pinion circle
motor_shaft_diameter_4 = Panel(filter_4)
pinion_teeth = Curve(flatten(roller_rack_and_pinion_maker.pinion_teeth_4))
explode_2 = Explode(Curve=pinion_teeth, Recursive=True)  # -> Segments, Vertices
multiplication_30 = Multiplication(A=motor_shaft_diameter_4, B=default_pinion_outer_edge_diamter_to_sha)
addition_20 = Addition(A=motor_shaft_diameter_4, B=minimum_pinion_pipe_wall_thickness, C=minimum_pinion_pipe_wall_thickness)
item_21 = ListItem(List=explode_2.Segments, Index=0, Wrap=True)
eval_4 = EvaluateLength(Curve=item_21, Length="0.5", Normalized=True)  # -> Point, Tangent, Parameter
pdecon_9 = Deconstruct(Point=eval_4.Point)  # -> XComponent, YComponent, ZComponent
abs = Absolute(Value=pdecon_9.YComponent)
addition_21 = Addition(A=abs, B=minimum_clearlance_from_tooth_to_outer_e)
multiplication_31 = Multiplication(A=addition_21, B="2")
xy_12 = XYPlane(Origin=Point(0, 0, 0))

# ---- group: Make outer pinion circle / Check if pinion wall is thick enough to hold a set screw
smaller_4 = SmallerThan(FirstNumber=multiplication_30, SecondNumber=addition_20)  # -> SmallerThan, OrEqualTo
filter_19 = StreamFilter(Gate=smaller_4.SmallerThan, Stream0=multiplication_30, Stream1=addition_20)

# ---- group: Make outer pinion circle / Check if there is enough clearing between tooth geometry and outer edge
smaller_5 = SmallerThan(FirstNumber=filter_19, SecondNumber=multiplication_31)  # -> SmallerThan, OrEqualTo
filter_20 = StreamFilter(Gate=smaller_5.SmallerThan, Stream0=filter_19, Stream1=multiplication_31)

# ---- group: Make outer pinion circle (continued)
round_4 = Round(Number=filter_20)  # -> Nearest, Floor, Ceiling
motor_shaft_diameter_5 = Panel(round_4.Ceiling)
multiplication_32 = Multiplication(A=motor_shaft_diameter_5, B="0.5")
cir_8 = Circle(Plane=xy_12, Radius=multiplication_32)
pinion_edge = Curve(cir_8)

# ---- group: Prep set screw markings (continued)
addition_22 = Addition(A=multiplication_32, B=subtraction_9)
pt_52 = ConstructPoint(XCoordinate=addition_22, YCoordinate=0, ZCoordinate=0)
xy_13 = XYPlane(Origin=pt_52)
cir_9 = Circle(Plane=xy_13, Radius=multiplication_27)
arrpolar = PolarArray(Geometry=cir_9, Plane=xy_11, Count=number_off_set_screws, Angle=6.283185307)  # -> Geometry, Transform
holes_for_marking_set_screws = Curve(arrpolar.Geometry)

# ---- group: Make 3D pinion
pinion_material_thickness_3 = Panel(pinion_material_thickness)
drill_depths_3 = Panel(drill_depths)
pinion_edge_2 = Curve(pinion_edge)
holes_for_marking_set_screws_2 = Curve(holes_for_marking_set_screws)
pinion_tooth_heigth_4 = Panel(pinion_tooth_heigth_2)
pinion_teeth_2 = Curve(pinion_teeth)
pinion_center_hole_2 = Curve(roller_rack_and_pinion_maker.pinion_center_hole_3)
offset_4 = Offset(Curve=pinion_edge_2, Distance=1, Plane=PlaneXY(0, 0, 0), Corners=1)
neg_34 = Negative(Value=drill_depths_3)
neg_35 = Negative(Value=pinion_material_thickness_3)
neg_36 = Negative(Value=pinion_tooth_heigth_4)
boundary = BoundarySurfaces(Edges=flatten(holes_for_marking_set_screws_2))
boundary_2 = BoundarySurfaces(Edges=flatten([pinion_center_hole_2, pinion_edge_2]))
Z_13 = UnitZ(Factor=neg_34)
Z_14 = UnitZ(Factor=neg_35)
boundary_3 = BoundarySurfaces(Edges=flatten([offset_4, pinion_teeth_2]))
Z_15 = UnitZ(Factor=neg_36)
extr_11 = Extrude(Base=boundary, Direction=Z_13)
extr_12 = Extrude(Base=boundary_2, Direction=Z_14)
extr_13 = Extrude(Base=boundary_3, Direction=Z_15)
sdiff_6 = SolidDifference(BrepsA=extr_12, BrepsB=extr_13)
sdiff_7 = SolidDifference(BrepsA=sdiff_6, BrepsB=extr_11)
_3d_pinion = Brep(sdiff_7)

# ----
pinion_edge_3 = Curve(pinion_edge)
holes_for_marking_set_screws_3 = Curve(holes_for_marking_set_screws)
pinion_teeth_3 = Curve(pinion_teeth)
_3d_pinion_2 = Brep(_3d_pinion)

chamfer_line_overshoot_3 = Panel(chamfer_line_overshoot)
neg_37 = Negative(Value=chamfer_line_overshoot_3)
Y_17 = UnitY(Factor=neg_37)
xz_8 = XZPlane(Origin=Point(0, 0, 0))

corner_fillet_radius_2 = Panel(corner_fillet_radius)
axis_stock_3 = Brep(axis_stock)
bbox_8 = BoundingBox(Content=axis_stock_3, Plane=PlaneXY(0, 0, 0))  # -> Box, Box_2
debrep_3 = DeconstructBrep(Brep=bbox_8.Box)  # -> Faces, Edges, Vertices
item_22 = ListItem(List=debrep_3.Faces, Index=5, Wrap=True)
edges_5 = BrepEdges(Brep=item_22)  # -> Naked, Interior, NonManifold
join_9 = JoinCurves(Curves=edges_5.Naked, Preserve=False)

item_23 = ListItem(List=debrep_3.Edges, Index=4, Wrap=True)
ext_2 = ExtendCurve(Curve=item_23, Type=0, Start=chamfer_line_overshoot_3, End=chamfer_line_overshoot_3)
addition_23 = Addition(A=chamfer_line_overshoot_3, B=corner_fillet_radius_2)
move_52 = Move(Geometry=ext_2, Motion=Y_17)  # -> Geometry, Transform
neg_38 = Negative(Value=addition_23)
end_13 = EndPoints(Curve=move_52.Geometry)  # -> Start, End
X_15 = UnitX(Factor=neg_38)
X_16 = UnitX(Factor=addition_23)
move_53 = Move(Geometry=end_13.Start, Motion=X_15)  # -> Geometry, Transform
move_54 = Move(Geometry=end_13.End, Motion=X_16)  # -> Geometry, Transform
xy_14 = XYPlane(Origin=move_54.Geometry)
xy_15 = XYPlane(Origin=move_53.Geometry)
arc = Arc(Plane=xy_15, Radius=addition_23, Angle=Domain(6.283185307, 4.71238898))  # -> Arc, Length
arc_2 = Arc(Plane=xy_14, Radius=addition_23, Angle=Domain(4.71238898, 3.141592654))  # -> Arc, Length
end_14 = EndPoints(Curve=arc.Arc)  # -> Start, End
end_15 = EndPoints(Curve=arc_2.Arc)  # -> Start, End
ln_10 = Line(StartPoint=end_14.End, EndPoint=end_15.Start)
join_10 = JoinCurves(Curves=[arc.Arc, ln_10, arc_2.Arc], Preserve=True)
Y_18 = UnitY(Factor=addition_23)
move_55 = Move(Geometry=join_10, Motion=Y_18)  # -> Geometry, Transform
mirror_6 = Mirror(Geometry=move_55.Geometry, Plane=xz_8)  # -> Geometry, Transform
flip = FlipCurve(Curve=mirror_6.Geometry)  # -> Curve, Flag
axis_chamfer_engrave_line = Curve([move_55.Geometry, flip.Curve])

fillet_4 = Fillet(Curve=join_9, Radius=corner_fillet_radius_2)

axis_outline = Curve(fillet_4)

gate_6 = StreamGate(Stream=axis_outline, Gate=gemotry_output_type_3)  # -> Target0, Target1
gate_7 = StreamGate(Stream=axis_chamfer_engrave_line, Gate=gemotry_output_type_3)  # -> Target0, Target1

# ---- group: Make 3D chamfer surfaces (very handy for high speed ball nose 3D milling with Bark Beetle)
axis_chamfer_engrave_line_2 = Curve(reparameterize(move_55.Geometry))
axis_length_5 = Panel(axis_length)
chamfer_distance_4 = Panel(chamfer_distance)
chamfer_line_overshoot_4 = Panel(chamfer_line_overshoot_3)
neg_39 = Negative(Value=chamfer_distance_4)
neg_40 = Negative(Value=chamfer_line_overshoot_4)
Z_16 = UnitZ(Factor=chamfer_line_overshoot_4)
addition_24 = Addition(A=neg_40, B=neg_39)
multiplication_33 = Multiplication(A=axis_length_5, B="0.5")
move_56 = Move(Geometry=axis_chamfer_engrave_line_2, Motion=Z_16)  # -> Geometry, Transform
addition_25 = Addition(A=chamfer_line_overshoot_4, B=chamfer_distance_4, C=chamfer_line_overshoot_4)
pt_53 = ConstructPoint(XCoordinate=multiplication_33, YCoordinate=0, ZCoordinate=0)
Z_17 = UnitZ(Factor=addition_24)
Y_19 = UnitY(Factor=addition_25)
xy_16 = XYPlane(Origin=pt_53)
move_57 = Move(Geometry=axis_chamfer_engrave_line_2, Motion=Z_17)  # -> Geometry, Transform
move_58 = Move(Geometry=move_56.Geometry, Motion=Y_19)  # -> Geometry, Transform
merge_6 = Merge(Data1=move_57.Geometry, Data2=move_58.Geometry)
loft = Loft(Curves=merge_6, Options={Adjust=False, Closed=False, LoftEnds=0, LoftSimp=0, LoftType=0, Rebuild=10, Refit=0.01})
rotate_2 = Rotate(Geometry=loft, Angle=3.141592654, Plane=xy_16)  # -> Geometry, Transform
merge_7 = Merge(Data1=loft, Data2=rotate_2.Geometry)
chamfer_3d_surfaces = Surface(merge_7)

# ----
gate_8 = StreamGate(Stream=chamfer_3d_surfaces, Gate=gemotry_output_type_3)  # -> Target0, Target1

# ---- group: Select chamfer type
axis_chamfer_engrave_line_3 = Curve(flatten(gate_7.Target0))
chamfer_geometry_for_2d_2 = Panel(chamfer_geometry_for_2d)
chamfer_3d_surfaces_2 = Surface(flatten(gate_8.Target0))
filter_21 = StreamFilter(Gate=chamfer_geometry_for_2d_2, Stream0=axis_chamfer_engrave_line_3, Stream1=chamfer_3d_surfaces_2)

# ---- group: Nest 2D parts
dogbone_pocket_2 = Curve(dogbone_pocket)
upper_glideblock_plane_4 = Plane(upper_glideblock_plane)
holes_upper_glideblock = Curve(cir_3)
chamfer_pad_pocket_2 = Curve(chamfer_pad_pocket)
outline_upper_glideblock_3 = Curve(outline_upper_glideblock)
lower_glideblock_plane_4 = Plane(lower_glideblock_plane)
holes_lower_glide_block = Circle(cir_4)
clearance_pocket_2 = Curve(clearance_pocket)
chamfer_line_2 = Curve(chamfer_line)
glideblock_chamfer_surface_2 = Surface(glideblock_chamfer_surface)
outline_lower_glideblock_2 = Curve(outline_lower_glideblock)
xy_17 = XYPlane(Origin=Point(0, 0, 0))
project_7 = Project(Geometry=outline_upper_glideblock_3, Plane=xy_17)  # -> Geometry, Transform
bbox_9 = BoundingBox(Content=project_7.Geometry, Plane=xy_17, UnionBox=False)  # -> Box, Box_2
dim_2 = Dimensions(Surface=bbox_9.Box)  # -> UDimension, VDimension
bb_metadata_for_order = Panel("Do first")
bb_metadata_for_order_2 = Panel("Yes")
clearence_pocket_depth = Panel(pocket_depth)
chamfer_engrave_depth_2 = Panel(chamfer_engrave_depth)
dogbone_pocket_depths = Panel(pocket_depth_3)
chamfer_pad_pocket_depths = Panel(pocket_depth_2)

# ----
project_8 = Project(Geometry=outline_lower_glideblock_2, Plane=xy_8)  # -> Geometry, Transform

# ---- group: Prep nesting planes
nesting_margin_axis_and_glideblocks = Panel("30")
axis_length_6 = Panel(axis_length)
extra_clearance = Panel("0.5")
axis_width_3 = Panel(axis_width)
milling_bit_diamter_for_clearing_flat_pa_3 = Panel(milling_bit_diamter_for_clearing_flat_pa)  # "Milling bit diamter for clearing flat pad slot"
addition_26 = Addition(A=milling_bit_diamter_for_clearing_flat_pa_3, B=extra_clearance)
addition_27 = Addition(A=axis_length_6, B=nesting_margin_axis_and_glideblocks)
multiplication_34 = Multiplication(A=axis_width_3, B="0.5")
multiplication_35 = Multiplication(A=addition_26, B="0.5")
addition_28 = Addition(A=multiplication_34, B=addition_26)  # disabled
addition_29 = Addition(A=multiplication_35, B=dim_2.VDimension)
neg_41 = Negative(Value=addition_28)  # disabled
neg_42 = Negative(Value=addition_29)
pt_54 = ConstructPoint(XCoordinate=addition_27, YCoordinate=multiplication_34, ZCoordinate=0)
Y_20 = UnitY(Factor=neg_42)
xy_18 = XYPlane(Origin=pt_54)
first_nesting_plane = Plane(xy_18)

# ---- group: Nest 2D parts (continued)
bbox_10 = BoundingBox(Content=project_8.Geometry, Plane=PlaneXY(0, 0, 0))  # -> Box, Box_2
dim_3 = Dimensions(Surface=bbox_10.Box)  # -> UDimension, VDimension
first_nesting_plane_2 = Plane(first_nesting_plane)
orient_5 = Orient(Geometry=holes_lower_glide_block, Source=lower_glideblock_plane_4, Target=first_nesting_plane_2)  # -> Geometry, Transform
orient_6 = Orient(Geometry=clearance_pocket_2, Source=lower_glideblock_plane_4, Target=first_nesting_plane_2)  # -> Geometry, Transform
orient_7 = Orient(Geometry=chamfer_line_2, Source=lower_glideblock_plane_4, Target=first_nesting_plane_2)  # -> Geometry, Transform
orient_8 = Orient(Geometry=glideblock_chamfer_surface_2, Source=lower_glideblock_plane_4, Target=first_nesting_plane_2)  # -> Geometry, Transform
orient_9 = Orient(Geometry=outline_lower_glideblock_2, Source=lower_glideblock_plane_4, Target=first_nesting_plane_2)  # -> Geometry, Transform
eval_5 = EvaluateLength(Curve=orient_7.Geometry, Length="0.5", Normalized=True)  # -> Point, Tangent, Parameter
yz_2 = YZPlane(Origin=eval_5.Point)
mirror_7 = Mirror(Geometry=orient_7.Geometry, Plane=yz_2)  # -> Geometry, Transform
mirror_8 = Mirror(Geometry=orient_8.Geometry, Plane=yz_2)  # -> Geometry, Transform

# ---- group: Prep nesting planes (continued)
addition_30 = Addition(A=multiplication_35, B=dim_3.VDimension)
multiplication_36 = Multiplication(A=addition_30, B="2")
neg_43 = Negative(Value=addition_30)
addition_31 = Addition(A=multiplication_36, B=addition_26)
Y_21 = UnitY(Factor=neg_43)
neg_44 = Negative(Value=addition_31)
move_59 = Move(Geometry=pt_54, Motion=Y_21)  # -> Geometry, Transform
Y_22 = UnitY(Factor=neg_44)
xz_9 = XZPlane(Origin=move_59.Geometry)
move_60 = Move(Geometry=pt_54, Motion=Y_22)  # -> Geometry, Transform
move_61 = Move(Geometry=move_60.Geometry, Motion=Y_20)  # -> Geometry, Transform
xz_10 = XZPlane(Origin=move_61.Geometry)
first_mirror_plane = Plane(xz_9)
second_nesting_plane = Plane(move_60.Geometry)
seond_mirror_plane = Plane(xz_10)

# ---- group: Nest 2D parts (continued)
second_nesting_plane_2 = Plane(second_nesting_plane)
orient_10 = Orient(Geometry=holes_upper_glideblock, Source=upper_glideblock_plane_4, Target=second_nesting_plane_2)  # -> Geometry, Transform
orient_11 = Orient(Geometry=dogbone_pocket_2, Source=upper_glideblock_plane_4, Target=second_nesting_plane_2)  # -> Geometry, Transform
orient_12 = Orient(Geometry=chamfer_pad_pocket_2, Source=upper_glideblock_plane_4, Target=second_nesting_plane_2)  # -> Geometry, Transform
orient_13 = Orient(Geometry=outline_upper_glideblock_3, Source=upper_glideblock_plane_4, Target=second_nesting_plane_2)  # -> Geometry, Transform
mirror_9 = Mirror(Geometry=orient_11.Geometry, Plane=seond_mirror_plane)  # -> Geometry, Transform
mirror_10 = Mirror(Geometry=orient_10.Geometry, Plane=seond_mirror_plane)  # -> Geometry, Transform
mirror_11 = Mirror(Geometry=orient_12.Geometry, Plane=seond_mirror_plane)  # -> Geometry, Transform
mirror_12 = Mirror(Geometry=orient_13.Geometry, Plane=seond_mirror_plane)  # -> Geometry, Transform
mirror_13 = Mirror(Geometry=orient_5.Geometry, Plane=first_mirror_plane)  # -> Geometry, Transform
mirror_14 = Mirror(Geometry=orient_9.Geometry, Plane=first_mirror_plane)  # -> Geometry, Transform
mirror_15 = Mirror(Geometry=orient_6.Geometry, Plane=first_mirror_plane)  # -> Geometry, Transform
mirror_16 = Mirror(Geometry=mirror_8.Geometry, Plane=first_mirror_plane)  # -> Geometry, Transform
mirror_17 = Mirror(Geometry=mirror_7.Geometry, Plane=first_mirror_plane)  # -> Geometry, Transform
merge_8 = Merge(Data1=orient_9.Geometry, Data2=mirror_14.Geometry, Data3=orient_13.Geometry, Data4=mirror_12.Geometry)
merge_9 = Merge(Data1=orient_5.Geometry, Data2=mirror_13.Geometry, Data3=orient_10.Geometry, Data4=mirror_10.Geometry)
glideblock_holes = Curve(merge_9)
clearance_pockets = Curve(flatten([orient_6.Geometry, mirror_15.Geometry]))
chamfer_lines = Curve(flatten([orient_7.Geometry, mirror_17.Geometry]))
glideblock_chamfer_surfaces = Surface(flatten([orient_8.Geometry, mirror_16.Geometry]))
dogbone_pockets = Curve([orient_11.Geometry, mirror_9.Geometry])
chamfer_pad_pockets = Curve([orient_12.Geometry, mirror_11.Geometry])
glideblock_outlines = Curve(flatten(merge_8))

# ----
glideblock_chamfer_surface_3 = Surface(glideblock_chamfer_surfaces)
chamfer_lines_2 = Curve(chamfer_lines)

# ---- group: Select chamfer type
chamfer_geometry_for_2d_3 = Panel(chamfer_geometry_for_2d)
filter_22 = StreamFilter(Gate=chamfer_geometry_for_2d_3, Stream0=chamfer_lines_2, Stream1=glideblock_chamfer_surface_3)

# ----
glideblock_holes_2 = Curve(glideblock_holes)
chamfer_pad_pockets_2 = Curve(chamfer_pad_pockets)
clearance_pockets_2 = Curve(clearance_pockets)
dogbone_pockets_2 = Curve(dogbone_pockets)
glideblock_outlines_2 = Curve(glideblock_outlines)
merge_10 = Merge(
    Data1=glideblock_holes_2,
    Data2=clearance_pockets_2,
    Data3=filter_22,
    Data4=dogbone_pockets_2,
    Data5=chamfer_pad_pockets_2,
    Data6=glideblock_outlines_2)
filter_23 = StreamFilter(Gate=gemotry_output_type_4, Stream0=flatten(merge_10))

# ---- group: Create pinion position plane
pinon_distance_from_axis_edge_3 = Panel(pinon_distance_from_axis_edge)
pinion_positioned_in_rack_2 = Curve(flatten(pinion_on_rack))
item_24 = ListItem(List=pinion_positioned_in_rack_2, Index=0, Wrap=True)
area_4 = Area(Geometry=item_24)  # -> Area, Centroid

# ----
pdecon_10 = Deconstruct(Point=area_4.Centroid)  # -> XComponent, YComponent, ZComponent
pt_55 = ConstructPoint(XCoordinate=pinon_distance_from_axis_edge_3, YCoordinate=pdecon_10.YComponent, ZCoordinate=0)

# ---- group: Create pinion position plane (continued)
xy_19 = XYPlane(Origin=pt_55)

# ----
orient_14 = Orient(
    Geometry=flatten([pinion_teeth_3, pinion_center_hole, pinion_edge_3, holes_for_marking_set_screws_3]),
    Source=xy_9,
    Target=xy_19)  # -> Geometry, Transform
orient_15 = Orient(Geometry=flatten(_3d_pinion_2), Source=rotate.Geometry, Target=xy_19)  # -> Geometry, Transform
filter_24 = StreamFilter(Gate=gemotry_output_type_5, Stream1=orient_15.Geometry)
filter_25 = StreamFilter(Gate=gemotry_output_type_5, Stream0=orient_14.Geometry)

# ---- group: 2D
rack_pocket_extended_2 = Curve(flatten(rack_pocket_extended))
screw_holes_center_3 = Curve(flatten(gate_5.Target0))
screw_pockets_center_3 = Curve(flatten(gate.Target0))
glideblock_geometery = Geometry(filter_23)
pinion_3 = Curve(flatten(filter_25))
chamfer_geometry = Geometry(flatten(filter_21))
axis_outline_2 = Curve(flatten(gate_6.Target0))
screw_holes_edges_3 = Curve(flatten(gate_3.Target0))
screw_pockets_edges_3 = Curve(flatten(gate_4.Target0))

# ---- group: Make preview brep fot motor plate
gemotry_output_type_6 = Panel(output_geometry_type)
motor_plate_curves = Curve(flatten([motorplate_outline, adjustable_motor_mount_holes_2, motor_mount_holes_2, flange_hole_2]))
material_thickness_9 = Panel(material_thickness_3)
filter_26 = StreamFilter(Gate=gemotry_output_type_6, Stream1=motor_plate_curves)
Z_18 = UnitZ(Factor=material_thickness_9)
move_62 = Move(Geometry=filter_26, Motion=Z_18)  # -> Geometry, Transform

# ----
boundary_4 = BoundarySurfaces(Edges=move_62.Geometry)

# ---- group: Make preview brep fot motor plate (continued)
extr_14 = Extrude(Base=boundary_4, Direction=Z_18)
motor_plate_brep = Brep(extr_14)

axis_plate_curves = Curve(flatten([attachment_holes, pinion_hole, fixed_glideblock_holes, adjustable_glideblock_holes, axis_plate_outline]))
gemotry_output_type_7 = Panel(output_geometry_type)
material_thickness_10 = Panel(material_thickness_3)
filter_27 = StreamFilter(Gate=gemotry_output_type_7, Stream1=axis_plate_curves)
Z_19 = UnitZ(Factor=material_thickness_10)

# ----
boundary_5 = BoundarySurfaces(Edges=filter_27)

# ---- group: Make preview brep fot motor plate (continued)
extr_15 = Extrude(Base=boundary_5, Direction=Z_19)
axis_plate_brep = Brep(extr_15)

# ---- group: 3D
motor_plate_brep_2 = Brep(motor_plate_brep)
axis_plate_brep_2 = Brep(axis_plate_brep)
glideblock_breps_2 = Brep(glideblock_breps)
pinion_brep = Brep(filter_24)
axis_brep_2 = Brep(axis_brep)

# ----
# Bake this geometry
# to export
axis_geometry_for_baking = Geometry([pinion_3, rack_pocket_extended_2, axis_outline_2, screw_holes_edges_3, screw_pockets_edges_3, screw_holes_center_3, screw_pockets_center_3, axis_brep_2, chamfer_geometry, pinion_brep, glideblock_breps_2, glideblock_geometery, axis_plate_brep_2, motor_plate_brep_2])

# ---- group: Right click and choose "Bake" to save to Rhino
axis_geometry = Geometry(axis_geometry_for_baking)

# ----
wires = BrepWireframe(Brep=axis_geometry_for_baking, Density=-1)
preview = CustomPreview(Geometry=axis_geometry_for_baking, Shader=ColourSwatch(SwatchColor=RGB(82, 82, 82)))
preview_2 = CustomPreview(Geometry=wires, Shader=ColourSwatch(SwatchColor=RGB(0, 0, 0)))

# ==== cluster RollerRackAndPinionMaker: Makes rack and pinion gemetry suitable for 3 axis CNC milling. Has low backlash, but is vulnerable to contamination. More options inside component.
pinion_tooth_spacing_factor = ClusterInput()
number_of_pinion_teeth = ClusterInput()
motor_shaft_diameter = ClusterInput()
milling_bit_diameter = ClusterInput()
rack_length = ClusterInput()
tooth_fillet_ratio = ClusterInput()

# ---- group: Determines the travel distance of pinion
rack_length_2 = Panel("200")
rack_length_3 = Number(rack_length)
null = NullItem(Item=rack_length_3)  # -> NullFlags, InvalidFlags, Description
filter = StreamFilter(Gate=null.NullFlags, Stream0=rack_length_3, Stream1=rack_length_2)
rack_length_4 = Panel(filter)

# ---- group: Smaller amount of teeth gives higher resolution and more torque
number_of_pinion_teeth_2 = Panel("9")
number_of_pinion_teeth_3 = Number(number_of_pinion_teeth)
# default config for nema 23 and nema 17 stepper motors - january 2017: bit diamter: 2.8
# pinion tooth spacing factor: -0.1071428
# (gives optimal pinion size and 5mm rack tooth spacing)
# number of pinion teeth: 9
# fillet ratio: 0.2
# earlier config for 2mm pinion milling and 3mm rack milling - august 2016: bit diamter: 3.1
# pinion tooth spacing factor: -0.14
# number of pinion teeth: 10
# fillet ratio: 0.15
null_2 = NullItem(Item=number_of_pinion_teeth_3)  # -> NullFlags, InvalidFlags, Description
filter_2 = StreamFilter(Gate=null_2.NullFlags, Stream0=number_of_pinion_teeth_3, Stream1=number_of_pinion_teeth_2)
number_of_pinion_teeth_4 = Panel(filter_2)

# ---- group: Determines the tooth spacing, some margin recommended
milling_bit_diameter_2 = Panel("2.8")
milling_bit_diameter_3 = Number(milling_bit_diameter)
null_3 = NullItem(Item=milling_bit_diameter_3)  # -> NullFlags, InvalidFlags, Description
filter_3 = StreamFilter(Gate=null_3.NullFlags, Stream0=milling_bit_diameter_3, Stream1=milling_bit_diameter_2)
milling_bit_diameter_4 = Panel(filter_3)

# ---- group: Can be used to reduce or increase the pinion tooth spacing
pinion_tooth_spacing_factor_2 = Panel("-0.1071428")
pinion_tooth_spacing_factor_3 = Number(pinion_tooth_spacing_factor)
null_4 = NullItem(Item=pinion_tooth_spacing_factor_3)  # -> NullFlags, InvalidFlags, Description
filter_4 = StreamFilter(Gate=null_4.NullFlags, Stream0=pinion_tooth_spacing_factor_3, Stream1=pinion_tooth_spacing_factor_2)
pinion_tooth_spacing_factor_4 = Panel(filter_4)

# ---- group: The shaft diameter of the motor driving the pinion
motor_shaft_diameter_2 = Panel("8")
motor_shaft_diameter_3 = Number(motor_shaft_diameter)
null_5 = NullItem(Item=motor_shaft_diameter_3)  # -> NullFlags, InvalidFlags, Description
filter_5 = StreamFilter(Gate=null_5.NullFlags, Stream0=motor_shaft_diameter_3, Stream1=motor_shaft_diameter_2)
motor_shaft_diameter_4 = Panel(filter_5)

# ---- group: Low fillet ratio gives smoother motion, but makes a less robust pinion
tooth_fillet_ratio_2 = Panel("0.2")
tooth_fillet_ratio_3 = Number(tooth_fillet_ratio)
null_6 = NullItem(Item=tooth_fillet_ratio_3)  # -> NullFlags, InvalidFlags, Description
filter_6 = StreamFilter(Gate=null_6.NullFlags, Stream0=tooth_fillet_ratio_3, Stream1=tooth_fillet_ratio_2)
tooth_fillet_ratio_4 = Panel(filter_6)

# ----
preview_position_0_1 = ClusterInput()
preview_position = Slider(0.25, range=0..1)

# ---- group: Controlls pinion tooth blending
rounding_factor_pinion_outside = Slider(20, range=0..100)
rounding_factor_pinion_inside = Slider(70, range=0..100)

# ---- group: Start numbers to help calculte pinion tooth path through rack
number_of_curve_sample_points = Slider(12, range=0..1000)
sample_tooth_position = Panel("0.26")

# ---- group: Lower number gives more clearene between rack tooth and pinion valley
pinion_corner_tolerance_factor = Panel("15")

# ---- group: Fill in for correct step statistics
number_of_stepper_motor_steps = Panel("200")
microstep_level = Panel("4")

# ----
preview_position_0_1_2 = Number(preview_position_0_1)

# ---- group: Prepare properties
multiplication = Multiplication(A=milling_bit_diameter_4, B=pinion_tooth_spacing_factor_4)
multiplication_2 = Multiplication(A=number_of_pinion_teeth_4, B=sample_tooth_position)
division = Division(A=milling_bit_diameter_4, B=pinion_corner_tolerance_factor)
addition = Addition(A=milling_bit_diameter_4, B=multiplication)
multiplication_3 = Multiplication(A=milling_bit_diameter_4, B="0.5")
multiplication_4 = Multiplication(A=motor_shaft_diameter_4, B="0.5")
round = Round(Number=multiplication_2)  # -> Nearest, Floor, Ceiling
multiplication_5 = Multiplication(A=number_of_pinion_teeth_4, B="2")
neg = Negative(Value=division)
multiplication_6 = Multiplication(A=milling_bit_diameter_4, B=tooth_fillet_ratio_4)
milling_bit_radius = Panel(multiplication_3)
xy = XYPlane(Origin=Point(0, 0, 0))
sample_tooth_number = Panel(round.Ceiling)
multiplication_7 = Multiplication(A=addition, B=multiplication_5)
tooth_fillet_radius = Panel(multiplication_6)
pinion_circumference = Panel(multiplication_7)
cir = Circle(Plane=xy, Radius=milling_bit_radius)
pi = Pi(Factor=1)
division_2 = Division(A=pinion_circumference, B=pi)
number_of_pinion_teeth_5 = Panel(number_of_pinion_teeth_4)
pinion_diameter = Panel(division_2)
sample_tooth_number_2 = Panel(sample_tooth_number)
number_of_curve_sample_points_2 = Panel(number_of_curve_sample_points)
multiplication_8 = Multiplication(A=pinion_diameter, B="0.5")
division_3 = Division(A=sample_tooth_number_2, B=number_of_pinion_teeth_5)
pinion_radius = Panel(multiplication_8)
pinion_circumference_2 = Panel(pinion_circumference)
multiplication_9 = Multiplication(A="360", B=division_3)
Y = UnitY(Factor=pinion_radius)
division_4 = Division(A="360", B=number_of_pinion_teeth_5)
division_5 = Division(A=multiplication_9, B=number_of_curve_sample_points_2)
multiplication_10 = Multiplication(A=pinion_circumference_2, B=division_3)
division_6 = Division(A=pinion_circumference, B=number_of_pinion_teeth_4)
move = Move(Geometry=xy, Motion=Y)  # -> Geometry, Transform
series = Series(Start=0, Step=division_4, Count=number_of_pinion_teeth_5)
division_7 = Division(A=multiplication_10, B=number_of_curve_sample_points_2)
series_2 = Series(Start=0, Step=division_5, Count=number_of_curve_sample_points_2)
tooth_spacing = Panel(division_6)
rad = Radians(Degrees=series)
circle = Circle(cir)
series_3 = Series(Start=0, Step=division_7, Count=number_of_curve_sample_points_2)
neg_2 = Negative(Value=series_2)
rad_2 = Radians(Degrees=neg_2)
rotate = Rotate(Geometry=circle, Angle=rad, Plane=move.Geometry)  # -> Geometry, Transform

# ---- group: Make step resolution statisitics
number_of_stepper_motor_steps_2 = Panel(number_of_stepper_motor_steps)
microstep_level_2 = Panel(microstep_level)
division_8 = Division(A=pinion_circumference, B=number_of_stepper_motor_steps_2)
distance_covered_per_step = Panel(division_8)
division_9 = Division(A=distance_covered_per_step, B=microstep_level_2)
distance_covered_per_micro_step = Panel(division_9)

# ---- group: Step statsistics
distance_covered_per_step_2 = Panel(distance_covered_per_step)
distance_covered_per_micro_step_2 = Panel(distance_covered_per_micro_step)

# ---- group: Create rack tooth geometry
sample_tooth_number_3 = Panel(sample_tooth_number_2)
tooth_spacing_2 = Panel(tooth_spacing)
item = ListItem(List=rotate.Geometry, Index=sample_tooth_number_3, Wrap=True)
rotate_2 = Rotate(Geometry=graft(item), Angle=rad_2, Plane=move.Geometry)  # -> Geometry, Transform
tooth_spacing_3 = Panel(tooth_spacing)
X = UnitX(Factor=series_3)
sample_tooth_number_4 = Panel(sample_tooth_number_3)
milling_it_radius = Panel(multiplication_3)
subtraction = Subtraction(A=sample_tooth_number_3, B="0.5")
move_2 = Move(Geometry=rotate_2.Geometry, Motion=X)  # -> Geometry, Transform
multiplication_11 = Multiplication(A=sample_tooth_number_4, B=tooth_spacing_3)
area = Area(Geometry=move_2.Geometry)  # -> Area, Centroid
pt = ConstructPoint(XCoordinate=multiplication_11, YCoordinate=0, ZCoordinate=0)
multiplication_12 = Multiplication(A=subtraction, B=tooth_spacing_2)
multiplication_13 = Multiplication(A=sample_tooth_number_3, B=tooth_spacing_2)
deplane = DeconstructPlane(Plane=xy)  # -> Origin, XAxis, YAxis, ZAxis
merge = Merge(Data1=flatten(area.Centroid), Data2=flatten(pt))
amp = Amplitude(Vector=deplane.YAxis, Amplitude=milling_it_radius)
amp_2 = Amplitude(Vector=deplane.XAxis, Amplitude=multiplication_12)
amp_3 = Amplitude(Vector=deplane.XAxis, Amplitude=multiplication_13)
intcrv = Interpolate(Vertices=merge, Degree=3, Periodic=False, KnotStyle=1)  # -> Curve, Length, Domain
rev = Reverse(Vector=amp)
move_3 = Move(Geometry=deplane.Origin, Motion=amp_2)  # -> Geometry, Transform
move_4 = Move(Geometry=deplane.Origin, Motion=amp_3)  # -> Geometry, Transform
move_5 = Move(Geometry=move_3.Geometry, Motion=rev)  # -> Geometry, Transform
yz = YZPlane(Origin=move_5.Geometry)
crv = Curve(intcrv.Curve)
mirror = Mirror(Geometry=crv, Plane=yz)  # -> Geometry, Transform
ccx = CurveCurve(CurveA=crv, CurveB=mirror.Geometry)  # -> Points, ParamsA, ParamsB
shatter = Shatter(Curve=crv, Parameters=ccx.ParamsA)
rev_2 = ReverseList(List=shatter)
milling_it_radius_2 = Panel(milling_it_radius)
tooth_fillet_radius_2 = Panel(tooth_fillet_radius)
item_2 = ListItem(List=rev_2, Index=0, Wrap=True)
mirror_2 = Mirror(Geometry=item_2, Plane=yz)  # -> Geometry, Transform
pt_2 = Point(move_4.Geometry)
pt_3 = Point(deplane.Origin)
addition_2 = Addition(A=tooth_fillet_radius_2, B=milling_it_radius_2)
join = JoinCurves(Curves=[item_2, mirror_2.Geometry], Preserve=False)
vec2pt = Vector2Pt(PointA=pt_2, PointB=pt_3, Unitize=False)  # -> Vector, Length
fillet = Fillet(Curve=join, Radius=addition_2)
move_6 = Move(Geometry=fillet, Motion=vec2pt.Vector)  # -> Geometry, Transform

# ---- group: Offset tooth profile to prepare for copying
tooth_spacing_4 = Panel(tooth_spacing)
milling_it_radius_3 = Panel(milling_it_radius)
tooth_profile_for_offset = Curve(move_6.Geometry)
xy_2 = XYPlane(Origin=Point(0, 0, 0))
neg_3 = Negative(Value=tooth_spacing_4)
X_2 = UnitX(Factor=tooth_spacing_4)
X_3 = UnitX(Factor=neg_3)
move_7 = Move(Geometry=tooth_profile_for_offset, Motion=X_2)  # -> Geometry, Transform
move_8 = Move(Geometry=tooth_profile_for_offset, Motion=X_3)  # -> Geometry, Transform
end = EndPoints(Curve=tooth_profile_for_offset)  # -> Start, End
join_2 = JoinCurves(Curves=flatten([move_8.Geometry, tooth_profile_for_offset, move_7.Geometry]), Preserve=False)
yz_2 = YZPlane(Origin=[end.Start, end.End])
offset = Offset(Curve=join_2, Distance=milling_it_radius_3, Plane=xy_2, Corners=2)
pcx = CurvePlane(Curve=offset, Plane=yz_2)  # -> Points, ParamsC, ParamsP
shatter_2 = Shatter(Curve=offset, Parameters=flatten(pcx.ParamsC))
item_3 = ListItem(List=shatter_2, Index="1", Wrap=True)
offset_tooth_for_copy_and_join = Curve(item_3)

# ----
distance_covered_per_step_3 = Panel(distance_covered_per_step)
division_10 = Division(A="1", B=distance_covered_per_step_3)
steps_per_mm = Number(division_10)
steps_per_mm_2 = ClusterOutput(steps_per_mm)

# ---- group: Create and blend pinion teeth
eval = EvaluateLength(Curve=fillet, Length="0.5", Normalized=True)  # -> Point, Tangent, Parameter
pdecon = Deconstruct(Point=eval.Point)  # -> XComponent, YComponent, ZComponent
milling_it_radius_4 = Panel(milling_bit_radius)
pinion_corner_tolerance = Panel(neg)
subtraction_2 = Subtraction(A=pdecon.YComponent, B=milling_it_radius_4)
subtraction_3 = Subtraction(A=subtraction_2, B=milling_it_radius_4)
subtraction_4 = Subtraction(A=subtraction_3, B=pinion_corner_tolerance)
pt_4 = ConstructPoint(XCoordinate=0, YCoordinate=subtraction_4, ZCoordinate=0)
rounding_factor_pinion_outside_2 = Panel(rounding_factor_pinion_outside)
xy_3 = XYPlane(Origin=pt_4)
division_11 = Division(A="360", B=multiplication_5)
rounding_factor_pinion_inside_2 = Panel(rounding_factor_pinion_inside)
subtraction_5 = Subtraction(A="0", B=rounding_factor_pinion_outside_2)
addition_3 = Addition(A="180", B=rounding_factor_pinion_outside_2)
rad_3 = Radians(Degrees=addition_3)
rad_4 = Radians(Degrees=subtraction_5)
subtraction_6 = Subtraction(A="180", B=rounding_factor_pinion_inside_2)
addition_4 = Addition(A="0", B=rounding_factor_pinion_inside_2)
milling_it_radius_5 = Panel(milling_it_radius_4)
dom = ConstructDomain(DomainStart=rad_4, DomainEnd=rad_3)
xy_4 = XYPlane(Origin=Point(0, 0, 0))
rad_5 = Radians(Degrees=subtraction_6)
rad_6 = Radians(Degrees=addition_4)
dom_2 = ConstructDomain(DomainStart=rad_6, DomainEnd=rad_5)
pi_2 = Pi(Factor=1)
arc = Arc(Plane=xy_4, Radius=milling_it_radius_5, Angle=dom)  # -> Arc, Length
arc_2 = Arc(Plane=xy_3, Radius=milling_it_radius_5, Angle=dom_2)  # -> Arc, Length
rad_7 = Radians(Degrees=division_11)
rotate_3 = Rotate(Geometry=arc.Arc, Angle=pi_2, Plane=xy_4)  # -> Geometry, Transform
addition_5 = Addition(A=rad, B=rad_7)
number_slider = Slider(0.5, range=0..1)
rotate_4 = Rotate(Geometry=rotate_3.Geometry, Angle=rad, Plane=move.Geometry)  # -> Geometry, Transform
rotate_5 = Rotate(Geometry=arc_2.Arc, Angle=addition_5, Plane=move.Geometry)  # -> Geometry, Transform
flip = FlipCurve(Curve=rotate_4.Geometry)  # -> Curve, Flag
flip_2 = FlipCurve(Curve=rotate_5.Geometry)  # -> Curve, Flag
pinion_radius_2 = Panel(pinion_radius)
shift = ShiftList(List=flip.Curve, Shift=1, Wrap=True)
blendc = BlendCurve(CurveA=rotate_4.Geometry, CurveB=flip_2.Curve, BulgeA=number_slider, BulgeB=number_slider, Continuity=2)
blendc_2 = BlendCurve(CurveA=shift, CurveB=rotate_5.Geometry, BulgeA=number_slider, BulgeB=number_slider, Continuity=2)
neg_4 = Negative(Value=pinion_radius_2)
Y_2 = UnitY(Factor=neg_4)
cir_2 = Circle(Plane=move.Geometry, Radius=multiplication_4)
join_3 = JoinCurves(Curves=flatten([rotate_4.Geometry, rotate_5.Geometry, blendc, blendc_2]), Preserve=False)
move_9 = Move(Geometry=join_3, Motion=Y_2)  # -> Geometry, Transform
pinion_teeth = Curve(move_9.Geometry)

# ----
move_10 = Move(Geometry=cir_2, Motion=Y_2)  # -> Geometry, Transform

# ---- group: Create and blend pinion teeth (continued)
pinion_center_hole = Curve(move_10.Geometry)

# ---- group: Create pinion movement preview
preview_position_0_1_3 = Number(preview_position_0_1_2)
pinion_radius_3 = Panel(pinion_radius)
pinion_circumference_3 = Panel(pinion_circumference)
multiplication_14 = Multiplication(A="360", B=preview_position_0_1_3)
multiplication_15 = Multiplication(A=pinion_circumference_3, B=preview_position_0_1_3)
neg_5 = Negative(Value=multiplication_14)
X_4 = UnitX(Factor=multiplication_15)
rad_8 = Radians(Degrees=neg_5)
rotate_6 = Rotate(Geometry=flatten([join_3, cir_2]), Angle=rad_8, Plane=move.Geometry)  # -> Geometry, Transform
move_11 = Move(Geometry=rotate_6.Geometry, Motion=X_4)  # -> Geometry, Transform
neg_6 = Negative(Value=pinion_radius_3)
Y_3 = UnitY(Factor=neg_6)
move_12 = Move(Geometry=move_11.Geometry, Motion=Y_3)  # -> Geometry, Transform
pinion_movement_preview = Curve(move_12.Geometry)

# ---- group: Make pinion bit statisitics
pinion_radius_4 = Panel(pinion_radius)
rotate_7 = Rotate(Geometry=move.Geometry, Angle=4.71238898, Plane=move.Geometry)  # -> Geometry, Transform
pinion_teeth_2 = Curve(join_3)
cir_3 = Circle(Plane=rotate_7.Geometry, Radius=pinion_radius_4)
trim = TrimWithRegion(Curve=cir_3, Region=pinion_teeth_2)  # -> Inside, Outside
item_4 = ListItem(List=trim.Outside, Index=0, Wrap=True)
len = Length(Curve=flatten(item_4))
maxium_pinion_milling_bit_diamter = Panel(len)

# ----
maxium_pinion_milling_bit_diamter_2 = Panel(maxium_pinion_milling_bit_diamter)
maxium_pinion_milling_bit_diamter_3 = Number(maxium_pinion_milling_bit_diamter_2)
pinion_movement_preview_2 = Curve(pinion_movement_preview)
pinion_center_hole_2 = Curve(pinion_center_hole)
pinion_teeth_3 = Curve(pinion_teeth)
pinion_teeth_4 = ClusterOutput(pinion_teeth_3)
pinion_center_hole_3 = ClusterOutput(pinion_center_hole_2)
maxium_pinion_milling_bit_diamter_4 = ClusterOutput(maxium_pinion_milling_bit_diamter_3)
pinion_movement_preview_3 = ClusterOutput(pinion_movement_preview_2)

# ---- group: Create rack by copying and offsetting rack tooth
tooth_spacing_5 = Panel(tooth_spacing)
rack_length_5 = Panel(rack_length_4)
milling_bit_radius_2 = Panel(multiplication_3)
tooth_profile_for_copy_and_join = Curve(offset_tooth_for_copy_and_join)
pinion_radius_5 = Panel(pinion_radius)
addition_6 = Addition(A=pinion_radius_5, B=milling_bit_radius_2)
multiplication_16 = Multiplication(A=addition_6, B="2")
addition_7 = Addition(A=rack_length_5, B=multiplication_16)
division_12 = Division(A=addition_6, B=tooth_spacing_5)
actual_rack_length = Panel(addition_7)
round_2 = Round(Number=division_12)  # -> Nearest, Floor, Ceiling
multiplication_17 = Multiplication(A=round_2.Ceiling, B=tooth_spacing_5)
division_13 = Division(A=actual_rack_length, B=tooth_spacing_5)
neg_7 = Negative(Value=addition_6)
neg_8 = Negative(Value=multiplication_17)
round_3 = Round(Number=division_13)  # -> Nearest, Floor, Ceiling
rack_start_distance = Panel(neg_8)
rack_cut_start_distance = Panel(neg_7)
addition_8 = Addition(A=round_3.Ceiling, B="1")
series_4 = Series(Start=0, Step=tooth_spacing_5, Count=addition_8)
X_5 = UnitX(Factor=rack_start_distance)
move_13 = Move(Geometry=tooth_profile_for_copy_and_join, Motion=X_5)  # -> Geometry, Transform
X_6 = UnitX(Factor=series_4)
move_14 = Move(Geometry=move_13.Geometry, Motion=X_6)  # -> Geometry, Transform
pinion_radius_6 = Panel(pinion_radius)
join_4 = JoinCurves(Curves=move_14.Geometry, Preserve=False)
neg_9 = Negative(Value=pinion_radius_6)
Y_4 = UnitY(Factor=neg_9)
move_15 = Move(Geometry=join_4, Motion=Y_4)  # -> Geometry, Transform; disabled
rack_teeth = Curve(move_15.Geometry)

# ----
end_2 = EndPoints(Curve=move_13.Geometry)  # -> Start, End
dist = Distance(PointA=end_2.Start, PointB=end_2.End)
panel = Panel(dist)
move_16 = Move(Geometry=move_14.Geometry, Motion=Y_4)  # -> Geometry, Transform

# ---- group: Create rack by copying and offsetting rack tooth (continued)
rack_teeth_unjoined = Curve(move_16.Geometry)

# ---- group: Trim rack to specified length
rack_cut_start_distance_2 = Panel(rack_cut_start_distance)
actual_rack_length_2 = Panel(actual_rack_length)
pinion_diameter_2 = Panel(pinion_diameter)
rack_teeth_2 = Curve(rack_teeth)
pt_5 = ConstructPoint(XCoordinate=rack_cut_start_distance_2, YCoordinate=0, ZCoordinate=0)
xy_5 = XYPlane(Origin=pt_5)
neg_10 = Negative(Value=pinion_diameter_2)
rectangle = Rectangle(Plane=xy_5, XSize=actual_rack_length_2, YSize=neg_10, Radius=0)  # -> Rectangle, Length
trim_2 = TrimWithRegion(Curve=rack_teeth_2, Region=rectangle.Rectangle)  # -> Inside, Outside
bbox = BoundingBox(Content=trim_2.Inside, Plane=PlaneXY(0, 0, 0))  # -> Box, Box_2
edges = BrepEdges(Brep=bbox.Box)  # -> Naked, Interior, NonManifold
item_5 = ListItem(List=edges.Naked, Index="2", Wrap=True)
flip_3 = FlipCurve(Curve=item_5)  # -> Curve, Flag
rack_tooth_edge = Curve(flip_3.Curve)
trimmed_rack_teeth = Curve(trim_2.Inside)

# ----
rack_teeth_trimmed_and_joined = Curve(trimmed_rack_teeth)
rack_teeth_3 = Curve(rack_teeth_unjoined)
rack_teeth_4 = ClusterOutput(rack_teeth_3)

pinion_radius_7 = Panel(pinion_radius)
milling_bit_radius_3 = Panel(multiplication_3)
addition_9 = Addition(A=pinion_radius_7, B=milling_bit_radius_3)
cir_4 = Circle(Plane=move.Geometry, Radius=addition_9)

move_17 = Move(Geometry=cir_4, Motion=Y_2)  # -> Geometry, Transform

pinion_edge = Curve(move_17.Geometry)

pinion_edge_2 = Curve(pinion_edge)
pinion_edge_3 = ClusterOutput(pinion_edge_2)

# ==== cluster InsideGearForPinionMaker: Creates a gear matching a pinion from "Roller rack and pinion maker". Great for making geared rack and pinion drive systems. Connect pinion geometery from a "Roller rack and pinion maker" component.
number_of_input_pinion_teeth = ClusterInput()  # Input same pinion tooth count as used in "Roller rack and pinion maker"
preview_position_0_1 = ClusterInput()  # Connect a slider to preview gear movement
tooth_fillet_ratio = ClusterInput()  # Adjust to make sure pinion can roll soothly past to tips
pinion_center_hole_curve = ClusterInput()  # Connect pinion center hole geometry from "Roller rack and pinion maker"
number_of_gear_teeth = ClusterInput()  # Specify the number of teeth
milling_bit_diameter = ClusterInput()  # Input same diameter value as used in "Roller rack and pinion maker"
pinion_teeth_curve = ClusterInput()  # Connect pinion curve geometry from "Roller rack and pinion maker"

# ---- group: Low fillet ratio gives smoother motion, but makes a less robust pinion
tooth_fillet_ratio_2 = Number(tooth_fillet_ratio)
tooth_fillet_ratio_3 = Panel(tooth_fillet_ratio_2)

# ----
preview_position_0_1_2 = Number(preview_position_0_1)

# ---- group: Start numbers to help calculte pinion tooth path through rack
number_of_curve_sample_points = Slider(20, range=0..1000)
sample_tooth_position = Panel("0.26")

# ----
number_of_gear_teeth_2 = Number(number_of_gear_teeth)
milling_bit_diameter_2 = Number(milling_bit_diameter)
number_of_input_pinion_teeth_2 = Number(number_of_input_pinion_teeth)
pinion_teeth_curve_2 = Curve(pinion_teeth_curve)
pinion_center_hole_curve_2 = Curve(pinion_center_hole_curve)
number_of_gear_teeth_3 = Panel(number_of_gear_teeth_2)
milling_bit_diameter_3 = Panel(milling_bit_diameter_2)
number_of_pinion_teeth = Panel(number_of_input_pinion_teeth_2)
division = Division(A=number_of_gear_teeth_3, B=number_of_pinion_teeth)
explode = Explode(Curve=pinion_teeth_curve_2, Recursive=True)  # -> Segments, Vertices
smaller = SmallerThan(FirstNumber=division, SecondNumber="2")  # -> SmallerThan, OrEqualTo
item = ListItem(List=explode.Segments, Index=0, Wrap=True)
multiplication = Multiplication(A=number_of_pinion_teeth, B=sample_tooth_position)
input_pinion_has_at_least_half_the_tooth = Panel(smaller.SmallerThan)  # "Input pinion has at least half the tooth count"
darc = DeconstructArc(Arc=item)  # -> BasePlane, Radius, Angle
round = Round(Number=multiplication)  # -> Nearest, Floor, Ceiling
area = Area(Geometry=pinion_center_hole_curve_2)  # -> Area, Centroid
pinion_tooth_center_point = Point(darc.BasePlane)
sample_tooth_number = Panel(round.Ceiling)
xy = XYPlane(Origin=area.Centroid)
pinion_center_plane = Plane(xy)
dist = Distance(PointA=flatten(pinion_tooth_center_point), PointB=flatten(area.Centroid))
pinion_radius = Panel(dist)
multiplication_2 = Multiplication(A=pinion_radius, B="2")
pi = Pi(Factor=1)
multiplication_3 = Multiplication(A=multiplication_2, B=pi)
number_of_pinion_teeth_2 = Panel(number_of_pinion_teeth)
number_of_gear_teeth_4 = Panel(number_of_gear_teeth_3)
pinion_cirumference = Panel(multiplication_3)

number_of_curve_sample_points_2 = Panel(number_of_curve_sample_points)
number_of_pinion_teeth_3 = Panel(number_of_pinion_teeth)
sample_tooth_number_2 = Panel(sample_tooth_number)
input_pinion_has_at_least_half_the_tooth_2 = Panel(input_pinion_has_at_least_half_the_tooth)  # "Input pinion has at least half the tooth count"
pinion_circumference = Panel(pinion_cirumference)
pinion_circumference_2 = Panel(pinion_circumference)
division_2 = Division(A=pinion_circumference, B=number_of_pinion_teeth)
division_3 = Division(A=sample_tooth_number_2, B=number_of_pinion_teeth_3)
tooth_spacing = Panel(division_2)
multiplication_4 = Multiplication(A="360", B=division_3)
division_4 = Division(A=multiplication_4, B=number_of_curve_sample_points_2)
multiplication_5 = Multiplication(A=pinion_circumference_2, B=division_3)
division_5 = Division(A=number_of_pinion_teeth, B=number_of_gear_teeth_3)
series = Series(Start=0, Step=division_4, Count=number_of_curve_sample_points_2)
division_6 = Division(A=multiplication_5, B=number_of_curve_sample_points_2)
tooth_count_ratio = Panel(division_5)
neg = Negative(Value=series)
series_2 = Series(Start=0, Step=division_6, Count=number_of_curve_sample_points_2)
rad = Radians(Degrees=neg)
multiplication_6 = Multiplication(A=rad, B=tooth_count_ratio)
neg_2 = Negative(Value=rad)
neg_3 = Negative(Value=multiplication_6)
filter = StreamFilter(Gate=input_pinion_has_at_least_half_the_tooth_2, Stream0=rad, Stream1=neg_2)
filter_2 = StreamFilter(Gate=input_pinion_has_at_least_half_the_tooth_2, Stream0=neg_3, Stream1=multiplication_6)
tooth_spacing_2 = Panel(tooth_spacing)
gear_sample_positions = Panel(filter)
gear_sample_positions_2 = Panel(filter_2)

milling_bit_diameter_4 = Panel(milling_bit_diameter_3)
multiplication_7 = Multiplication(A=milling_bit_diameter_3, B=tooth_fillet_ratio_3)
multiplication_8 = Multiplication(A=milling_bit_diameter_4, B="0.5")
tooth_fillet_radius = Panel(multiplication_7)
milling_it_radius = Panel(multiplication_8)

division_7 = Division(A=pinion_cirumference, B=number_of_pinion_teeth_2)
tooth_spacing_3 = Panel(division_7)
multiplication_9 = Multiplication(A=tooth_spacing_3, B=number_of_gear_teeth_4)
gear_circumference = Panel(multiplication_9)
pi_2 = Pi(Factor=1)
division_8 = Division(A=gear_circumference, B=pi_2)
gear_diameter = Panel(division_8)
division_9 = Division(A=gear_diameter, B="2")
gear_radius = Panel(division_9)
pinion_tooth_center_point_2 = Point(pinion_tooth_center_point)
neg_4 = Negative(Value=gear_radius)
Y = UnitY(Factor=gear_radius)
move = Move(Geometry=pinion_tooth_center_point_2, Motion=Y)  # -> Geometry, Transform
gear_center_point = Point(move.Geometry)
xy_2 = XYPlane(Origin=gear_center_point)
gear_center_plane = Plane(xy_2)

gear_sample_positions_3 = Panel(gear_sample_positions_2)
gear_center_plane_2 = Plane(gear_center_plane)
rotate = Rotate(Geometry=graft(item), Angle=gear_sample_positions, Plane=pinion_center_plane)  # -> Geometry, Transform
gear_center_plane_3 = Plane(gear_center_plane)
number_of_gear_teeth_5 = Panel(number_of_gear_teeth_3)
X = UnitX(Factor=series_2)
move_2 = Move(Geometry=rotate.Geometry, Motion=X)  # -> Geometry, Transform
rotate_2 = Rotate(Geometry=rotate.Geometry, Angle=gear_sample_positions_3, Plane=gear_center_plane_2)  # -> Geometry, Transform
yz = YZPlane(Origin=gear_center_plane_3)
division_10 = Division(A="180", B=number_of_gear_teeth_5)
darc_2 = DeconstructArc(Arc=rotate_2.Geometry)  # -> BasePlane, Radius, Angle
rotate_3 = Rotate(Geometry=yz, Angle=degrees(division_10), Plane=gear_center_plane_3)  # -> Geometry, Transform
pt = Point(darc_2.BasePlane)
intcrv = Interpolate(Vertices=pt, Degree=3, Periodic=False, KnotStyle=1)  # -> Curve, Length, Domain
tooth_mid_plane = Plane(rotate_3.Geometry)
master_profile_curve = Curve(intcrv.Curve)

pinion_center_hole = Curve(pinion_center_hole_curve_2)
pinion_center_plane_2 = Plane(pinion_center_plane)
gear_center_plane_4 = Plane(gear_center_plane)
orient = Orient(Geometry=pinion_center_hole, Source=pinion_center_plane_2, Target=gear_center_plane_4)  # -> Geometry, Transform
gear_center_hole = Curve(orient.Geometry)

# ---- group: Create pinion movement preview
pinion_center_plane_3 = Plane(pinion_center_plane)
pinion_teeth = Curve(pinion_teeth_curve_2)
preview_position_0_1_3 = Number(preview_position_0_1_2)
multiplication_10 = Multiplication(A="360", B=preview_position_0_1_3)
neg_5 = Negative(Value=multiplication_10)
rad_2 = Radians(Degrees=neg_5)
rotate_4 = Rotate(Geometry=flatten(pinion_teeth), Angle=rad_2, Plane=pinion_center_plane_3)  # -> Geometry, Transform
pinion_movement_preview = Curve(rotate_4.Geometry)

# ----
gear_center_hole_2 = Curve(gear_center_hole)
pinion_movement_preview_2 = Curve(pinion_movement_preview)
gear_center_hole_3 = ClusterOutput(gear_center_hole_2)
pinion_movement_preview_3 = ClusterOutput(pinion_movement_preview_2)

milling_it_radius_2 = Panel(milling_it_radius)
master_profile_curve_2 = Curve(master_profile_curve)
gear_radius_2 = Panel(gear_radius)
valley_arc_from_pinion = Curve(item)
tooth_mid_plane_2 = Plane(tooth_mid_plane)
gear_center_plane_5 = Plane(gear_center_plane)
cir = Circle(Plane=gear_center_plane_5, Radius=gear_radius_2)
xy_3 = XYPlane(Origin=Point(0, 0, 0))
offset = Offset(Curve=master_profile_curve_2, Distance=milling_it_radius_2, Plane=xy_3, Corners=1)
ccx = CurveCurve(CurveA=offset, CurveB=cir)  # -> Points, ParamsA, ParamsB
shatter = Shatter(Curve=offset, Parameters=ccx.ParamsA)
rev = ReverseList(List=shatter)
milling_bit_diameter_5 = Panel(milling_bit_diameter_3)
item_2 = ListItem(List=rev, Index=0, Wrap=True)
ext = ExtendCurve(Curve=item_2, Type=0, Start=milling_bit_diameter_5, End=milling_bit_diameter_5)
valley_arc_from_pinion_2 = Curve(valley_arc_from_pinion)
extended_profile = Curve(ext)
ccx_2 = CurveCurve(CurveA=extended_profile, CurveB=valley_arc_from_pinion_2)  # -> Points, ParamsA, ParamsB
rev_2 = ReverseList(List=ccx_2.Points)
rev_3 = ReverseList(List=ccx_2.ParamsA)
item_3 = ListItem(List=rev_3, Index=0, Wrap=True)
yz_2 = YZPlane(Origin=Point(0, 0, 0))
item_4 = ListItem(List=rev_2, Index=0, Wrap=True)
shatter_2 = Shatter(Curve=extended_profile, Parameters=item_3)
mirror = Mirror(Geometry=item_4, Plane=yz_2)  # -> Geometry, Transform
rev_4 = ReverseList(List=shatter_2)
crv_cp = CurveClosestPoint(Point=[item_4, mirror.Geometry], Curve=valley_arc_from_pinion_2)  # -> Point, Parameter, Distance
item_5 = ListItem(List=rev_4, Index=0, Wrap=True)
shatter_3 = Shatter(Curve=valley_arc_from_pinion_2, Parameters=crv_cp.Parameter)
item_6 = ListItem(List=shatter_3, Index="1", Wrap=True)
trimmed_profile = Curve(item_5)
trimmed_valley = Curve(item_6)
curve_for_mirror = Curve(trimmed_profile)
mirror_2 = Mirror(Geometry=curve_for_mirror, Plane=tooth_mid_plane_2)  # -> Geometry, Transform
tooth_fillet_radius_2 = Panel(tooth_fillet_radius)
trimmed_valley_2 = Curve(trimmed_valley)

mirror_3 = Mirror(Geometry=curve_for_mirror, Plane=tooth_mid_plane_2)  # -> Geometry, Transform

ccx_3 = CurveCurve(CurveA=curve_for_mirror, CurveB=mirror_3.Geometry)  # -> Points, ParamsA, ParamsB
shatter_4 = Shatter(Curve=curve_for_mirror, Parameters=ccx_3.ParamsA)
item_7 = ListItem(List=shatter_4, Index=0, Wrap=True)
mirror_4 = Mirror(Geometry=item_7, Plane=tooth_mid_plane_2)  # -> Geometry, Transform
join = JoinCurves(Curves=[item_7, mirror_4.Geometry], Preserve=False)
fillet = Fillet(Curve=join, Radius=tooth_fillet_radius_2)
gear_profile = Curve(fillet)

number_of_gear_teeth_6 = Panel(number_of_gear_teeth_3)
gear_center_plane_6 = Plane(gear_center_plane)
tooth_valley = Curve(trimmed_valley_2)
tooth_profile = Curve(gear_profile)
division_11 = Division(A="360", B=number_of_gear_teeth_6)
series_3 = Series(Start=0, Step=division_11, Count=number_of_gear_teeth_6)
rotate_5 = Rotate(Geometry=[tooth_profile, tooth_valley], Angle=degrees(series_3), Plane=gear_center_plane_6)  # -> Geometry, Transform
join_2 = JoinCurves(Curves=flatten(rotate_5.Geometry), Preserve=False)
gear_teeth = Curve(join_2)

# ---- group: Create pinion movement preview
preview_position_0_1_4 = Number(preview_position_0_1_2)
gear_center_plane_7 = Plane(gear_center_plane)
number_of_gear_teeth_7 = Panel(number_of_gear_teeth_3)
number_of_pinion_teeth_4 = Panel(number_of_pinion_teeth)
gear_teeth_2 = Curve(gear_teeth)
division_12 = Division(A=number_of_pinion_teeth_4, B=number_of_gear_teeth_7)
multiplication_11 = Multiplication(A="360", B=preview_position_0_1_4)
neg_6 = Negative(Value=multiplication_11)
rad_3 = Radians(Degrees=neg_6)
multiplication_12 = Multiplication(A=rad_3, B=division_12)
rotate_6 = Rotate(Geometry=flatten(gear_teeth_2), Angle=multiplication_12, Plane=gear_center_plane_7)  # -> Geometry, Transform
gear_movement_preview = Curve(rotate_6.Geometry)

# ----
gear_movement_preview_2 = Curve(gear_movement_preview)
gear_teeth_3 = Curve(gear_teeth)
gear_teeth_4 = ClusterOutput(gear_teeth_3)
gear_movement_preview_3 = ClusterOutput(gear_movement_preview_2)
