# Grasshopper definition machine builder.gh (Grasshopper 0.9.76)
# Copyright: Creative commons attribution share-a-like
# plug-ins: Firefly.Core

merge = Merge(Data1="MDF: ", Data2="1.5", Data3=" M2")
merge_2 = Merge(Data1="Plastic: ", Data2="0.6", Data3=" M2")
join = TextJoin(Text=merge)
join_2 = TextJoin(Text=merge_2)
merge_3 = Merge(Data1=join, Data2=join_2, Data3="NEMA 17 motor: 4", Data4="Bolt M5: 24", Data5="Bolt M5: 24", Data6="Nut M5: 24")

# ---- group: Gantry bed
# ok lets verify this:
vaccum_tube_diameter = Slider(12, range=10..20)
make_vacuum_bed = BooleanToggle(True)

# ----
# Welcome to the machine builder.
# 
# A simple way of building custom machines
# with a large format CNC router.
# 
# 1; Specify your desired machine, materials and tools available
# 2: Simulate and verfify your machine
# 3: Generate g-code for cutting the various parts of the macine
# 4: Assemble, add end-effector, calibrate and use
# 1
# I want build this
# kind of machine:
# It should be able to
# make things this size:
list = ValueList({"Single axis": 0, "Simple gantry": 1, "Delta platform": 2}, selected="Single axis")

# ---- group: Single axis
axis_length = Slider(400, range=20..1000)

# ---- group: Simple gantry work area
work_area_x = Slider(640, range=20..1000)
work_area_y = Slider(320, range=20..1000)
work_area_z = Slider(40, range=20..1000)

# ---- group: Delta platform work area
end_effector_plate_diameter = Slider(60, range=60..200)
work_area_diameter = Slider(300, range=20..1000)
arm_to_platform_angle = Slider(60, range=45..75)

# ---- group: Z axis
make_z_axis_side1 = BooleanToggle(True)
motorize_z_axis_side1 = BooleanToggle(False)
motorize_z_axis_side2 = BooleanToggle(False)
motor_height = Slider(44, range=10..60)
make_z_axis_side2 = BooleanToggle(False)

# ---- group: Joinery
# Bonus features:
join_rails_with_dowels_instead_of_bolts = BooleanToggle(False)

# ----
job_simulation_position = Slider(0, range=0..1)
# Machine stats:
list_2 = ValueList({"View machine in 3D": 0, "View machine in 2D - 1:1": 1, "View machine from end effector position": 2}, selected="View machine in 3D")
# 2
# I want to simulate this job:
job_to_simulate = Panel("Hello world")

# ---- group: BOM
# Machine type:
# 
# Acutual Z axis travel:
# 
# Rigididity rating: 0.2
# Bill of materials:
panel = Panel(merge_3)

# ----
list_3 = ValueList({"I'm rich, give me an efficient cut sheet for all the parts": 0, "I'm poor, give me part: 1": 1, "I'm poor, give me part: 2": 2, "I'm poor, give me part: 3": 3, "I'm poor, give me part: 4": 4, "I'm poor, give me part: 5": 5, "I'm poor, give me part: 6": 6, "I'm poor, give me part: 7": 7, "I'm poor, give me part: 8": 8}, selected="I'm rich, give me an efficient cut sheet for all the parts")
# 3
# Now i want to:
list_4 = ValueList({"View machine parts": 0, "Pre fabricate rails, pinion and bearings": 1, "Cut pinion axis hole": 2, "Cut pinion teeth": 3, "Pre fabricate main frame parts": 4, "Cut registration geometry for the assembly": 5, "Cut v-rail geometry": 6, "Cut rack geometry": 7, "Flatten gantry bed": 8, "Drill vacuum holes": 9, "Document this machine": 10}, selected="Cut registration geometry for the assembly")
current_hold_down_g_code = Panel("M3 fest")
# I want to make this the manual way,
# give me the geometry:
current_part_main_cut_g_code = Panel("M3 fest")
# Speed multiplier?
# Milling bit for current job: 6mm single flute upcut
material_for_current_job = Panel("MDF 12mm")
# Instructions: Assmeble parts bla bla
minimum_distance_from_collet_to_bit_tip = Panel("5mm")  # "Minimum distance from collet to bit tip for current job"

# ---- group: Right clik and choose "Bake"
selected_machine_parts_for_export = Geometry()

# ---- group: Pinion axis inside cut
diameter = Slider(3, range=3..4)

# ---- group: Rack teeth cut
diameter_2 = Slider(3, range=2..6.35)

# ---- group: Birds mouth diamond bit
diameter_3 = Slider(38, range=10..50)
upper_knife_length = Slider(12, range=10..40)
lower_knife_length = Slider(22, range=10..40)

# ---- group: Main material and rail pre cut
# My milling bits:
diameter_4 = Slider(6, range=3..6.35)

# ---- group: Pinion pre cut
diameter_5 = Slider(6, range=3..6.35)

# ---- group: Pinion teeth cut
diameter_6 = Slider(2, range=2..4)

# ----
# I want it to glide with:
list_5 = ValueList({"Plain bearings, V-type": 0, "Skateboard bearing V-wheels": 1}, selected="Plain bearings, V-type")

# ---- group: Main construction material
# I want to use these materials:
list_6 = ValueList({"Valchromat / MDF": 0, "Plastic": 1, "Aluminum / Brass": 2}, selected="Valchromat / MDF")
thickness = Slider(12, range=10..20)

# ---- group: Rail, rack and pinion material
list_7 = ValueList({"Plastic": 0, "Aluminum / Brass": 1}, selected="Plastic")
thickness_2 = Slider(12, range=10..20)

# ---- group: Simple gantry bed surfacing bit
diameter_7 = Slider(10, range=10..20)

# ---- group: Vacuum bed hole drill
diameter_8 = Slider(3, range=1..6)

# ----
motor_shaft_diamameter = Slider(5, range=3..15)
# Advanced settings
# I want to use this
# motor standard:
list_8 = ValueList({"NEMA 17": 0, "NEMA 23": 1, "NEMA 34": 2}, selected="NEMA 17")

rack_teeth_bit = Panel(diameter_2)
motor_shaft_diamameter_2 = Panel(motor_shaft_diamameter)
motor_type = Panel(list_8)
motor_widths = Panel("""42.3
57.15
85.6""")
shaft_opening_diameters = Panel("""24
32
48""")
motor_type_2 = Panel(list_8)
motor_mount_hole_diameters = Panel("""3
5
6.5""")
motor_mount_hole_spacings = Panel("""31
47.14
69.6""")
hole_size_multiplier = Panel("1.1")
bearing_bolt_diameter = Panel("8")
hole_size_multiplier_2 = Panel("1.05")
main_material_bit = Panel(diameter_4)
pinion_pre_cut_bit = Panel(diameter_5)
pinion_axis_inside_bit = Panel(diameter)
main_material_thickness = Panel(thickness)
multiplication = Multiplication(A=motor_mount_hole_diameters, B=hole_size_multiplier)
rail_rack_and_pinion_material_thickness = Panel(thickness_2)
multiplication_2 = Multiplication(A=bearing_bolt_diameter, B=hole_size_multiplier_2)
item = ListItem(List=shaft_opening_diameters, Index=motor_type_2, Wrap=True)
item_2 = ListItem(List=motor_widths, Index=motor_type, Wrap=True)
item_3 = ListItem(List=multiplication, Index=motor_type_2, Wrap=True)
item_4 = ListItem(List=motor_mount_hole_spacings, Index=motor_type_2, Wrap=True)
motorize_z_axis_side1_2 = Panel(motorize_z_axis_side1)
motorize_z_axis_side1_3 = Panel(motorize_z_axis_side2)
make_z_axis_side2_2 = Panel(make_z_axis_side2)
motor_width = Panel(item_2)
make_z_axis_side1_2 = Panel(make_z_axis_side1)
thickness_underneath_motor_pocket_on_z_w = Panel("3")  # "Thickness underneath motor pocket on Z wall"
motor_mount_hole_spacing = Panel(item_4)
inner_v_rail_edge_to_bolt_center_distanc = Panel("10.5")  # "Inner v rail edge to bolt center distance"
bearing_bolt_placement_margin = Panel("6")
motor_height_2 = Panel(motor_height)
shaft_opening_diameter = Panel(item)
bearing_bolt_hole_diameter = Panel(multiplication_2)
thickness_underneath_motor_pocket_on_car = Panel("10")  # "Thickness underneath motor pocket on carriage"
carriage_plate_corner_radius = Panel("3")
# Uber advanced settings
axis_width = Panel("100")
carriage_lenght = Panel("100")
number_of_layers_beneath_rack_and_rail_l = Panel("2")  # "Number of layers beneath rack and rail layer"
number_of_layers_in_gantry_bed = Panel("2")
hold_down_minimum_spacing = Panel("100")
tab_width = Panel("12")
tab_height = Panel("8")
motor_mount_hole_diameter = Panel(item_3)
motor_mount_placement_margin = Panel("6")
extra_amount_of_pinions_to_cut = Panel("0")
registration_hole_depth = Panel("8")
nut_width_flat_side_to_flat_side = Panel("13")
nut_pocket_depth = Panel("9")
spacer_diameter_inc_margin = Panel("18")
attachment_bolt_diameter = Panel("8")
spacer_pocket_depth = Panel("7")
wedge_width_to_material_thickness_ratio = Panel("1.5")
wedge_or_bolt_spacing = Panel("50")
additional_axis_margin = Panel("2")
number_of_pinion_teeth = Panel("10")
pinion_to_pocket_wall_margin = Panel("2")
pinion_edge_screw_edge_margin = Panel("5")
v_rail_to_attachment_bolt_margin = Panel("5")
rack_and_pinion_tooth_height = Panel("6")
rack_and_pinion_tooth_overlap_reduction = Panel("1")  # "Rack and pinion tooth overlap reduction distance"
material_leftover_beneath_rack_teeth = Panel("0.5")
rail_to_carriage_safety_distance = Panel("2.5")
extra_cutout_depth = Panel("0.6")
extra_precut_with_offset_top_layer = Panel("1")
hold_down_and_registration_hole_diameter = Panel("8")
rack_mill_margin = Panel("0.1")
rail_flat_mid_section_heigth = Panel("1")
make_motor_mount_holes_millable_with_mai = Panel(Toggle(True))  # "Make motor mount holes millable with main milling bit"
or = GateOr(A=make_z_axis_side1_2, B=make_z_axis_side2_2)
motor_width_2 = Panel(motor_width)
motor_height_3 = Panel(motor_height_2)
thickness_underneath_motor_pocket_on_z_w_2 = Panel(thickness_underneath_motor_pocket_on_z_w)  # "Thickness underneath motor pocket on Z wall"
thickness_underneath_motor_pocket_on_car_2 = Panel(thickness_underneath_motor_pocket_on_car)  # "Thickness underneath motor pocket on carriage"

rack_and_pinion_tooth_overlap_reduction_2 = Panel(rack_and_pinion_tooth_overlap_reduction)  # "Rack and pinion tooth overlap reduction distance"
material_leftover_beneath_rack_teeth_2 = Panel(material_leftover_beneath_rack_teeth)
rail_to_carriage_safety_distance_2 = Panel(rail_to_carriage_safety_distance)
addition = Addition(A=rack_and_pinion_tooth_overlap_reduction_2, B=material_leftover_beneath_rack_teeth_2)
larger = LargerThan(FirstNumber=addition, SecondNumber=rail_to_carriage_safety_distance_2)  # -> LargerThan, OrEqualTo
inssuficent_sapce_between_pinion_and_car = Panel(larger.LargerThan)  # "Inssuficent sapce between pinion and carriage"

# ---- group: Make rack and pinion
# Optimize rack and pinion maker. Make offset, then copy. No join
# Find longest rack length and make only one rack?
axis_length_2 = Panel(axis_length)
additional_axis_margin_2 = Panel(additional_axis_margin)
rack_teeth_bit_diameter = Panel(diameter_2)
rack_mill_margin_2 = Panel(rack_mill_margin)
number_of_pinion_teeth_2 = Panel(number_of_pinion_teeth)
motor_shaft_diamameter_3 = Panel(motor_shaft_diamameter)
addition_2 = Addition(A=rack_teeth_bit_diameter, B=rack_mill_margin_2)
multiplication_3 = Multiplication(A=additional_axis_margin_2, B="2")
addition_3 = Addition(A=axis_length_2, B=multiplication_3)
actual_axis_lenght = Panel(addition_3)
roller_rack_and_pinion_maker = RollerRackAndPinionMaker(
    rack_length=actual_axis_lenght,
    milling_bit_diameter=addition_2,
    number_of_pinion_teeth=number_of_pinion_teeth_2,
    motor_shaft_diameter=motor_shaft_diamameter_3)  # -> rack_teeth_4, rack_edge_2, pinion_teeth_4, pinion_center_hole_3, pinion_edge_3, pinion_movement_preview_3, distance_covered_per_step_5, maxium_pinion_milling_bit_diamter_4

# ----
step_resolution = Panel(roller_rack_and_pinion_maker.distance_covered_per_step_5)
pinion_center_hole = Curve(roller_rack_and_pinion_maker.pinion_center_hole_3)
pinion_teeth = Curve(roller_rack_and_pinion_maker.pinion_teeth_4)

bird_bit_lower_knife_lenght = Panel(lower_knife_length)
bird_bit_diameter = Panel(diameter_3)
bird_bit_upper_knife_lenght = Panel(upper_knife_length)
multiplication_4 = Multiplication(A=bird_bit_diameter, B="0.5")
pt = ConstructPoint(XCoordinate=0, YCoordinate=multiplication_4, ZCoordinate=0)
pt_2 = ConstructPoint(XCoordinate=0, YCoordinate=multiplication_4, ZCoordinate=bird_bit_upper_knife_lenght)
pt_3 = ConstructPoint(XCoordinate=0, YCoordinate=multiplication_4, ZCoordinate=bird_bit_lower_knife_lenght)
yz = YZPlane(Origin=pt)
rotate = Rotate(Geometry=pt_2, Angle=degrees("45"), Plane=yz)  # -> Geometry, Transform
rotate_2 = Rotate(Geometry=pt_3, Angle=degrees("135"), Plane=yz)  # -> Geometry, Transform
pdecon = Deconstruct(Point=rotate_2.Geometry)  # -> XComponent, YComponent, ZComponent
Z = UnitZ(Factor="20")
pt_4 = ConstructPoint(XCoordinate=0, YCoordinate=0, ZCoordinate=0)
pt_5 = ConstructPoint(XCoordinate=0, YCoordinate=0, ZCoordinate=pdecon.ZComponent)
move = Move(Geometry=rotate.Geometry, Motion=Z)  # -> Geometry, Transform
ln = Line(StartPoint=pt, EndPoint=rotate.Geometry)
ln_2 = Line(StartPoint=pt, EndPoint=rotate_2.Geometry)
ln_3 = Line(StartPoint=pt_5, EndPoint=pt_4)
ln_4 = Line(StartPoint=rotate_2.Geometry, EndPoint=pt_5)
ln_5 = Line(StartPoint=move.Geometry, EndPoint=rotate.Geometry)
join_3 = JoinCurves(Curves=[ln_5, ln, ln_2, ln_4], Preserve=False)
revsrf = Revolution(Curve=join_3, Axis=ln_3, Domain=Domain(0, 6.283185307))
bird_beak_model = Brep(revsrf)
center_point = Point(pt_5)
upper_line = Line(ln)
lower_line = Line(ln_2)

# ---- group: Make rack and pinion pocket depths
material_leftover_beneath_rack_teeth_3 = Panel(material_leftover_beneath_rack_teeth)
rack_and_pinion_tooth_height_2 = Panel(rack_and_pinion_tooth_height)
rail_rack_and_pinion_material_thickness_2 = Panel(thickness_2)
subtraction = Subtraction(A=rail_rack_and_pinion_material_thickness_2, B=material_leftover_beneath_rack_teeth_3)
subtraction_2 = Subtraction(A=subtraction, B=rack_and_pinion_tooth_height_2)
rack_pocket_depth = Panel(subtraction_2)
pinion_pocket_depth = Panel(subtraction)

# ---- group: Check pinion teeth milling bit
max_pinion_diamter = Panel(roller_rack_and_pinion_maker.maxium_pinion_milling_bit_diamter_4)
xy = XYPlane(Origin=Point(0, 0, 0))
rack_mill_margin_3 = Panel(rack_mill_margin_2)
pinion_teeth_bit_diameter = Panel(diameter_6)
warning_plane = Plane(xy)
subtraction_3 = Subtraction(A=max_pinion_diamter, B=rack_mill_margin_3)
smaller = SmallerThan(FirstNumber=subtraction_3, SecondNumber=pinion_teeth_bit_diameter)  # -> SmallerThan, OrEqualTo
panel_2 = Panel("""WARNING:
Pinion teeth milling bit
diameter to large""")
filter = StreamFilter(Gate=smaller.OrEqualTo, Stream1=warning_plane)
tag = TextTag3D(Location=filter, Text=panel_2, Size="100", Colour=ColourSwatch(SwatchColor=RGB(255, 0, 102)), Justification=7)

# ---- group: Make rack top pocket
pinion_edge_screw_edge_margin_2 = Panel(pinion_edge_screw_edge_margin)
additional_axis_margin_3 = Panel(additional_axis_margin)
rack_teeth = Curve(roller_rack_and_pinion_maker.rack_teeth_4)
bbox = BoundingBox(Content=rack_teeth, Plane=PlaneXY(0, 0, 0), UnionBox=True)  # -> Box, Box_2
edges = BrepEdges(Brep=bbox.Box)  # -> Naked, Interior, NonManifold
item_5 = ListItem(List=edges.Naked, Index="2", Wrap=True)
item_6 = ListItem(List=edges.Naked, Index=0, Wrap=True)
flip = FlipCurve(Curve=item_5)  # -> Curve, Flag
neg = Negative(Value=pinion_edge_screw_edge_margin_2)
rack_tooth_edge = Curve(flip.Curve)
rack_outer_edge = Curve(item_6)
Y = UnitY(Factor=neg)
Y_2 = UnitY(Factor="1")
ext = ExtendCurve(Curve=rack_tooth_edge, Type=0, Start=additional_axis_margin_3, End=additional_axis_margin_3)
ext_2 = ExtendCurve(Curve=rack_outer_edge, Type=0, Start=additional_axis_margin_3, End=additional_axis_margin_3)
move_2 = Move(Geometry=ext_2, Motion=Y)  # -> Geometry, Transform
move_3 = Move(Geometry=ext, Motion=Y_2)  # -> Geometry, Transform
end = EndPoints(Curve=move_3.Geometry)  # -> Start, End
end_2 = EndPoints(Curve=move_2.Geometry)  # -> Start, End
ln_6 = Line(StartPoint=end.End, EndPoint=end_2.End)
ln_7 = Line(StartPoint=end.Start, EndPoint=end_2.Start)
join_4 = JoinCurves(Curves=flatten([move_3.Geometry, ln_7, ln_6, move_2.Geometry]), Preserve=False)
rack_pocket_depth_2 = Panel(rack_pocket_depth)
rack_pocket = Curve(join_4)

# ---- group: Make pinion pocket
pinion_to_pocket_wall_margin_2 = Panel(pinion_to_pocket_wall_margin)
pinion_edge = Curve(roller_rack_and_pinion_maker.pinion_edge_3)
bbox_2 = BoundingBox(Content=pinion_edge, Plane=PlaneXY(0, 0, 0))  # -> Box, Box_2
dim = Dimensions(Surface=flatten(bbox_2.Box))  # -> UDimension, VDimension
pinion_width = Panel(dim.UDimension)
rack_tooth_edge_2 = Curve(ext)
multiplication_5 = Multiplication(A=pinion_width, B="0.5")
addition_4 = Addition(A=multiplication_5, B=pinion_to_pocket_wall_margin_2)
end_3 = EndPoints(Curve=rack_tooth_edge_2)  # -> Start, End
pdecon_2 = Deconstruct(Point=end_3.Start)  # -> XComponent, YComponent, ZComponent
pdecon_3 = Deconstruct(Point=end_3.End)  # -> XComponent, YComponent, ZComponent
pt_6 = ConstructPoint(XCoordinate=pdecon_2.XComponent, YCoordinate=addition_4, ZCoordinate=0)
pt_7 = ConstructPoint(XCoordinate=pdecon_3.XComponent, YCoordinate=addition_4, ZCoordinate=0)
ln_8 = Line(StartPoint=pt_6, EndPoint=pt_7)
end_4 = EndPoints(Curve=ln_8)  # -> Start, End
end_5 = EndPoints(Curve=rack_tooth_edge_2)  # -> Start, End
ln_9 = Line(StartPoint=end_4.End, EndPoint=end_5.End)
ln_10 = Line(StartPoint=end_4.Start, EndPoint=end_5.Start)
join_5 = JoinCurves(Curves=flatten([ln_10, ln_9, rack_tooth_edge_2, ln_8]), Preserve=False)
pinion_pocket_depth_2 = Panel(pinion_pocket_depth)
# make pocket depths
pinion_pocket = Curve(join_5)

# ---- group: Make rack preview
rack_pocket_depth_3 = Panel(rack_pocket_depth)
rack_teeth_2 = Curve(roller_rack_and_pinion_maker.rack_teeth_4)
neg_2 = Negative(Value=rack_pocket_depth_3)
Z_2 = UnitZ(Factor=neg_2)
move_4 = Move(Geometry=rack_teeth_2, Motion=Z_2)  # -> Geometry, Transform
rack_teeth_3 = Curve(move_4.Geometry)

# ----
additional_axis_margin_4 = Panel(additional_axis_margin_2)
X = UnitX(Factor=additional_axis_margin_4)
yz_2 = YZPlane(Origin=Point(0, 0, 0))
xy_2 = XYPlane(Origin=Point(0, 0, 0))

# ---- group: Make nut pocket
nut_pocket_depth_2 = Panel(nut_pocket_depth)
nut_width_flat_side_to_flat_side_2 = Panel(nut_width_flat_side_to_flat_side)
xy_3 = XYPlane(Origin=Point(0, 0, 0))
rotate_3 = Rotate(Geometry=xy_3, Angle=1.570796327, Plane=xy_3)  # -> Geometry, Transform
nut_pocket_depth_3 = Panel(nut_pocket_depth_2)
polygon = Polygon(Plane=xy_3, Radius=nut_width_flat_side_to_flat_side_2, Segments="3", FilletRadius=0)  # -> Polygon, Length
nut_pocket = Curve(polygon.Polygon)

# ---- group: Make tab boxes for main material cutting
tab_height_2 = Panel(tab_height)
main_material_bit_2 = Panel(diameter_4)
tab_width_2 = Panel(tab_width)
xy_4 = XYPlane(Origin=Point(0, 0, 0))
multiplication_6 = Multiplication(A=tab_width_2, B="0.5")
box = CenterBox(Base=xy_4, X=main_material_bit_2, Y=multiplication_6, Z=tab_height_2)
tab_box = Brep(box)

# ---- group: Make inside axis hold down holes
actual_axis_lenght_2 = Panel(actual_axis_lenght)
hold_down_hole_diameter = Panel(hold_down_and_registration_hole_diameter)
hold_down_minimum_spacing_2 = Panel(hold_down_minimum_spacing)
division = Division(A=actual_axis_lenght_2, B=hold_down_minimum_spacing_2)
multiplication_7 = Multiplication(A=hold_down_hole_diameter, B="0.5")
round = Round(Number=division)  # -> Nearest, Floor, Ceiling
xy_5 = XYPlane(Origin=Point(0, 0, 0))
division_2 = Division(A=actual_axis_lenght_2, B=round.Ceiling)
cir = Circle(Plane=xy_5, Radius=multiplication_7)
X_2 = UnitX(Factor=division_2)
addition_5 = Addition(A=round.Ceiling, B="1")
arrlinear = LinearArray(Geometry=cir, Direction=X_2, Count=addition_5)  # -> Geometry, Transform
inside_axis_hold_down_holes = Curve(arrlinear.Geometry)
hold_down_hole = Curve(cir)

# ----
rack_pocket_depth_4 = Panel(rack_pocket_depth)
rack_teeth_4 = Curve(roller_rack_and_pinion_maker.rack_teeth_4)
cut_rack_geometry_identifer = Panel("7")
current_action = Panel(list_4)
rack_teeth_bit_diameter_2 = Panel(diameter_2)
rack_mill_margin_4 = Panel(rack_mill_margin)
first_premill_stepover = Panel("0.05")
rack_and_pinion_tooth_height_3 = Panel(rack_and_pinion_tooth_height_2)
neg_3 = Negative(Value=rack_pocket_depth_4)
equals = Equality(FirstNumber=cut_rack_geometry_identifer, SecondNumber=current_action)  # -> Equality, Inequality
multiplication_8 = Multiplication(A=rack_mill_margin_4, B="0.5")
multiplication_9 = Multiplication(A=rack_teeth_bit_diameter_2, B="0.5")
multiplication_10 = Multiplication(A=rack_teeth_bit_diameter_2, B=first_premill_stepover)
Z_3 = UnitZ(Factor=neg_3)
filter_2 = StreamFilter(Gate=equals.Equality, Stream1=rack_teeth_4)
addition_6 = Addition(A=multiplication_9, B=multiplication_8)
flip_2 = FlipCurve(Curve=filter_2)  # -> Curve, Flag
addition_7 = Addition(A=addition_6, B=multiplication_10)
move_5 = Move(Geometry=flip_2.Curve, Motion=Z_3)  # -> Geometry, Transform
cut1 = Panel(addition_7)
cut2 = Panel(addition_6)
cut3 = Panel(multiplication_9)
rack_teeth_5 = Curve(move_5.Geometry)
offset = Offset(Curve=rack_teeth_5, Distance=cut1, Plane=PlaneXY(0, 0, 0), Corners=1)
offset_2 = Offset(Curve=rack_teeth_5, Distance=cut2, Plane=PlaneXY(0, 0, 0), Corners=1)
offset_3 = Offset(Curve=rack_teeth_5, Distance=cut3, Plane=PlaneXY(0, 0, 0), Corners=1)
flip_3 = FlipCurve(Curve=offset)  # -> Curve, Flag
flip_4 = FlipCurve(Curve=offset_2)  # -> Curve, Flag
rack_cut_depth = Panel(rack_and_pinion_tooth_height_3)
rack_finish_mill = Curve(offset_3)
rack_premill1 = Curve(flip_3.Curve)
rack_premill2 = Curve(flip_4.Curve)

corner_radius = Panel(carriage_plate_corner_radius)

# ---- group: Find axis edges and width
axis_width_2 = Panel(axis_width)
pinion_edge_screw_edge_margin_3 = Panel(pinion_edge_screw_edge_margin_2)
carriage_lenght_2 = Panel(carriage_lenght)
wedge_width_to_material_thickness_ratio_2 = Panel(wedge_width_to_material_thickness_ratio)
actual_axis_lenght_3 = Panel(actual_axis_lenght)
v_rail_to_attachment_bolt_margin_2 = Panel(v_rail_to_attachment_bolt_margin)
spacer_diamter = Panel(spacer_diameter_inc_margin)
pinion_width_2 = Panel(dim.UDimension)
join_rails_with_dowels_instead_of_bolts_2 = Panel(join_rails_with_dowels_instead_of_bolts)
additional_axis_margin_5 = Panel(additional_axis_margin)
main_material_thickness_2 = Panel(thickness)
multiplication_11 = Multiplication(A=wedge_width_to_material_thickness_ratio_2, B=main_material_thickness_2)
multiplication_12 = Multiplication(A=pinion_width_2, B="0.5")
top_wedge_hole_width = Panel(multiplication_11)
addition_8 = Addition(A=multiplication_12, B=pinion_edge_screw_edge_margin_3)
minium_distance_to_start_bolt_placing = Panel(addition_8)
filter_3 = StreamFilter(Gate=join_rails_with_dowels_instead_of_bolts_2, Stream0=spacer_diamter, Stream1=top_wedge_hole_width)
top_hole_width = Panel(filter_3)
v_rail_to_attachment_bolt_margin_3 = Panel(v_rail_to_attachment_bolt_margin_2)
multiplication_13 = Multiplication(A=top_hole_width, B="0.5")
addition_9 = Addition(A=multiplication_13, B=v_rail_to_attachment_bolt_margin_3)
bolt_hole_pluss_margin_radus = Panel(addition_9)
addition_10 = Addition(A=minium_distance_to_start_bolt_placing, B=bolt_hole_pluss_margin_radus)
attachment_bolt_center_line_distance = Panel(addition_10)
bolt_hole_pluss_margin_radus_2 = Panel(addition_9)
desired_axis_width = Panel(axis_width_2)
multiplication_14 = Multiplication(A=desired_axis_width, B="0.5")
addition_11 = Addition(A=attachment_bolt_center_line_distance, B=addition_9, C=v_rail_to_attachment_bolt_margin_3)
multiplication_15 = Multiplication(A=addition_11, B="2")
subtraction_4 = Subtraction(A=multiplication_14, B=bolt_hole_pluss_margin_radus_2)
minimum_axis_width = Panel(multiplication_15)
desired_axis_width_2 = Panel(axis_width_2)
subtraction_5 = Subtraction(A=subtraction_4, B=v_rail_to_attachment_bolt_margin_3)
desired_attachment_bolt_center_line_dist = Panel(subtraction_5)  # "Desired attachment bolt center line distance"
smaller_2 = SmallerThan(FirstNumber=minimum_axis_width, SecondNumber=desired_axis_width_2)  # -> SmallerThan, OrEqualTo
filter_4 = StreamFilter(Gate=smaller_2.SmallerThan, Stream0=minimum_axis_width, Stream1=desired_axis_width_2)
axis_width_3 = Panel(filter_4)
filter_5 = StreamFilter(
    Gate=smaller_2.SmallerThan,
    Stream0=attachment_bolt_center_line_distance,
    Stream1=desired_attachment_bolt_center_line_dist)
attachment_bolt_center_line_distance_2 = Panel(filter_5)
actual_axis_lenght_4 = Panel(actual_axis_lenght_3)
multiplication_16 = Multiplication(A=axis_width_3, B="0.5")
carriage_lenght_3 = Panel(carriage_lenght_2)
additional_axis_margin_6 = Panel(additional_axis_margin_5)
pt_8 = ConstructPoint(XCoordinate=0, YCoordinate=attachment_bolt_center_line_distance_2, ZCoordinate=0)
pt_9 = ConstructPoint(XCoordinate=actual_axis_lenght_4, YCoordinate=attachment_bolt_center_line_distance_2, ZCoordinate=0)
pt_10 = ConstructPoint(XCoordinate=0, YCoordinate=multiplication_16, ZCoordinate=0)
pt_11 = ConstructPoint(XCoordinate=actual_axis_lenght_4, YCoordinate=multiplication_16, ZCoordinate=0)
multiplication_17 = Multiplication(A=carriage_lenght_3, B="0.5")
ln_11 = Line(StartPoint=pt_8, EndPoint=pt_9)
addition_12 = Addition(A=multiplication_17, B=additional_axis_margin_6)
ln_12 = Line(StartPoint=pt_10, EndPoint=pt_11)
ext_3 = ExtendCurve(Curve=ln_11, Type=0, Start=addition_12, End=addition_12)
ext_4 = ExtendCurve(Curve=ln_12, Type=0, Start=addition_12, End=addition_12)
carriage_lenght_4 = Panel(carriage_lenght_2)
axis_width_4 = Panel(axis_width_3)
bolt_placement_axis = Curve(ext_3)
axis_edge = Curve(ext_4)

# ----
len = Length(Curve=ext_4)

# ---- group: Find axis edges and width (continued)
actual_axis_length = Panel(len)

# ----
wedge_or_bolt_spacing_2 = Panel(wedge_or_bolt_spacing)
wedge_width_to_material_thickness_ratio_3 = Panel(wedge_width_to_material_thickness_ratio)
spacer_diamter_2 = Panel(spacer_diameter_inc_margin)
join_rails_with_dowels_instead_of_bolts_3 = Panel(join_rails_with_dowels_instead_of_bolts_2)
main_material_thickness_3 = Panel(thickness)
bolt_placement_axis_2 = Curve(bolt_placement_axis)
multiplication_18 = Multiplication(A=wedge_width_to_material_thickness_ratio_3, B=main_material_thickness_3)
top_wedge_hole_width_2 = Panel(multiplication_18)
bolt_placement_axis_3 = Curve(bolt_placement_axis_2)
filter_6 = StreamFilter(Gate=join_rails_with_dowels_instead_of_bolts_3, Stream0=spacer_diamter_2, Stream1=top_wedge_hole_width_2)
hole_width = Panel(filter_6)
len_2 = Length(Curve=bolt_placement_axis_3)
subtraction_6 = Subtraction(A=len_2, B=hole_width)
merge_4 = Merge(Data1=hole_width, Data2=subtraction_6)
eval = EvaluateLength(Curve=bolt_placement_axis_3, Length=merge_4, Normalized=Toggle(False))  # -> Point, Tangent, Parameter
shatter = Shatter(Curve=bolt_placement_axis_3, Parameters=eval.Parameter)
wedge_or_bolt_spacing_3 = Panel(wedge_or_bolt_spacing_2)
item_7 = ListItem(List=shatter, Index="1", Wrap=True)
divide_curve_even_lenght = DivideCurveEvenLenght(crv=item_7, B=wedge_or_bolt_spacing_3)
xz = XZPlane(Origin=Point(0, 0, 0))
xy_6 = XYPlane(Origin=divide_curve_even_lenght)
mirror = Mirror(Geometry=xy_6, Plane=xz)  # -> Geometry, Transform
hole_planes_top_layer = Plane([xy_6, mirror.Geometry])

# ---- group: Make v rail profiles
bird_bit_upper_line = Line(upper_line)
rail_rack_and_pinion_material_thickness_3 = Panel(thickness_2)
rail_to_carriage_safety_distance_3 = Panel(rail_to_carriage_safety_distance)
rail_flat_mid_section_heigth_2 = Panel(rail_flat_mid_section_heigth)
bird_bit_lower_line = Line(lower_line)
bird_bit_center_point = Point(center_point)
xz_2 = XZPlane(Origin=Point(0, 0, 0))
axis_edge_2 = Curve(axis_edge)
mirror_2 = Mirror(Geometry=axis_edge_2, Plane=xz_2)  # -> Geometry, Transform
end_6 = EndPoints(Curve=mirror_2.Geometry)  # -> Start, End
multiplication_19 = Multiplication(A=rail_to_carriage_safety_distance_3, B="0.5")
multiplication_20 = Multiplication(A=rail_flat_mid_section_heigth_2, B="0.5")
subtraction_7 = Subtraction(A=rail_rack_and_pinion_material_thickness_3, B=multiplication_19)
multiplication_21 = Multiplication(A=subtraction_7, B="0.5")
v_rail_center_depth = Panel(multiplication_21)
v_rail_height = Panel(subtraction_7)
rail_to_carriege_safety_distance_2 = Panel(multiplication_19)
addition_13 = Addition(A=v_rail_center_depth, B=multiplication_20)
subtraction_8 = Subtraction(A=v_rail_center_depth, B=multiplication_20)
neg_4 = Negative(Value=rail_to_carriege_safety_distance_2)
neg_5 = Negative(Value=rail_to_carriege_safety_distance_2)
neg_6 = Negative(Value=subtraction_8)
neg_7 = Negative(Value=v_rail_height)
neg_8 = Negative(Value=addition_13)
pt_12 = Point(end_6.Start)
Y_3 = UnitY(Factor=subtraction_8)
Z_4 = UnitZ(Factor=neg_4)
Y_4 = UnitY(Factor=subtraction_8)
Z_5 = UnitZ(Factor=neg_6)
Y_5 = UnitY(Factor=neg_5)
Z_6 = UnitZ(Factor=neg_7)
Z_7 = UnitZ(Factor=neg_8)
move_6 = Move(Geometry=pt_12, Motion=Y_3)  # -> Geometry, Transform
move_7 = Move(Geometry=pt_12, Motion=Z_5)  # -> Geometry, Transform
move_8 = Move(Geometry=pt_12, Motion=Y_4)  # -> Geometry, Transform
move_9 = Move(Geometry=pt_12, Motion=Z_7)  # -> Geometry, Transform
move_10 = Move(Geometry=move_6.Geometry, Motion=Z_6)  # -> Geometry, Transform
rail_lowest_point = Point(move_10.Geometry)
move_11 = Move(Geometry=rail_lowest_point, Motion=Z_4)  # -> Geometry, Transform
move_12 = Move(Geometry=move_11.Geometry, Motion=Y_5)  # -> Geometry, Transform
ln_13 = Line(StartPoint=move_8.Geometry, EndPoint=move_7.Geometry)
ln_14 = Line(StartPoint=rail_lowest_point, EndPoint=move_12.Geometry)
ln_15 = Line(StartPoint=move_10.Geometry, EndPoint=move_9.Geometry)
ln_16 = Line(StartPoint=move_7.Geometry, EndPoint=move_9.Geometry)
v_rail_upper_line = Curve(ln_13)
bird_bit_center_point_2 = Point(bird_bit_center_point)
bird_bit_lower_line_2 = Line(bird_bit_lower_line)
bird_bit_center_point_3 = Point(bird_bit_center_point)
bird_beak_model_2 = Brep(bird_beak_model)
bird_bit_upper_line_2 = Line(bird_bit_upper_line)
v_rail_lower_line = Curve(ln_15)
v_rail_mid_section = Curve(ln_16)
v_rail_rest_line = Curve(ln_14)
bird_beak_model_3 = Brep(bird_beak_model)
len_3 = Length(Curve=bird_bit_lower_line_2)
eval_2 = EvaluateLength(Curve=bird_bit_lower_line_2, Length="0.5", Normalized=True)  # -> Point, Tangent, Parameter
eval_3 = EvaluateLength(Curve=v_rail_upper_line, Length="0.5", Normalized=True)  # -> Point, Tangent, Parameter
len_4 = Length(Curve=v_rail_upper_line)
eval_4 = EvaluateLength(Curve=v_rail_lower_line, Length="0", Normalized=True)  # -> Point, Tangent, Parameter
len_5 = Length(Curve=v_rail_lower_line)
eval_5 = EvaluateLength(Curve=bird_bit_upper_line_2, Length="0", Normalized=True)  # -> Point, Tangent, Parameter
len_6 = Length(Curve=bird_bit_upper_line_2)
yz_3 = YZPlane(Origin=eval_2.Point)
yz_4 = YZPlane(Origin=eval_3.Point)
v_rail_upper_line_2 = Curve(v_rail_upper_line)
v_rail_mid_section_2 = Curve(v_rail_mid_section)
v_rail_lower_line_2 = Curve(v_rail_lower_line)
v_rail_rest_line_2 = Curve(v_rail_rest_line)
yz_5 = YZPlane(Origin=eval_4.Point)
yz_6 = YZPlane(Origin=eval_5.Point)
merge_5 = Merge(Data1=v_rail_upper_line_2, Data2=v_rail_mid_section_2, Data3=v_rail_lower_line_2, Data4=v_rail_rest_line_2)
orient = Orient(Geometry=bird_bit_center_point_2, Source=yz_3, Target=yz_4)  # -> Geometry, Transform
orient_2 = Orient(Geometry=bird_bit_center_point_3, Source=yz_6, Target=yz_5)  # -> Geometry, Transform
orient_3 = Orient(Geometry=bird_beak_model_2, Source=yz_3, Target=yz_4)  # -> Geometry, Transform
orient_4 = Orient(Geometry=bird_beak_model_3, Source=yz_6, Target=yz_5)  # -> Geometry, Transform
join_6 = JoinCurves(Curves=merge_5, Preserve=False)
v_rail_edge_cleanup_depth = Panel(addition_13)
end_point_upper_rail_path = Point(orient.Geometry)
end_point_lower_rail_path = Point(orient_2.Geometry)
rail_lowest_point_2 = Point(move_12.Geometry)
rail_profile = Curve(join_6)

# ----
# Make motor pocket option?
rail_rack_and_pinion_material_thickness_4 = Panel(thickness_2)
rail_to_carriage_safety_distance_4 = Panel(rail_to_carriage_safety_distance)
rail_flat_mid_section_heigth_3 = Panel(rail_flat_mid_section_heigth)
v_rail_upper_line_3 = Curve(v_rail_upper_line)
v_rail_lower_line_3 = Curve(v_rail_lower_line)
end_7 = EndPoints(Curve=v_rail_lower_line_3)  # -> Start, End
end_8 = EndPoints(Curve=v_rail_upper_line_3)  # -> Start, End
end_9 = EndPoints(Curve=v_rail_lower_line_3)  # -> Start, End
end_10 = EndPoints(Curve=v_rail_upper_line_3)  # -> Start, End
multiplication_22 = Multiplication(A=rail_to_carriage_safety_distance_4, B="0.5")
multiplication_23 = Multiplication(A=rail_flat_mid_section_heigth_3, B="0.5")
neg_9 = Negative(Value=multiplication_22)
neg_10 = Negative(Value=multiplication_23)
neg_11 = Negative(Value=multiplication_22)
Z_8 = UnitZ(Factor=multiplication_22)
Z_9 = UnitZ(Factor=neg_9)
neg_12 = Negative(Value=multiplication_23)
Z_10 = UnitZ(Factor=multiplication_23)
Z_11 = UnitZ(Factor=neg_10)
move_13 = Move(Geometry=end_7.Start, Motion=Z_8)  # -> Geometry, Transform
move_14 = Move(Geometry=end_8.Start, Motion=Z_9)  # -> Geometry, Transform
Y_6 = UnitY(Factor=neg_11)
move_15 = Move(Geometry=end_9.End, Motion=Z_10)  # -> Geometry, Transform
move_16 = Move(Geometry=end_10.End, Motion=Z_11)  # -> Geometry, Transform
Y_7 = UnitY(Factor=neg_12)
move_17 = Move(Geometry=move_13.Geometry, Motion=Y_6)  # -> Geometry, Transform
move_18 = Move(Geometry=move_14.Geometry, Motion=Y_6)  # -> Geometry, Transform
move_19 = Move(Geometry=move_15.Geometry, Motion=Y_7)  # -> Geometry, Transform
move_20 = Move(Geometry=move_16.Geometry, Motion=Y_7)  # -> Geometry, Transform
rail_rack_and_pinion_material_thickness_5 = Panel(rail_rack_and_pinion_material_thickness_4)
ln_17 = Line(StartPoint=move_17.Geometry, EndPoint=move_19.Geometry)
ln_18 = Line(StartPoint=move_18.Geometry, EndPoint=move_20.Geometry)
pdecon_4 = Deconstruct(Point=move_20.Geometry)  # -> XComponent, YComponent, ZComponent
pdecon_5 = Deconstruct(Point=move_18.Geometry)  # -> XComponent, YComponent, ZComponent
v_bearing_lower_line = Curve(ln_17)
v_bearing_lower_line_2 = Curve(v_bearing_lower_line)
end_11 = EndPoints(Curve=v_bearing_lower_line_2)  # -> Start, End
pt_13 = Point(end_11.Start)
v_bearing_upper_line = Curve(ln_18)
v_bearing_upper_line_2 = Curve(v_bearing_upper_line)
end_12 = EndPoints(Curve=v_bearing_upper_line_2)  # -> Start, End
pt_14 = Point(end_12.Start)
pt_15 = ConstructPoint(XCoordinate=0, YCoordinate=pdecon_5.YComponent, ZCoordinate=0)
pt_16 = ConstructPoint(XCoordinate=0, YCoordinate=pdecon_4.YComponent, ZCoordinate=0)
dist = Distance(PointA=pt_14, PointB=pt_13)
dist_2 = Distance(PointA=pt_15, PointB=pt_16)
subtraction_9 = Subtraction(A=rail_rack_and_pinion_material_thickness_5, B=dist)
grove_depth_bearing = Panel(dist_2)
Z_12 = UnitZ(Factor=subtraction_9)
move_21 = Move(Geometry=pt_14, Motion=Z_12)  # -> Geometry, Transform
ln_19 = Line(StartPoint=move_21.Geometry, EndPoint=pt_14)
join_7 = JoinCurves(Curves=[v_bearing_upper_line, v_bearing_lower_line], Preserve=False)
move_22 = Move(Geometry=move_20.Geometry, Motion=X)  # -> Geometry, Transform
move_23 = Move(Geometry=move_18.Geometry, Motion=X)  # -> Geometry, Transform
move_24 = Move(Geometry=join_7, Motion=X)  # -> Geometry, Transform
v_bearing_inside_corner_point = Point(move_22.Geometry)
v_bearing_straight_top_line = Curve(ln_19)
v_bearing_outer_point = Point(move_23.Geometry)
v_bearing_profile = Curve(move_24.Geometry)

# ---- group: Make wedge holes
wedge_width_to_material_thickness_ratio_4 = Panel(wedge_width_to_material_thickness_ratio_3)
dogbone_corner_reduction_factor = Panel(".66")
wedge_hole_margin = Panel("0")
dogbone_margin = Panel("0.05")
join_rails_with_dowels_instead_of_bolts_4 = Panel(join_rails_with_dowels_instead_of_bolts_3)
main_material_thickness_4 = Panel(main_material_thickness_3)
main_material_bit_3 = Panel(diameter_4)
filter_7 = StreamFilter(Gate=join_rails_with_dowels_instead_of_bolts_4, Stream1=main_material_thickness_4)
main_material_thickness_5 = Panel(filter_7)
multiplication_24 = Multiplication(A=main_material_bit_3, B="0.5")
xy_7 = XYPlane(Origin=Point(0, 0, 0))
dom = ConstructDomain(DomainStart="0.01", DomainEnd="0.99")
addition_14 = Addition(A=multiplication_24, B=dogbone_margin)
constrain = Constrain(Number=dogbone_corner_reduction_factor, Domain=dom)
multiplication_25 = Multiplication(A=main_material_thickness_5, B="0.5")
cir_2 = Circle(Plane=xy_7, Radius=addition_14)
addition_15 = Addition(A=multiplication_25, B=wedge_hole_margin)
wedge_width_to_material_thickness_ratio_5 = Panel(wedge_width_to_material_thickness_ratio_4)
multiplication_26 = Multiplication(A=addition_14, B=constrain)
main_material_thickness_6 = Panel(main_material_thickness_5)
multiplication_27 = Multiplication(A=main_material_thickness_6, B=wedge_width_to_material_thickness_ratio_5)
multiplication_28 = Multiplication(A=multiplication_27, B="0.5")
multiplication_29 = Multiplication(A=multiplication_26, B="0.5")
multiplication_30 = Multiplication(A=multiplication_26, B="0.5")
addition_16 = Addition(A=addition_15, B=multiplication_29)
addition_17 = Addition(A=addition_15, B=multiplication_30)
neg_13 = Negative(Value=addition_15)
neg_14 = Negative(Value=multiplication_28)
neg_15 = Negative(Value=addition_15)
neg_16 = Negative(Value=addition_17)
subtraction_10 = Subtraction(A=addition_15, B=multiplication_26)
subtraction_11 = Subtraction(A=multiplication_28, B=addition_14)
subtraction_12 = Subtraction(A=addition_15, B=multiplication_26)
subtraction_13 = Subtraction(A=addition_17, B=addition_14)
subtraction_14 = Subtraction(A=addition_15, B=addition_14)
subtraction_15 = Subtraction(A=addition_15, B=multiplication_26)
dom_2 = ConstructDomain(DomainStart=neg_13, DomainEnd=addition_15)
dom_3 = ConstructDomain(DomainStart=neg_14, DomainEnd=multiplication_28)
dom_4 = ConstructDomain(DomainStart=neg_15, DomainEnd=addition_15)
dom_5 = ConstructDomain(DomainStart=neg_16, DomainEnd=addition_17)
X_3 = UnitX(Factor=subtraction_11)
X_4 = UnitX(Factor=subtraction_13)
X_5 = UnitX(Factor=subtraction_14)
neg_17 = Negative(Value=addition_15)
move_25 = Move(Geometry=cir_2, Motion=X_3)  # -> Geometry, Transform
Y_8 = UnitY(Factor=subtraction_10)
move_26 = Move(Geometry=cir_2, Motion=X_4)  # -> Geometry, Transform
Y_9 = UnitY(Factor=subtraction_12)
move_27 = Move(Geometry=cir_2, Motion=X_5)  # -> Geometry, Transform
Y_10 = UnitY(Factor=subtraction_15)
dom_6 = ConstructDomain(DomainStart=neg_17, DomainEnd=addition_15)
rectangle = Rectangle(Plane=xy_7, XSize=dom_3, YSize=dom_2, Radius=0)  # -> Rectangle, Length
rectangle_2 = Rectangle(Plane=xy_7, XSize=dom_5, YSize=dom_4, Radius=0)  # -> Rectangle, Length
move_28 = Move(Geometry=move_25.Geometry, Motion=Y_8)  # -> Geometry, Transform
move_29 = Move(Geometry=move_26.Geometry, Motion=Y_9)  # -> Geometry, Transform
rectangle_3 = Rectangle(Plane=xy_7, XSize=dom_6, YSize=dom_6, Radius=0)  # -> Rectangle, Length
move_30 = Move(Geometry=move_27.Geometry, Motion=Y_10)  # -> Geometry, Transform
ccx = CurveCurve(CurveA=rectangle.Rectangle, CurveB=move_28.Geometry)  # -> Points, ParamsA, ParamsB
ccx_2 = CurveCurve(CurveA=rectangle_2.Rectangle, CurveB=move_29.Geometry)  # -> Points, ParamsA, ParamsB
ccx_3 = CurveCurve(CurveA=rectangle_3.Rectangle, CurveB=move_30.Geometry)  # -> Points, ParamsA, ParamsB
shatter_2 = Shatter(Curve=move_28.Geometry, Parameters=ccx.ParamsB)
shatter_3 = Shatter(Curve=move_29.Geometry, Parameters=ccx_2.ParamsB)
shatter_4 = Shatter(Curve=move_30.Geometry, Parameters=ccx_3.ParamsB)
item_8 = ListItem(List=shatter_2, Index=0, Wrap=True)  # -> Item, Item1
item_9 = ListItem(List=shatter_3, Index=0, Wrap=True)  # -> Item, Item1
item_10 = ListItem(List=shatter_4, Index=0, Wrap=True)  # -> Item, Item1
join_8 = JoinCurves(Curves=[item_8.Item, item_8.Item1], Preserve=False)
join_9 = JoinCurves(Curves=[item_9.Item, item_9.Item1], Preserve=False)
join_10 = JoinCurves(Curves=[item_10.Item, item_10.Item1], Preserve=False)
corner_curve = Curve(join_8)
corner_curve_2 = Curve(join_9)
corner_curve_3 = Curve(join_10)
yz_7 = YZPlane(Origin=Point(0, 0, 0))
xz_3 = XZPlane(Origin=Point(0, 0, 0))
yz_8 = YZPlane(Origin=Point(0, 0, 0))
xz_4 = XZPlane(Origin=Point(0, 0, 0))
yz_9 = YZPlane(Origin=Point(0, 0, 0))
xz_5 = XZPlane(Origin=Point(0, 0, 0))
mirror_3 = Mirror(Geometry=corner_curve, Plane=xz_3)  # -> Geometry, Transform
mirror_4 = Mirror(Geometry=corner_curve, Plane=yz_7)  # -> Geometry, Transform
mirror_5 = Mirror(Geometry=mirror_3.Geometry, Plane=yz_7)  # -> Geometry, Transform
mirror_6 = Mirror(Geometry=corner_curve_2, Plane=xz_4)  # -> Geometry, Transform
mirror_7 = Mirror(Geometry=corner_curve_2, Plane=yz_8)  # -> Geometry, Transform
mirror_8 = Mirror(Geometry=mirror_6.Geometry, Plane=yz_8)  # -> Geometry, Transform
mirror_9 = Mirror(Geometry=corner_curve_3, Plane=xz_5)  # -> Geometry, Transform
mirror_10 = Mirror(Geometry=corner_curve_3, Plane=yz_9)  # -> Geometry, Transform
mirror_11 = Mirror(Geometry=mirror_9.Geometry, Plane=yz_9)  # -> Geometry, Transform
end_13 = EndPoints(Curve=corner_curve)  # -> Start, End
end_14 = EndPoints(Curve=mirror_3.Geometry)  # -> Start, End
end_15 = EndPoints(Curve=corner_curve)  # -> Start, End
end_16 = EndPoints(Curve=mirror_4.Geometry)  # -> Start, End
end_17 = EndPoints(Curve=corner_curve_2)  # -> Start, End
end_18 = EndPoints(Curve=mirror_6.Geometry)  # -> Start, End
end_19 = EndPoints(Curve=corner_curve_2)  # -> Start, End
end_20 = EndPoints(Curve=mirror_7.Geometry)  # -> Start, End
end_21 = EndPoints(Curve=corner_curve_3)  # -> Start, End
end_22 = EndPoints(Curve=mirror_9.Geometry)  # -> Start, End
end_23 = EndPoints(Curve=corner_curve_3)  # -> Start, End
end_24 = EndPoints(Curve=mirror_10.Geometry)  # -> Start, End
yz_10 = YZPlane(Origin=Point(0, 0, 0))
xz_6 = XZPlane(Origin=Point(0, 0, 0))
ln_20 = Line(StartPoint=end_13.Start, EndPoint=end_14.Start)
ln_21 = Line(StartPoint=end_15.End, EndPoint=end_16.End)
yz_11 = YZPlane(Origin=Point(0, 0, 0))
xz_7 = XZPlane(Origin=Point(0, 0, 0))
ln_22 = Line(StartPoint=end_17.Start, EndPoint=end_18.Start)
ln_23 = Line(StartPoint=end_19.End, EndPoint=end_20.End)
yz_12 = YZPlane(Origin=Point(0, 0, 0))
xz_8 = XZPlane(Origin=Point(0, 0, 0))
ln_24 = Line(StartPoint=end_21.Start, EndPoint=end_22.Start)
ln_25 = Line(StartPoint=end_23.End, EndPoint=end_24.End)
mirror_12 = Mirror(Geometry=ln_20, Plane=yz_10)  # -> Geometry, Transform
mirror_13 = Mirror(Geometry=ln_21, Plane=xz_6)  # -> Geometry, Transform
mirror_14 = Mirror(Geometry=ln_22, Plane=yz_11)  # -> Geometry, Transform
mirror_15 = Mirror(Geometry=ln_23, Plane=xz_7)  # -> Geometry, Transform
mirror_16 = Mirror(Geometry=ln_24, Plane=yz_12)  # -> Geometry, Transform
mirror_17 = Mirror(Geometry=ln_25, Plane=xz_8)  # -> Geometry, Transform
merge_6 = Merge(
    Data1=corner_curve,
    Data2=mirror_3.Geometry,
    Data3=mirror_4.Geometry,
    Data4=mirror_5.Geometry,
    Data5=ln_20,
    Data6=mirror_12.Geometry,
    Data7=ln_21,
    Data8=mirror_13.Geometry)
merge_7 = Merge(
    Data1=corner_curve_2,
    Data2=mirror_6.Geometry,
    Data3=mirror_7.Geometry,
    Data4=mirror_8.Geometry,
    Data5=ln_22,
    Data6=mirror_14.Geometry,
    Data7=ln_23,
    Data8=mirror_15.Geometry)
merge_8 = Merge(
    Data1=corner_curve_3,
    Data2=mirror_9.Geometry,
    Data3=mirror_10.Geometry,
    Data4=mirror_11.Geometry,
    Data5=ln_24,
    Data6=mirror_16.Geometry,
    Data7=ln_25,
    Data8=mirror_17.Geometry)
join_11 = JoinCurves(Curves=merge_6, Preserve=False)
join_12 = JoinCurves(Curves=merge_7, Preserve=False)
join_13 = JoinCurves(Curves=merge_8, Preserve=False)
wedge_hole_lowest_layer = Curve(join_13)
wedge_hole_top_layer = Curve(join_11)
wedge_hole_mid_layers = Curve(join_12)

# ---- group: Make lower axis layer outline and brep
number_of_layers_beneath_rack_and_rail_l_2 = Panel(number_of_layers_beneath_rack_and_rail_l)  # "Number of layers beneath rack and rail layer"
rail_rack_and_pinion_material_thickness_6 = Panel(thickness_2)
main_material_thickness_7 = Panel(thickness)
actual_axis_length_2 = Panel(actual_axis_length)
rail_lowest_point_3 = Point(rail_lowest_point_2)
series = Series(Start=0, Step=main_material_thickness_7, Count=number_of_layers_beneath_rack_and_rail_l_2)
pdecon_6 = Deconstruct(Point=rail_lowest_point_3)  # -> XComponent, YComponent, ZComponent
neg_18 = Negative(Value=rail_rack_and_pinion_material_thickness_6)
xz_9 = XZPlane(Origin=Point(0, 0, 0))
neg_19 = Negative(Value=series)
pt_17 = ConstructPoint(XCoordinate=pdecon_6.XComponent, YCoordinate=pdecon_6.YComponent, ZCoordinate=neg_18)
Z_13 = UnitZ(Factor=neg_19)
mirror_18 = Mirror(Geometry=pt_17, Plane=xz_9)  # -> Geometry, Transform
X_6 = UnitX(Factor=actual_axis_length_2)
xy_8 = XYPlane(Origin=pt_17)
move_31 = Move(Geometry=mirror_18.Geometry, Motion=X_6)  # -> Geometry, Transform
neg_20 = Negative(Value=main_material_thickness_7)
rec_2pt = Rectangle2Pt(Plane=xy_8, PointA=pt_17, PointB=move_31.Geometry, Radius=0)  # -> Rectangle, Length
Z_14 = UnitZ(Factor=neg_20)
extr = Extrude(Base=rec_2pt.Rectangle, Direction=Z_14)
cap = CapHoles(Brep=extr)
move_32 = Move(Geometry=cap, Motion=Z_13)  # -> Geometry, Transform
lower_parts_corner_plane = Plane(xy_8)
axis_lower_layer_outline = Curve(rec_2pt.Rectangle)
axis_lower_layers_brep = Brep(move_32.Geometry)

# ---- group: Make axis top layer outline
extra_precut_with_offset_top_layer_2 = Panel(extra_precut_with_offset_top_layer)
axis_edge_3 = Curve(axis_edge)
Y_11 = UnitY(Factor=extra_precut_with_offset_top_layer_2)
move_33 = Move(Geometry=axis_edge_3, Motion=Y_11)  # -> Geometry, Transform
offset_axis_edge = Curve(move_33.Geometry)
xz_10 = XZPlane(Origin=Point(0, 0, 0))
rail_rack_and_pinion_material_thickness_7 = Panel(thickness_2)
mirror_19 = Mirror(Geometry=offset_axis_edge, Plane=xz_10)  # -> Geometry, Transform
end_25 = EndPoints(Curve=offset_axis_edge)  # -> Start, End
end_26 = EndPoints(Curve=mirror_19.Geometry)  # -> Start, End
ln_26 = Line(StartPoint=end_25.Start, EndPoint=end_26.Start)
ln_27 = Line(StartPoint=end_25.End, EndPoint=end_26.End)
neg_21 = Negative(Value=rail_rack_and_pinion_material_thickness_7)
join_14 = JoinCurves(Curves=[ln_26, ln_27, offset_axis_edge, mirror_19.Geometry], Preserve=False)
Z_15 = UnitZ(Factor=neg_21)
move_34 = Move(Geometry=join_14, Motion=Z_15)  # -> Geometry, Transform; disabled
axis_top_layer_outline = Curve(join_14)

# ---- group: Make axis top layer 3D model
actual_axis_length_3 = Panel(actual_axis_length)
pinion_pocket_depth_3 = Panel(pinion_pocket_depth_2)
rack_pocket_depth_5 = Panel(rack_pocket_depth_2)
pinion_pocket_2 = Curve(pinion_pocket)
rack_pocket_2 = Curve(rack_pocket)
rail_profile_2 = Curve(rail_profile)
xz_11 = XZPlane(Origin=Point(0, 0, 0))
neg_22 = Negative(Value=rack_pocket_depth_5)
neg_23 = Negative(Value=pinion_pocket_depth_3)
mirror_20 = Mirror(Geometry=rail_profile_2, Plane=xz_11)  # -> Geometry, Transform
Z_16 = UnitZ(Factor=neg_22)
Z_17 = UnitZ(Factor=neg_23)
end_27 = EndPoints(Curve=rail_profile_2)  # -> Start, End
end_28 = EndPoints(Curve=mirror_20.Geometry)  # -> Start, End
extr_2 = Extrude(Base=rack_pocket_2, Direction=Z_16)
extr_3 = Extrude(Base=pinion_pocket_2, Direction=Z_17)
cap_2 = CapHoles(Brep=extr_2)
cap_3 = CapHoles(Brep=extr_3)
ln_28 = Line(StartPoint=end_27.End, EndPoint=end_28.End)
ln_29 = Line(StartPoint=end_27.Start, EndPoint=end_28.Start)
join_15 = JoinCurves(Curves=[ln_29, ln_28, mirror_20.Geometry, rail_profile_2], Preserve=False)
X_7 = UnitX(Factor=actual_axis_length_3)
extr_4 = Extrude(Base=join_15, Direction=X_7)
cap_4 = CapHoles(Brep=extr_4)
sdiff = SolidDifference(BrepsA=cap_4, BrepsB=cap_3)
sdiff_2 = SolidDifference(BrepsA=sdiff, BrepsB=cap_2)
axis_top_layer_brep = Brep(sdiff_2)

# ---- group: Make inside holes for axis top layer
wedge_hole_top_layer_2 = Curve(wedge_hole_top_layer)
join_rails_with_dowels_instead_of_bolts_5 = Panel(join_rails_with_dowels_instead_of_bolts_3)
attachment_bolt_diameter_2 = Panel(attachment_bolt_diameter)
spacer_diameter_inc_margin_2 = Panel(spacer_diameter_inc_margin)
spacer_pocket_depth_2 = Panel(spacer_pocket_depth)
hole_planes_top_layer_2 = Plane(hole_planes_top_layer)
inside_axis_hold_down_holes_2 = Curve(inside_axis_hold_down_holes)
extra_cutout_depth_2 = Panel(extra_cutout_depth)
rail_rack_and_pinion_material_thickness_8 = Panel(thickness_2)
axis_top_layer_outline_2 = Curve(axis_top_layer_outline)
addition_18 = Addition(A=extra_cutout_depth_2, B=rail_rack_and_pinion_material_thickness_8)
xy_9 = XYPlane(Origin=Point(0, 0, 0))
multiplication_31 = Multiplication(A=attachment_bolt_diameter_2, B="0.5")
filter_8 = StreamFilter(Gate=join_rails_with_dowels_instead_of_bolts_5, Stream0=spacer_diameter_inc_margin_2)
cir_3 = Circle(Plane=xy_9, Radius=multiplication_31)
xy_10 = XYPlane(Origin=Point(0, 0, 0))
xy_11 = XYPlane(Origin=Point(0, 0, 0))
multiplication_32 = Multiplication(A=filter_8, B="0.5")
rotate_4 = Rotate(Geometry=xy_10, Angle=1.570796327, Plane=xy_10)  # -> Geometry, Transform
cir_4 = Circle(Plane=xy_11, Radius=multiplication_32)
filter_9 = StreamFilter(Gate=join_rails_with_dowels_instead_of_bolts_5, Stream0=cir_3, Stream1=wedge_hole_top_layer_2)
merge_9 = Merge(Data1=flatten(inside_axis_hold_down_holes_2), Data2=flatten(axis_top_layer_outline_2))
orient_5 = Orient(Geometry=cir_4, Source=rotate_4.Geometry, Target=hole_planes_top_layer_2)  # -> Geometry, Transform
orient_6 = Orient(Geometry=filter_9, Source=rotate_4.Geometry, Target=hole_planes_top_layer_2)  # -> Geometry, Transform
clean = CleanTree(RemoveNulls=True, RemoveInvalid=True, RemoveEmpty=False, Tree=orient_5.Geometry)
spacer_pocket_depth_3 = Panel(spacer_pocket_depth_2)
axis_top_layer_spacer_pocket = Curve(clean)
cut_depth_top_layer = Panel(addition_18)
axis_top_layer_inside_holes = Curve(orient_6.Geometry)
axis_top_layer_cutout = Curve(merge_9)

# ----
extra_cutout_depth_3 = Panel(extra_cutout_depth)
wedge_hole_mid_layers_2 = Curve(join_12)
number_of_layers_beneath_rack_and_rail_l_3 = Panel(number_of_layers_beneath_rack_and_rail_l)  # "Number of layers beneath rack and rail layer"
axis_lower_layer_outline_2 = Curve(axis_lower_layer_outline)
main_material_thickness_8 = Panel(thickness)
xy_12 = XYPlane(Origin=Point(0, 0, 0))
project = Project(Geometry=axis_lower_layer_outline_2, Plane=xy_12)  # -> Geometry, Transform
xy_13 = XYPlane(Origin=Point(0, 0, 0))
addition_19 = Addition(A=extra_cutout_depth_3, B=main_material_thickness_8)
smaller_3 = SmallerThan(FirstNumber=number_of_layers_beneath_rack_and_rail_l_3, SecondNumber="2")  # -> SmallerThan, OrEqualTo
rotate_5 = Rotate(Geometry=xy_13, Angle=1.570796327, Plane=xy_13)  # -> Geometry, Transform
cut_depth_main_layers = Panel(addition_19)
filter_10 = StreamFilter(Gate=join_rails_with_dowels_instead_of_bolts_5, Stream0=cir_3, Stream1=wedge_hole_mid_layers_2)
inside_axis_hold_down_holes_3 = Curve(inside_axis_hold_down_holes_2)
subtraction_16 = Subtraction(A=number_of_layers_beneath_rack_and_rail_l_3, B="1")
orient_7 = Orient(Geometry=filter_10, Source=rotate_5.Geometry, Target=hole_planes_top_layer_2)  # -> Geometry, Transform
merge_10 = Merge(Data1=flatten(orient_7.Geometry), Data2=flatten(inside_axis_hold_down_holes_3))
filter_11 = StreamFilter(Gate=smaller_3.SmallerThan, Stream0=merge_10)
filter_12 = StreamFilter(Gate=smaller_3.SmallerThan, Stream0=project.Geometry)
number_of_mid_layers = Panel(subtraction_16)
axis_mid_layers_inside_holes = Curve(filter_11)
cut_depth_mid_layer = Panel(cut_depth_main_layers)
axis_mid_layer_outline = Curve(filter_12)

wedge_hole_lowest_layer_2 = Curve(join_13)
axis_lower_layer_outline_3 = Curve(axis_lower_layer_outline)
hold_down_area_width = Panel("20")
main_material_bit_4 = Panel(diameter_4)
hold_down_hole_2 = Curve(hold_down_hole)
tab_box_2 = Brep(tab_box)
nut_pocket_depth_4 = Panel(nut_pocket_depth_3)
nut_pocket_2 = Curve(nut_pocket)
xy_14 = XYPlane(Origin=Point(0, 0, 0))
multiplication_33 = Multiplication(A=hold_down_area_width, B="0.5")
project_2 = Project(Geometry=axis_lower_layer_outline_3, Plane=xy_14)  # -> Geometry, Transform
addition_20 = Addition(A=main_material_bit_4, B=hold_down_area_width)
xy_15 = XYPlane(Origin=Point(0, 0, 0))
addition_21 = Addition(A=main_material_bit_4, B=multiplication_33)
neg_24 = Negative(Value=addition_21)
explode = Explode(Curve=project_2.Geometry, Recursive=True)  # -> Segments, Vertices
item_11 = ListItem(List=explode.Segments, Index=0, Wrap=True)  # -> Item, Item1, Item2, Item3
rotate_6 = Rotate(Geometry=xy_15, Angle=1.570796327, Plane=xy_15)  # -> Geometry, Transform
X_8 = UnitX(Factor=addition_21)
X_9 = UnitX(Factor=neg_24)
neg_25 = Negative(Value=addition_20)
filter_13 = StreamFilter(Gate=join_rails_with_dowels_instead_of_bolts_5, Stream0=cir_3, Stream1=wedge_hole_lowest_layer_2)
item_12 = ListItem(List=explode.Vertices, Index=0, Wrap=True)  # -> Item, Item1, Item2
X_10 = UnitX(Factor=addition_20)
X_11 = UnitX(Factor=neg_25)
move_35 = Move(Geometry=item_11.Item3, Motion=X_9)  # -> Geometry, Transform
move_36 = Move(Geometry=item_11.Item1, Motion=X_8)  # -> Geometry, Transform
filter_14 = StreamFilter(Gate=join_rails_with_dowels_instead_of_bolts_5, Stream0=nut_pocket_2)
orient_8 = Orient(Geometry=filter_13, Source=rotate_6.Geometry, Target=hole_planes_top_layer_2)  # -> Geometry, Transform
toggle = BooleanToggle(False)
move_37 = Move(Geometry=item_12.Item2, Motion=X_10)  # -> Geometry, Transform
move_38 = Move(Geometry=item_12.Item, Motion=X_11)  # -> Geometry, Transform
xy_16 = XYPlane(Origin=Point(0, 0, 0))
orient_9 = Orient(Geometry=filter_14, Source=rotate_6.Geometry, Target=hole_planes_top_layer_2)  # -> Geometry, Transform
rec_2pt_2 = Rectangle2Pt(Plane=xy_16, PointA=move_38.Geometry, PointB=move_37.Geometry, Radius=0)  # -> Rectangle, Length
eval_6 = EvaluateLength(Curve=[move_35.Geometry, move_36.Geometry], Length=multiplication_33, Normalized=toggle)  # -> Point, Tangent, Parameter
eval_7 = EvaluateLength(Curve=[item_11.Item1, item_11.Item3], Length=multiplication_33, Normalized=toggle)  # -> Point, Tangent, Parameter
clean_2 = CleanTree(RemoveNulls=True, RemoveInvalid=True, RemoveEmpty=False, Tree=orient_9.Geometry)
xz_12 = XZPlane(Origin=Point(0, 0, 0))
inside_axis_hold_down_holes_4 = Curve(inside_axis_hold_down_holes_2)
mirror_21 = Mirror(Geometry=eval_6.Point, Plane=xz_12)  # -> Geometry, Transform
mirror_22 = Mirror(Geometry=eval_7.Point, Plane=xz_12)  # -> Geometry, Transform
cut_depth_mid_layer_2 = Panel(cut_depth_main_layers)
weave = Weave(Pattern=[0, 1], Stream0=eval_6.Point, Stream1=mirror_21.Geometry, NullGaps=False)
weave_2 = Weave(Pattern=[0, 1], Stream0=eval_7.Point, Stream1=mirror_22.Geometry, NullGaps=False)
xy_17 = XYPlane(Origin=weave)
xy_18 = XYPlane(Origin=weave_2)
pt_18 = ConstructPoint(XCoordinate=0, YCoordinate=0, ZCoordinate=cut_depth_mid_layer_2)
outer_hold_down_planes = Plane(xy_17)
hold_down_hole_3 = Curve(hold_down_hole_2)
tab_planes = Plane(xy_18)
filter_15 = StreamFilter(Gate=0, Stream0=project_2.Geometry)
xy_19 = XYPlane(Origin=Point(0, 0, 0))
xy_20 = XYPlane(Origin=pt_18)
tab_box_3 = Brep(tab_box_2)
axis_mid_layer_outside_tabs_outline = Curve(rec_2pt_2.Rectangle)
orient_10 = Orient(Geometry=hold_down_hole_3, Source=xy_19, Target=outer_hold_down_planes)  # -> Geometry, Transform
lower_layer_outside_hold_down_holes = Curve(orient_10.Geometry)
merge_11 = Merge(
    Data1=flatten(orient_8.Geometry),
    Data2=flatten(inside_axis_hold_down_holes_4),
    Data3=flatten(lower_layer_outside_hold_down_holes))
filter_16 = StreamFilter(Gate=0, Stream0=merge_11)
orient_11 = Orient(Geometry=tab_box_3, Source=xy_20, Target=tab_planes)  # -> Geometry, Transform
axis_mid_layers_inside_holes_2 = Curve(filter_16)
nut_pocket_depth_5 = Panel(nut_pocket_depth_4)
axis_mid_layer_outline_2 = Curve(filter_15)
axis_lower_layer_tabs = Brep(orient_11.Geometry)
nut_pockets = Curve(clean_2)

axis_edge_4 = Curve(axis_edge)
v_rail_edge_cleanup_depth_2 = Panel(v_rail_edge_cleanup_depth)
extra_cutout_depth_4 = Panel(extra_cutout_depth)
addition_22 = Addition(A=v_rail_edge_cleanup_depth_2, B=extra_cutout_depth_4)
neg_26 = Negative(Value=addition_22)
Z_18 = UnitZ(Factor=neg_26)
move_39 = Move(Geometry=axis_edge_4, Motion=Z_18)  # -> Geometry, Transform
Y_12 = UnitY(Factor=multiplication_9)
move_40 = Move(Geometry=move_39.Geometry, Motion=Y_12)  # -> Geometry, Transform
ext_5 = ExtendCurve(Curve=move_40.Geometry, Type=0, Start=rack_teeth_bit_diameter_2, End=rack_teeth_bit_diameter_2)
redpline = Reduce(Polyline=ext_5, Tolerance=1)  # -> Polyline, Reduction
xz_13 = XZPlane(Origin=Point(0, 0, 0))
mirror_23 = Mirror(Geometry=redpline.Polyline, Plane=xz_13)  # -> Geometry, Transform
flip_5 = FlipCurve(Curve=mirror_23.Geometry)  # -> Curve, Flag
merge_12 = Merge(Data1=flip_5.Curve, Data2=redpline.Polyline)
v_reail_edge_cleanup_toolpath = Curve(merge_12)

# ---- group: Select registration holes
lower_layer_outside_hold_down_holes_2 = Curve(lower_layer_outside_hold_down_holes)
cut_registration_geometry_identifer = Panel("5")
current_action_2 = Panel(list_4)
panel_3 = Panel("""0
2""")
equals_2 = Equality(FirstNumber=cut_registration_geometry_identifer, SecondNumber=current_action_2)  # -> Equality, Inequality
item_13 = ListItem(List=lower_layer_outside_hold_down_holes_2, Index=panel_3, Wrap=True)
filter_17 = StreamFilter(Gate=equals_2.Equality, Stream1=item_13)
axis_assembly_registration_holes = Curve(filter_17)

# ---- group: Pre cut lower layer
axis_mid_layer_outside_tabs_outline_2 = Curve(axis_mid_layer_outside_tabs_outline)
axis_lower_layers_inside_holes = Curve(axis_mid_layers_inside_holes_2)
# Make dowels
cut_depth_mid_layer_3 = Panel(cut_depth_main_layers)
axis_lower_layer_outline_4 = Curve(axis_mid_layer_outline_2)
axis_lower_layer_tabs_2 = Brep(axis_lower_layer_tabs)

# ---- group: Pre cut mid layers
number_of_mid_layers_2 = Panel(number_of_mid_layers)
axis_mid_layers_inside_holes_3 = Curve(axis_mid_layers_inside_holes)
cut_depth_mid_layer_4 = Panel(cut_depth_mid_layer)
axis_mid_layer_outline_3 = Curve(axis_mid_layer_outline)

# ---- group: Precut top axis layer
spacer_pocket_depth_4 = Panel(spacer_pocket_depth_3)
axis_top_layer_inside_holes_2 = Curve(axis_top_layer_inside_holes)
cut_depth_top_layer_2 = Panel(cut_depth_top_layer)
pinion_pocket_depth_4 = Panel(pinion_pocket_depth_2)
rack_pocket_depth_6 = Panel(rack_pocket_depth_2)
axis_top_layer_cutout_2 = Curve(axis_top_layer_cutout)
pinion_pocket_3 = Curve(pinion_pocket)
spacer_pockets = Curve(axis_top_layer_spacer_pocket)
rack_pocket_3 = Curve(rack_pocket)

# ----
nut_pocket_depth_6 = Panel(nut_pocket_depth_5)

# ---- group: Rack cut and edge cleanup
v_reail_edge_cleanup_toolpath_2 = Curve(v_reail_edge_cleanup_toolpath)
rack_cut_depth_2 = Panel(rack_cut_depth)
rack_finish_mill_2 = Curve(rack_finish_mill)
rack_premill1_2 = Curve(rack_premill1)
rack_premill2_2 = Curve(rack_premill2)

# ---- group: Assembly registration holes - inside cut
registration_hole_depth_2 = Panel(registration_hole_depth)
axis_assembly_registration_holes_2 = Curve(axis_assembly_registration_holes)

# ----
nut_pockets_2 = Curve(nut_pockets)

# ---- group: Make V bearing geometry
grove_depth_bearing_2 = Panel(grove_depth_bearing)
safety_reduction = Panel("0.5")
make_at_least_one_z_axis = Panel(or)
make_z_axis_side2_3 = Panel(make_z_axis_side2_2)
motorize_z_axis_side1_4 = Panel(motorize_z_axis_side1_2)
motorize_z_axis_side1_5 = Panel(motorize_z_axis_side1_3)
bearing_bolt_placement_margin_2 = Panel(bearing_bolt_placement_margin)
make_z_axis_side1_3 = Panel(make_z_axis_side1_2)
main_material_thickness_9 = Panel(thickness)
v_bearing_outer_point_2 = Point(v_bearing_outer_point)
subtraction_17 = Subtraction(A=main_material_thickness_9, B=safety_reduction)
multiplication_34 = Multiplication(A=bearing_bolt_placement_margin_2, B="0.5")
v_bearing_outer_point_3 = Point(v_bearing_outer_point_2)
make_at_least_one_z_axis_2 = Panel(make_at_least_one_z_axis)
grove_depth_bearing_3 = Panel(grove_depth_bearing_2)
xy_21 = XYPlane(Origin=Point(0, 0, 0))
xz_14 = XZPlane(Origin=Point(0, 0, 0))
project_3 = Project(Geometry=v_bearing_outer_point_3, Plane=xy_21)  # -> Geometry, Transform
xy_22 = XYPlane(Origin=Point(0, 0, 0))
addition_23 = Addition(A=grove_depth_bearing_3, B=safety_reduction)
addition_24 = Addition(A=subtraction_17, B=multiplication_34)
indent_depth = Panel(addition_23)
indent_depth_2 = Panel(addition_24)
neg_27 = Negative(Value=indent_depth)
Y_13 = UnitY(Factor=neg_27)
yz_13 = YZPlane(Origin=Point(0, 0, 0))
X_12 = UnitX(Factor=neg_27)
yz_14 = YZPlane(Origin=Point(0, 0, 0))
xy_23 = XYPlane(Origin=Point(0, 0, 0))
make_z_axis_side1_4 = Panel(make_z_axis_side1_3)
make_z_axis_side2_4 = Panel(make_z_axis_side2_3)
xz_15 = XZPlane(Origin=Point(0, 0, 0))
make_at_least_one_z_axis_3 = Panel(make_at_least_one_z_axis)

# ----
indent_depth_3 = Panel(subtraction_17)
Y_14 = UnitY(Factor=indent_depth_2)

# ---- group: Make carriage plate geometry
axis_width_5 = Panel(axis_width_4)
rail_flat_mid_section_heigth_4 = Panel(rail_flat_mid_section_heigth)
carriage_lenght_5 = Panel(carriage_lenght_4)
make_motor_mount_holes_millable_with_mai_2 = Panel(make_motor_mount_holes_millable_with_mai)  # "Make motor mount holes millable with main milling bit"
motor_mount_hole_spacing_2 = Panel(motor_mount_hole_spacing)
motor_mount_hole_diameter_2 = Panel(motor_mount_hole_diameter)
shaft_opening_diameter_2 = Panel(shaft_opening_diameter)
main_material_bit_5 = Panel(diameter_4)
motor_mount_placement_margin_2 = Panel(motor_mount_placement_margin)
v_slide_backside_width_ratio = Panel("1.3")
bearing_bolt_placement_margin_3 = Panel(bearing_bolt_placement_margin)
bearing_bolt_hole_diameter_2 = Panel(bearing_bolt_hole_diameter)
inner_v_rail_edge_to_bolt_center_distanc_2 = Panel(inner_v_rail_edge_to_bolt_center_distanc)  # "Inner v rail edge to bolt center distance"
main_material_thickness_10 = Panel(thickness)
corner_radius_2 = Panel(carriage_plate_corner_radius)
smaller_4 = SmallerThan(FirstNumber=motor_mount_hole_diameter_2, SecondNumber=main_material_bit_5)  # -> SmallerThan, OrEqualTo
multiplication_35 = Multiplication(A=inner_v_rail_edge_to_bolt_center_distanc_2, B=v_slide_backside_width_ratio)
multiplication_36 = Multiplication(A=carriage_lenght_5, B="0.5")
addition_25 = Addition(A=axis_width_5, B=rail_flat_mid_section_heigth_4)
multiplication_37 = Multiplication(A=main_material_bit_5, B="1.02")
addition_26 = Addition(A=inner_v_rail_edge_to_bolt_center_distanc_2, B=multiplication_35)
and = GateAnd(A=make_motor_mount_holes_millable_with_mai_2, B=smaller_4.SmallerThan)
multiplication_38 = Multiplication(A=addition_25, B="0.5")
distance_from_rail_edge_to_slide_edge = Panel(addition_26)
distance_from_rail_edge_to_slide_edge_2 = Panel(distance_from_rail_edge_to_slide_edge)
distance_to_rail_edge = Panel(multiplication_38)
addition_27 = Addition(A=inner_v_rail_edge_to_bolt_center_distanc_2, B=multiplication_35)
multiplication_39 = Multiplication(A=main_material_thickness_10, B="0.5")
inner_v_rail_edge_to_bolt_center_distanc_3 = Panel(inner_v_rail_edge_to_bolt_center_distanc)  # "Inner v rail edge to bolt center distance"
distance_to_rail_edge_2 = Panel(multiplication_38)
addition_28 = Addition(A=distance_to_rail_edge, B=distance_from_rail_edge_to_slide_edge_2)
motor_mount_hole_spacing_3 = Panel(motor_mount_hole_spacing_2)
neg_28 = Negative(Value=addition_28)
neg_29 = Negative(Value=multiplication_36)
filter_18 = StreamFilter(Gate=and, Stream0=motor_mount_hole_diameter_2, Stream1=multiplication_37)
addition_29 = Addition(A=multiplication_39, B=main_material_thickness_10)
subtraction_18 = Subtraction(A=multiplication_36, B=multiplication_39)
multiplication_40 = Multiplication(A=addition_27, B="0.5")
multiplication_41 = Multiplication(A=carriage_lenght_5, B="0.5")
pt_19 = ConstructPoint(XCoordinate=multiplication_36, YCoordinate=addition_28, ZCoordinate=0)
subtraction_19 = Subtraction(A=distance_to_rail_edge, B=addition_29)
pt_20 = ConstructPoint(XCoordinate=neg_29, YCoordinate=neg_28, ZCoordinate=0)
edge_off_support_wall = Panel(subtraction_18)
addition_30 = Addition(A=distance_to_rail_edge_2, B=inner_v_rail_edge_to_bolt_center_distanc_3)
subtraction_20 = Subtraction(A=multiplication_41, B=multiplication_40)
multiplication_42 = Multiplication(A=motor_mount_hole_spacing_3, B="0.5")
shaft_opening_diameter_3 = Panel(shaft_opening_diameter_2)
xy_24 = XYPlane(Origin=Point(0, 0, 0))
motor_mount_placement_margin_3 = Panel(motor_mount_placement_margin_2)
motor_mount_hole_diameter_3 = Panel(filter_18)
bolt_placement_margin = Panel(bearing_bolt_placement_margin_3)
bearing_bolt_hole_diameter_3 = Panel(bearing_bolt_hole_diameter_2)
pt_21 = ConstructPoint(XCoordinate=subtraction_20, YCoordinate=addition_30, ZCoordinate=0)
neg_30 = Negative(Value=subtraction_19)
pt_22 = ConstructPoint(XCoordinate=multiplication_42, YCoordinate=multiplication_42, ZCoordinate=0)
neg_31 = Negative(Value=edge_off_support_wall)
rec_2pt_3 = Rectangle2Pt(Plane=xy_24, PointA=pt_19, PointB=pt_20, Radius=corner_radius_2)  # -> Rectangle, Length
make_at_least_one_z_axis_4 = Panel(make_at_least_one_z_axis)
xy_25 = XYPlane(Origin=pt_21)
xz_16 = XZPlane(Origin=Point(0, 0, 0))
xz_17 = XZPlane(Origin=pt_21)
xy_26 = XYPlane(Origin=pt_22)
xz_18 = XZPlane(Origin=pt_22)
pt_23 = ConstructPoint(XCoordinate=neg_31, YCoordinate=neg_30, ZCoordinate=0)
multiplication_43 = Multiplication(A=shaft_opening_diameter_3, B="0.5")
xy_27 = XYPlane(Origin=Point(0, 0, 0))
multiplication_44 = Multiplication(A=bolt_placement_margin, B="0.5")
multiplication_45 = Multiplication(A=bearing_bolt_hole_diameter_3, B="0.5")
multiplication_46 = Multiplication(A=motor_mount_placement_margin_3, B="0.5")
multiplication_47 = Multiplication(A=motor_mount_hole_diameter_3, B="0.5")
filter_19 = StreamFilter(Gate=make_at_least_one_z_axis_4, Stream1=pt_23)
arc = Arc(Plane=xy_25, Radius=multiplication_45, Angle=Domain(0, 3.141592654))  # -> Arc, Length
arc_2 = Arc(Plane=xy_27, Radius=multiplication_43, Angle=Domain(0, 3.141592654))  # -> Arc, Length
arc_3 = Arc(Plane=xy_26, Radius=multiplication_47, Angle=Domain(0, 3.141592654))  # -> Arc, Length
Y_15 = UnitY(Factor=multiplication_44)
Y_16 = UnitY(Factor=multiplication_46)
xy_28 = XYPlane(Origin=filter_19)
move_41 = Move(Geometry=arc.Arc, Motion=Y_15)  # -> Geometry, Transform
move_42 = Move(Geometry=arc_2.Arc, Motion=Y_16)  # -> Geometry, Transform
move_43 = Move(Geometry=arc_3.Arc, Motion=Y_16)  # -> Geometry, Transform
xz_19 = XZPlane(Origin=Point(0, 0, 0))
rectangle_4 = Rectangle(Plane=xy_28, XSize=main_material_thickness_10, YSize=main_material_thickness_10, Radius=0)  # -> Rectangle, Length
yz_15 = YZPlane(Origin=Point(0, 0, 0))
mirror_24 = Mirror(Geometry=move_41.Geometry, Plane=xz_17)  # -> Geometry, Transform
mirror_25 = Mirror(Geometry=move_42.Geometry, Plane=xz_19)  # -> Geometry, Transform
mirror_26 = Mirror(Geometry=move_43.Geometry, Plane=xz_18)  # -> Geometry, Transform
mirror_27 = Mirror(Geometry=rectangle_4.Rectangle, Plane=yz_15)  # -> Geometry, Transform
end_29 = EndPoints(Curve=mirror_24.Geometry)  # -> Start, End
end_30 = EndPoints(Curve=move_41.Geometry)  # -> Start, End
end_31 = EndPoints(Curve=mirror_25.Geometry)  # -> Start, End
end_32 = EndPoints(Curve=mirror_26.Geometry)  # -> Start, End
end_33 = EndPoints(Curve=move_42.Geometry)  # -> Start, End
end_34 = EndPoints(Curve=move_43.Geometry)  # -> Start, End
make_z_axis_side1_5 = Panel(make_z_axis_side1_3)
make_z_axis_side2_5 = Panel(make_z_axis_side2_3)
mirror_28 = Mirror(Geometry=[mirror_27.Geometry, rectangle_4.Rectangle], Plane=xz_16)  # -> Geometry, Transform
carriage_outline = Curve(rec_2pt_3.Rectangle)
ln_30 = Line(StartPoint=end_29.Start, EndPoint=end_30.Start)
ln_31 = Line(StartPoint=end_29.End, EndPoint=end_30.End)
ln_32 = Line(StartPoint=end_31.Start, EndPoint=end_33.Start)
ln_33 = Line(StartPoint=end_31.End, EndPoint=end_33.End)
ln_34 = Line(StartPoint=end_32.Start, EndPoint=end_34.Start)
ln_35 = Line(StartPoint=end_32.End, EndPoint=end_34.End)
make_at_least_one_z_axis_5 = Panel(make_at_least_one_z_axis)
merge_13 = Merge(Data1=ln_30, Data2=ln_31, Data3=mirror_24.Geometry, Data4=move_41.Geometry)
merge_14 = Merge(Data1=ln_32, Data2=ln_33, Data3=mirror_25.Geometry, Data4=move_42.Geometry)
merge_15 = Merge(Data1=ln_34, Data2=ln_35, Data3=mirror_26.Geometry, Data4=move_43.Geometry)
join_16 = JoinCurves(Curves=merge_13, Preserve=False)
yz_16 = YZPlane(Origin=Point(0, 0, 0))
join_17 = JoinCurves(Curves=merge_14, Preserve=False)
join_18 = JoinCurves(Curves=merge_15, Preserve=False)
yz_17 = YZPlane(Origin=Point(0, 0, 0))
filter_20 = StreamFilter(Gate=make_z_axis_side1_5, Stream1=[rectangle_4.Rectangle, mirror_27.Geometry])
filter_21 = StreamFilter(Gate=make_z_axis_side2_5, Stream1=mirror_28.Geometry)
mirror_29 = Mirror(Geometry=join_16, Plane=yz_16)  # -> Geometry, Transform
mirror_30 = Mirror(Geometry=join_18, Plane=yz_17)  # -> Geometry, Transform
xz_20 = XZPlane(Origin=Point(0, 0, 0))
merge_16 = Merge(Data1=filter_20, Data2=filter_21)
xz_21 = XZPlane(Origin=Point(0, 0, 0))
mirror_31 = Mirror(Geometry=[mirror_29.Geometry, join_16], Plane=xz_20)  # -> Geometry, Transform
mirror_32 = Mirror(Geometry=[mirror_30.Geometry, join_18], Plane=xz_21)  # -> Geometry, Transform
z_support_wall_holes = Curve(merge_16)
motor_mount_holes = Curve(join_17)
motor_mount_holes_2 = Curve([mirror_32.Geometry, mirror_30.Geometry, join_18])
# Make nut pocket?
# Or pocket on underside of y axis?
bolt_holes = Curve([mirror_31.Geometry, mirror_29.Geometry, join_16])

# ----
z_support_wall_holes_2 = Curve(z_support_wall_holes)
motor_mount_holes_3 = Curve(motor_mount_holes_2)
motor_mount_holes_4 = Curve(motor_mount_holes)
bolt_holes_2 = Curve(bolt_holes)

# ---- group: Make V bearing geometry (continued)
pt_24 = Point(pt_19)
inner_v_rail_edge_to_bolt_center_distanc_4 = Panel(inner_v_rail_edge_to_bolt_center_distanc_2)  # "Inner v rail edge to bolt center distance"
panel_4 = Panel(multiplication_40)
mirror_33 = Mirror(Geometry=pt_24, Plane=xz_14)  # -> Geometry, Transform
corner_radius_3 = Panel(corner_radius_2)
panel_5 = Panel(panel_4)
multiplication_48 = Multiplication(A=inner_v_rail_edge_to_bolt_center_distanc_4, B="2")
rec_2pt_4 = Rectangle2Pt(Plane=xy_22, PointA=project_3.Geometry, PointB=mirror_33.Geometry, Radius=0)  # -> Rectangle, Length
rec_2pt_5 = Rectangle2Pt(Plane=xy_22, PointA=project_3.Geometry, PointB=mirror_33.Geometry, Radius=corner_radius_3)  # -> Rectangle, Length
slide_outline = Curve(rec_2pt_4.Rectangle)
filter_22 = StreamFilter(Gate=make_at_least_one_z_axis_2, Stream1=rec_2pt_4.Rectangle)
addition_31 = Addition(A=panel_5, B=multiplication_48)
multiplication_49 = Multiplication(A=panel_5, B="2")
explode_2 = Explode(Curve=filter_22, Recursive=True)  # -> Segments, Vertices
explode_3 = Explode(Curve=slide_outline, Recursive=True)  # -> Segments, Vertices
distance_from_edge_to_rail_indent_start = Panel(multiplication_49)
distance_from_edge_to_indent_start = Panel(addition_31)
item_14 = ListItem(List=explode_3.Segments, Index="2", Wrap=True)
item_15 = ListItem(List=explode_2.Segments, Index=0, Wrap=True)
eval_8 = EvaluateLength(Curve=item_14, Length=distance_from_edge_to_rail_indent_start, Normalized=Toggle(False))  # -> Point, Tangent, Parameter
eval_9 = EvaluateLength(Curve=item_15, Length=distance_from_edge_to_indent_start, Normalized=Toggle(False))  # -> Point, Tangent, Parameter
Y_17 = UnitY(Factor=indent_depth_3)
move_44 = Move(Geometry=eval_8.Point, Motion=Y_13)  # -> Geometry, Transform
move_45 = Move(Geometry=eval_9.Point, Motion=Y_17)  # -> Geometry, Transform
move_46 = Move(Geometry=move_44.Geometry, Motion=X_12)  # -> Geometry, Transform
mirror_34 = Mirror(Geometry=move_45.Geometry, Plane=yz_14)  # -> Geometry, Transform
merge_17 = Merge(Data1=eval_8.Point, Data2=move_46.Geometry)
rec_2pt_6 = Rectangle2Pt(Plane=xy_23, PointA=eval_9.Point, PointB=mirror_34.Geometry, Radius=0)  # -> Rectangle, Length
mirror_35 = Mirror(Geometry=merge_17, Plane=yz_13)  # -> Geometry, Transform
rev = ReverseList(List=merge_17)
mirror_36 = Mirror(Geometry=rec_2pt_6.Rectangle, Plane=xz_15)  # -> Geometry, Transform
pline = PolyLine(Vertices=[rev, mirror_35.Geometry], Closed=True)
filter_23 = StreamFilter(Gate=make_z_axis_side1_4, Stream1=rec_2pt_6.Rectangle)
filter_24 = StreamFilter(Gate=make_z_axis_side2_4, Stream1=mirror_36.Geometry)
slide_outline_with_radius = Curve(rec_2pt_5.Rectangle)
slide_indent = Curve(pline)
merge_18 = Merge(Data1=filter_23, Data2=filter_24)
rdiff = RegionDifference(CurvesA=slide_outline_with_radius, CurvesB=slide_indent)
axis_cutouts = Curve(merge_18)
bolt_holes_slide = Curve(mirror_31.Geometry)

# ----
subtraction_21 = Subtraction(A=addition_31, B=safety_reduction)
distance_from_edge_to_indent_start_2 = Panel(subtraction_21)
eval_10 = EvaluateLength(Curve=item_15, Length=distance_from_edge_to_indent_start_2, Normalized=Toggle(False))  # -> Point, Tangent, Parameter
move_47 = Move(Geometry=eval_10.Point, Motion=Y_14)  # -> Geometry, Transform
mirror_37 = Mirror(Geometry=move_47.Geometry, Plane=yz_2)  # -> Geometry, Transform
rec_2pt_7 = Rectangle2Pt(Plane=xy_2, PointA=eval_10.Point, PointB=mirror_37.Geometry, Radius=0)  # -> Rectangle, Length

# ---- group: Make carriage plate geometry (continued)
axis_cutouts_2 = Curve(axis_cutouts)
rdiff_2 = RegionDifference(CurvesA=carriage_outline, CurvesB=axis_cutouts_2)
filter_25 = StreamFilter(Gate=make_at_least_one_z_axis_5, Stream0=carriage_outline, Stream1=rdiff_2)
carriage_outline_2 = Curve(filter_25)

# ---- group: Make V bearing geometry (continued)
rdiff_3 = RegionDifference(CurvesA=rdiff, CurvesB=rec_2pt_7.Rectangle)
filter_26 = StreamFilter(Gate=make_at_least_one_z_axis_3, Stream0=rdiff, Stream1=rdiff_3)
slide_outline_with_radius_2 = Curve(filter_26)

# ---- group: Make V bearing preview brep
bolt_holes_slide_2 = Curve(bolt_holes_slide)
slide_outline_with_radius_3 = Curve(slide_outline_with_radius_2)
rail_rack_and_pinion_material_thickness_9 = Panel(rail_rack_and_pinion_material_thickness)
v_bearing_profile_2 = Curve(v_bearing_profile)
axis_width_6 = Panel(axis_width_4)
rail_to_carriage_safety_distance_5 = Panel(rail_to_carriage_safety_distance)
merge_19 = Merge(Data1=flatten(bolt_holes_slide_2), Data2=flatten(slide_outline_with_radius_3))
end_35 = EndPoints(Curve=v_bearing_profile_2)  # -> Start, End
addition_32 = Addition(A=axis_width_6, B="2")
neg_32 = Negative(Value=rail_rack_and_pinion_material_thickness_9)
Z_19 = UnitZ(Factor=rail_to_carriage_safety_distance_5)
xz_22 = XZPlane(Origin=end_35.Start)
slide_curves = Curve(merge_19)
X_13 = UnitX(Factor=addition_32)
mirror_38 = Mirror(Geometry=v_bearing_profile_2, Plane=xz_22)  # -> Geometry, Transform
Z_20 = UnitZ(Factor=neg_32)
extr_5 = Extrude(Base=flatten(slide_curves), Direction=Z_20)
boundary = BoundarySurfaces(Edges=slide_curves)
join_19 = JoinCurves(Curves=[v_bearing_profile_2, mirror_38.Geometry], Preserve=False)
extr_6 = Extrude(Base=join_19, Direction=X_13)
move_48 = Move(Geometry=boundary, Motion=Z_20)  # -> Geometry, Transform
neg_33 = Negative(Value="1")
cap_5 = CapHoles(Brep=extr_6)
join_20 = BrepJoin(Breps=[move_48.Geometry, boundary, extr_5])  # -> Breps, Closed
X_14 = UnitX(Factor=neg_33)
move_49 = Move(Geometry=cap_5, Motion=X_14)  # -> Geometry, Transform
move_50 = Move(Geometry=join_20.Breps, Motion=Z_19)  # -> Geometry, Transform
sdiff_3 = SolidDifference(BrepsA=move_50.Geometry, BrepsB=move_49.Geometry)
xz_23 = XZPlane(Origin=Point(0, 0, 0))
mirror_39 = Mirror(Geometry=sdiff_3, Plane=xz_23)  # -> Geometry, Transform
v_bearing_brep = Brep([sdiff_3, mirror_39.Geometry])

# ----
slide_outline_with_radius_4 = Curve(slide_outline_with_radius_2)

# ---- group: Make carriage plate preview brep
rail_to_carriage_safety_distance_6 = Panel(rail_to_carriage_safety_distance)
motor_mount_holes_5 = Curve(motor_mount_holes_2)
main_material_thickness_11 = Panel(thickness)
z_support_wall_holes_3 = Curve(z_support_wall_holes)
motor_mount_holes_6 = Curve(motor_mount_holes)
carriage_outline_3 = Curve(carriage_outline_2)
bolt_holes_3 = Curve(bolt_holes)
merge_20 = Merge(
    Data1=flatten(carriage_outline_3),
    Data2=flatten(bolt_holes_3),
    Data3=flatten(motor_mount_holes_5),
    Data4=flatten(motor_mount_holes_6),
    Data5=flatten(z_support_wall_holes_3))
carriage_curves = Curve(merge_20)
Z_21 = UnitZ(Factor=rail_to_carriage_safety_distance_6)
Z_22 = UnitZ(Factor=main_material_thickness_11)
extr_7 = Extrude(Base=flatten(carriage_curves), Direction=Z_22)
boundary_2 = BoundarySurfaces(Edges=carriage_curves)
move_51 = Move(Geometry=boundary_2, Motion=Z_22)  # -> Geometry, Transform
join_21 = BrepJoin(Breps=[move_51.Geometry, boundary_2, extr_7])  # -> Breps, Closed
move_52 = Move(Geometry=join_21.Breps, Motion=Z_21)  # -> Geometry, Transform
carriage_plate_brep = Brep(move_52.Geometry)

# ----
bolt_holes_slide_3 = Curve(bolt_holes_slide)
carriage_outline_4 = Curve(carriage_outline_2)

end_point_upper_rail_path_2 = Point(end_point_upper_rail_path)
end_point_lower_rail_path_2 = Point(end_point_lower_rail_path)
actual_axis_length_4 = Panel(actual_axis_length)
bird_bit_diameter_2 = Panel(bird_bit_diameter)
safe_x_y_bird_bit = Panel("10")
X_15 = UnitX(Factor=actual_axis_length_4)
multiplication_50 = Multiplication(A=bird_bit_diameter_2, B=".5")
move_53 = Move(Geometry=end_point_upper_rail_path_2, Motion=X_15)  # -> Geometry, Transform
addition_33 = Addition(A=multiplication_50, B=safe_x_y_bird_bit)
ln_36 = Line(StartPoint=move_53.Geometry, EndPoint=end_point_upper_rail_path_2)
ext_6 = ExtendCurve(Curve=ln_36, Type=0, Start=addition_33, End=addition_33)
redpline_2 = Reduce(Polyline=ext_6, Tolerance=1)  # -> Polyline, Reduction
xz_24 = XZPlane(Origin=Point(0, 0, 0))
mirror_40 = Mirror(Geometry=redpline_2.Polyline, Plane=xz_24)  # -> Geometry, Transform
flip_6 = FlipCurve(Curve=mirror_40.Geometry)  # -> Curve, Flag
merge_21 = Merge(Data1=redpline_2.Polyline, Data2=flip_6.Curve)

move_54 = Move(Geometry=end_point_lower_rail_path_2, Motion=X_15)  # -> Geometry, Transform
ln_37 = Line(StartPoint=move_54.Geometry, EndPoint=end_point_lower_rail_path_2)
ext_7 = ExtendCurve(Curve=ln_37, Type=0, Start=addition_33, End=addition_33)
redpline_3 = Reduce(Polyline=ext_7, Tolerance=1)  # -> Polyline, Reduction
mirror_41 = Mirror(Geometry=redpline_3.Polyline, Plane=xz_24)  # -> Geometry, Transform
flip_7 = FlipCurve(Curve=mirror_41.Geometry)  # -> Curve, Flag
merge_22 = Merge(Data1=redpline_3.Polyline, Data2=flip_7.Curve)
merge_23 = Merge(Data1=merge_21, Data2=merge_22)

v_rail_bird_beak_toolpaths = Curve(merge_23)

# ---- group: V rail bird bit toolpats
v_rail_bird_beak_toolpaths_2 = Curve(v_rail_bird_beak_toolpaths)

# ==== cluster RollerRackAndPinionMaker: Makes rack and pinion gemetry suitable for 3 axis CNC milling. Has low backlash, but is vulnerable to contamination. More options inside component.
number_of_pinion_teeth = ClusterInput()
milling_bit_diameter = ClusterInput()
motor_shaft_diameter = ClusterInput()
rack_length = ClusterInput()

# ---- group: Smaller amount of teeth gives higher resolution and more torque
number_of_pinion_teeth_2 = Panel("10")
number_of_pinion_teeth_3 = Number(number_of_pinion_teeth)
null = NullItem(Item=number_of_pinion_teeth_3)  # -> NullFlags, InvalidFlags, Description
filter = StreamFilter(Gate=null.NullFlags, Stream0=number_of_pinion_teeth_3, Stream1=number_of_pinion_teeth_2)
number_of_pinion_teeth_4 = Panel(filter)

# ---- group: Determines the tooth sppacing, some margin recommended
milling_bit_diameter_2 = Panel("3.1")
milling_bit_diameter_3 = Number(milling_bit_diameter)
null_2 = NullItem(Item=milling_bit_diameter_3)  # -> NullFlags, InvalidFlags, Description
filter_2 = StreamFilter(Gate=null_2.NullFlags, Stream0=milling_bit_diameter_3, Stream1=milling_bit_diameter_2)
milling_bit_diameter_4 = Panel(filter_2)

# ---- group: Determines the travel distance of pinion
rack_length_2 = Panel("200")
rack_length_3 = Number(rack_length)
# default config for 2mm pinion milling and 3mm rack milling: bit diamter: 3.1
# margin factor: -0.14
# number of pinion teeth: 10
# fillet ratio: 0.15
null_3 = NullItem(Item=rack_length_3)  # -> NullFlags, InvalidFlags, Description
filter_3 = StreamFilter(Gate=null_3.NullFlags, Stream0=rack_length_3, Stream1=rack_length_2)
rack_length_4 = Panel(filter_3)

# ---- group: The shaft diameter of the motor driving the pinion
motor_shaft_diameter_2 = Panel("5")
motor_shaft_diameter_3 = Number(motor_shaft_diameter)
null_4 = NullItem(Item=motor_shaft_diameter_3)  # -> NullFlags, InvalidFlags, Description
filter_4 = StreamFilter(Gate=null_4.NullFlags, Stream0=motor_shaft_diameter_3, Stream1=motor_shaft_diameter_2)
motor_shaft_diameter_4 = Panel(filter_4)

# ----
preview_position_0_1 = ClusterInput()
preview_position = Slider(0.25, range=0..1)

# ---- group: Low fillet ratio gives smoother motion, but makes a less robust pinion
tooth_fillet_ratio = Slider(0.15, range=0..1)
tooth_fillet_ratio_2 = Panel(tooth_fillet_ratio)

# ---- group: Controlls pinion tooth blending
rounding_factor_pinion_outside = Slider(20, range=0..100)
rounding_factor_pinion_inside = Slider(70, range=0..100)

# ---- group: Start numbers to help calculte pinion tooth path through rack
number_of_curve_sample_points = Slider(20, range=0..1000)
sample_tooth_position = Panel("0.26")

# ---- group: Lower number gives more clearene between rack tooth and pinion valley
pinion_corner_tolerance_factor = Panel("15")

# ---- group: Fill in for correct step statistics
number_of_stepper_motor_steps = Panel("200")
microstep_level = Panel("4")

# ----
preview_position_0_1_2 = Number(preview_position_0_1)

# ---- group: Can be used to reduce or increase the pinion tooth spacing
pinion_tooth_spacing_factor = Panel("-0.14")

# ---- group: Prepare properties
multiplication = Multiplication(A=milling_bit_diameter_4, B=pinion_tooth_spacing_factor)
multiplication_2 = Multiplication(A=number_of_pinion_teeth_4, B=sample_tooth_position)
division = Division(A=milling_bit_diameter_4, B=pinion_corner_tolerance_factor)
addition = Addition(A=milling_bit_diameter_4, B=multiplication)
multiplication_3 = Multiplication(A=milling_bit_diameter_4, B="0.5")
multiplication_4 = Multiplication(A=motor_shaft_diameter_4, B="0.5")
round = Round(Number=multiplication_2)  # -> Nearest, Floor, Ceiling
multiplication_5 = Multiplication(A=number_of_pinion_teeth_4, B="2")
neg = Negative(Value=division)
multiplication_6 = Multiplication(A=milling_bit_diameter_4, B=tooth_fillet_ratio_2)
milling_bit_radius = Panel(multiplication_3)
xy = XYPlane(Origin=Point(0, 0, 0))
sample_tooth_number = Panel(round.Ceiling)
multiplication_7 = Multiplication(A=addition, B=multiplication_5)
tooth_fillet_radius = Panel(multiplication_6)
pinion_circumference = Panel(multiplication_7)
cir = Circle(Plane=xy, Radius=milling_bit_radius)
pi = Pi(Factor=1)
division_2 = Division(A=pinion_circumference, B=pi)
number_of_pinion_teeth_5 = Panel(number_of_pinion_teeth_4)
pinion_diameter = Panel(division_2)
sample_tooth_number_2 = Panel(sample_tooth_number)
number_of_curve_sample_points_2 = Panel(number_of_curve_sample_points)
multiplication_8 = Multiplication(A=pinion_diameter, B="0.5")
division_3 = Division(A=sample_tooth_number_2, B=number_of_pinion_teeth_5)
pinion_radius = Panel(multiplication_8)
pinion_circumference_2 = Panel(pinion_circumference)
multiplication_9 = Multiplication(A="360", B=division_3)
Y = UnitY(Factor=pinion_radius)
division_4 = Division(A="360", B=number_of_pinion_teeth_5)
multiplication_10 = Multiplication(A=pinion_circumference_2, B=division_3)
division_5 = Division(A=multiplication_9, B=number_of_curve_sample_points_2)
division_6 = Division(A=pinion_circumference, B=number_of_pinion_teeth_4)
move = Move(Geometry=xy, Motion=Y)  # -> Geometry, Transform
series = Series(Start=0, Step=division_4, Count=number_of_pinion_teeth_5)
division_7 = Division(A=multiplication_10, B=number_of_curve_sample_points_2)
series_2 = Series(Start=0, Step=division_5, Count=number_of_curve_sample_points_2)
tooth_spacing = Panel(division_6)
rad = Radians(Degrees=series)
circle = Circle(cir)
series_3 = Series(Start=0, Step=division_7, Count=number_of_curve_sample_points_2)
neg_2 = Negative(Value=series_2)
rotate = Rotate(Geometry=circle, Angle=rad, Plane=move.Geometry)  # -> Geometry, Transform
rad_2 = Radians(Degrees=neg_2)

# ---- group: Make step resolution statisitics
number_of_stepper_motor_steps_2 = Panel(number_of_stepper_motor_steps)
microstep_level_2 = Panel(microstep_level)
division_8 = Division(A=pinion_circumference, B=number_of_stepper_motor_steps_2)
distance_covered_per_step = Panel(division_8)
division_9 = Division(A=distance_covered_per_step, B=microstep_level_2)
distance_covered_per_micro_step = Panel(division_9)

# ---- group: Step statsistics
distance_covered_per_step_2 = Panel(distance_covered_per_step)
distance_covered_per_micro_step_2 = Panel(distance_covered_per_micro_step)

# ---- group: Create rack tooth geometry
sample_tooth_number_3 = Panel(sample_tooth_number_2)
tooth_spacing_2 = Panel(tooth_spacing)
item = ListItem(List=rotate.Geometry, Index=sample_tooth_number_3, Wrap=True)
rotate_2 = Rotate(Geometry=graft(item), Angle=rad_2, Plane=move.Geometry)  # -> Geometry, Transform
tooth_spacing_3 = Panel(tooth_spacing)
X = UnitX(Factor=series_3)
sample_tooth_number_4 = Panel(sample_tooth_number_3)
milling_it_radius = Panel(multiplication_3)
subtraction = Subtraction(A=sample_tooth_number_3, B="0.5")
move_2 = Move(Geometry=rotate_2.Geometry, Motion=X)  # -> Geometry, Transform
multiplication_11 = Multiplication(A=sample_tooth_number_4, B=tooth_spacing_3)
area = Area(Geometry=move_2.Geometry)  # -> Area, Centroid
pt = ConstructPoint(XCoordinate=multiplication_11, YCoordinate=0, ZCoordinate=0)
multiplication_12 = Multiplication(A=subtraction, B=tooth_spacing_2)
multiplication_13 = Multiplication(A=sample_tooth_number_3, B=tooth_spacing_2)
deplane = DeconstructPlane(Plane=xy)  # -> Origin, XAxis, YAxis, ZAxis
merge = Merge(Data1=flatten(area.Centroid), Data2=flatten(pt))
amp = Amplitude(Vector=deplane.YAxis, Amplitude=milling_it_radius)
amp_2 = Amplitude(Vector=deplane.XAxis, Amplitude=multiplication_12)
amp_3 = Amplitude(Vector=deplane.XAxis, Amplitude=multiplication_13)
intcrv = Interpolate(Vertices=merge, Degree=3, Periodic=False, KnotStyle=1)  # -> Curve, Length, Domain
rev = Reverse(Vector=amp)
move_3 = Move(Geometry=deplane.Origin, Motion=amp_2)  # -> Geometry, Transform
move_4 = Move(Geometry=deplane.Origin, Motion=amp_3)  # -> Geometry, Transform
move_5 = Move(Geometry=move_3.Geometry, Motion=rev)  # -> Geometry, Transform
yz = YZPlane(Origin=move_5.Geometry)
crv = Curve(intcrv.Curve)
mirror = Mirror(Geometry=crv, Plane=yz)  # -> Geometry, Transform
ccx = CurveCurve(CurveA=crv, CurveB=mirror.Geometry)  # -> Points, ParamsA, ParamsB
shatter = Shatter(Curve=crv, Parameters=ccx.ParamsA)
rev_2 = ReverseList(List=shatter)
milling_it_radius_2 = Panel(milling_it_radius)
tooth_fillet_radius_2 = Panel(tooth_fillet_radius)
item_2 = ListItem(List=rev_2, Index=0, Wrap=True)
mirror_2 = Mirror(Geometry=item_2, Plane=yz)  # -> Geometry, Transform
pt_2 = Point(move_4.Geometry)
pt_3 = Point(deplane.Origin)
addition_2 = Addition(A=tooth_fillet_radius_2, B=milling_it_radius_2)
join = JoinCurves(Curves=[item_2, mirror_2.Geometry], Preserve=False)
vec2pt = Vector2Pt(PointA=pt_2, PointB=pt_3, Unitize=False)  # -> Vector, Length
fillet = Fillet(Curve=join, Radius=addition_2)
move_6 = Move(Geometry=fillet, Motion=vec2pt.Vector)  # -> Geometry, Transform

# ----
distance_covered_per_step_3 = Panel(distance_covered_per_step)
distance_covered_per_step_4 = Number(distance_covered_per_step_3)
distance_covered_per_step_5 = ClusterOutput(distance_covered_per_step_4)

# ---- group: Create and blend pinion teeth
eval = EvaluateLength(Curve=fillet, Length="0.5", Normalized=True)  # -> Point, Tangent, Parameter
pdecon = Deconstruct(Point=eval.Point)  # -> XComponent, YComponent, ZComponent
milling_it_radius_3 = Panel(milling_bit_radius)
pinion_corner_tolerance = Panel(neg)
subtraction_2 = Subtraction(A=pdecon.YComponent, B=milling_it_radius_3)
subtraction_3 = Subtraction(A=subtraction_2, B=milling_it_radius_3)
subtraction_4 = Subtraction(A=subtraction_3, B=pinion_corner_tolerance)
pt_4 = ConstructPoint(XCoordinate=0, YCoordinate=subtraction_4, ZCoordinate=0)
rounding_factor_pinion_outside_2 = Panel(rounding_factor_pinion_outside)
xy_2 = XYPlane(Origin=pt_4)
division_10 = Division(A="360", B=multiplication_5)
rounding_factor_pinion_inside_2 = Panel(rounding_factor_pinion_inside)
subtraction_5 = Subtraction(A="0", B=rounding_factor_pinion_outside_2)
addition_3 = Addition(A="180", B=rounding_factor_pinion_outside_2)
rad_3 = Radians(Degrees=addition_3)
rad_4 = Radians(Degrees=subtraction_5)
subtraction_6 = Subtraction(A="180", B=rounding_factor_pinion_inside_2)
addition_4 = Addition(A="0", B=rounding_factor_pinion_inside_2)
milling_it_radius_4 = Panel(milling_it_radius_3)
dom = ConstructDomain(DomainStart=rad_4, DomainEnd=rad_3)
xy_3 = XYPlane(Origin=Point(0, 0, 0))
rad_5 = Radians(Degrees=subtraction_6)
rad_6 = Radians(Degrees=addition_4)
dom_2 = ConstructDomain(DomainStart=rad_6, DomainEnd=rad_5)
pi_2 = Pi(Factor=1)
arc = Arc(Plane=xy_3, Radius=milling_it_radius_4, Angle=dom)  # -> Arc, Length
arc_2 = Arc(Plane=xy_2, Radius=milling_it_radius_4, Angle=dom_2)  # -> Arc, Length
rad_7 = Radians(Degrees=division_10)
rotate_3 = Rotate(Geometry=arc.Arc, Angle=pi_2, Plane=xy_3)  # -> Geometry, Transform
addition_5 = Addition(A=rad, B=rad_7)
number_slider = Slider(0.5, range=0..1)
rotate_4 = Rotate(Geometry=rotate_3.Geometry, Angle=rad, Plane=move.Geometry)  # -> Geometry, Transform
rotate_5 = Rotate(Geometry=arc_2.Arc, Angle=addition_5, Plane=move.Geometry)  # -> Geometry, Transform
flip = FlipCurve(Curve=rotate_4.Geometry)  # -> Curve, Flag
flip_2 = FlipCurve(Curve=rotate_5.Geometry)  # -> Curve, Flag
pinion_radius_2 = Panel(pinion_radius)
shift = ShiftList(List=flip.Curve, Shift=1, Wrap=True)
blendc = BlendCurve(CurveA=rotate_4.Geometry, CurveB=flip_2.Curve, BulgeA=number_slider, BulgeB=number_slider, Continuity=2)
blendc_2 = BlendCurve(CurveA=shift, CurveB=rotate_5.Geometry, BulgeA=number_slider, BulgeB=number_slider, Continuity=2)
neg_3 = Negative(Value=pinion_radius_2)
Y_2 = UnitY(Factor=neg_3)
cir_2 = Circle(Plane=move.Geometry, Radius=multiplication_4)
join_2 = JoinCurves(Curves=flatten([rotate_4.Geometry, rotate_5.Geometry, blendc, blendc_2]), Preserve=False)
move_7 = Move(Geometry=join_2, Motion=Y_2)  # -> Geometry, Transform
pinion_teeth = Curve(move_7.Geometry)

# ----
move_8 = Move(Geometry=cir_2, Motion=Y_2)  # -> Geometry, Transform

# ---- group: Create and blend pinion teeth (continued)
pinion_center_hole = Curve(move_8.Geometry)

# ---- group: Create pinion movement preview
preview_position_0_1_3 = Number(preview_position_0_1_2)
pinion_radius_3 = Panel(pinion_radius)
pinion_circumference_3 = Panel(pinion_circumference)
multiplication_14 = Multiplication(A="360", B=preview_position_0_1_3)
multiplication_15 = Multiplication(A=pinion_circumference_3, B=preview_position_0_1_3)
neg_4 = Negative(Value=multiplication_14)
X_2 = UnitX(Factor=multiplication_15)
rad_8 = Radians(Degrees=neg_4)
rotate_6 = Rotate(Geometry=flatten([join_2, cir_2]), Angle=rad_8, Plane=move.Geometry)  # -> Geometry, Transform
move_9 = Move(Geometry=rotate_6.Geometry, Motion=X_2)  # -> Geometry, Transform
neg_5 = Negative(Value=pinion_radius_3)
Y_3 = UnitY(Factor=neg_5)
move_10 = Move(Geometry=move_9.Geometry, Motion=Y_3)  # -> Geometry, Transform
pinion_movement_preview = Curve(move_10.Geometry)

# ---- group: Make pinion bit statisitics
pinion_radius_4 = Panel(pinion_radius)
rotate_7 = Rotate(Geometry=move.Geometry, Angle=4.71238898, Plane=move.Geometry)  # -> Geometry, Transform
pinion_teeth_2 = Curve(join_2)
cir_3 = Circle(Plane=rotate_7.Geometry, Radius=pinion_radius_4)
trim = TrimWithRegion(Curve=cir_3, Region=pinion_teeth_2)  # -> Inside, Outside
item_3 = ListItem(List=trim.Outside, Index=0, Wrap=True)
len = Length(Curve=flatten(item_3))
maxium_pinion_milling_bit_diamter = Panel(len)

# ----
maxium_pinion_milling_bit_diamter_2 = Panel(maxium_pinion_milling_bit_diamter)
maxium_pinion_milling_bit_diamter_3 = Number(maxium_pinion_milling_bit_diamter_2)
pinion_movement_preview_2 = Curve(pinion_movement_preview)
pinion_center_hole_2 = Curve(pinion_center_hole)
pinion_teeth_3 = Curve(pinion_teeth)
pinion_teeth_4 = ClusterOutput(pinion_teeth_3)
pinion_center_hole_3 = ClusterOutput(pinion_center_hole_2)
pinion_movement_preview_3 = ClusterOutput(pinion_movement_preview_2)
maxium_pinion_milling_bit_diamter_4 = ClusterOutput(maxium_pinion_milling_bit_diamter_3)

# ---- group: Create rack by copying and offsetting rack tooth
tooth_spacing_4 = Panel(tooth_spacing)
rack_length_5 = Panel(rack_length_4)
milling_bit_radius_2 = Panel(multiplication_3)
pinion_radius_5 = Panel(pinion_radius)
addition_6 = Addition(A=pinion_radius_5, B=milling_bit_radius_2)
multiplication_16 = Multiplication(A=addition_6, B="2")
division_11 = Division(A=addition_6, B=tooth_spacing_4)
round_2 = Round(Number=division_11)  # -> Nearest, Floor, Ceiling
multiplication_17 = Multiplication(A=round_2.Ceiling, B=tooth_spacing_4)
neg_6 = Negative(Value=multiplication_17)
rack_start_distance = Panel(neg_6)
pinion_radius_6 = Panel(pinion_radius)
neg_7 = Negative(Value=pinion_radius_6)
Y_4 = UnitY(Factor=neg_7)

# ----
addition_7 = Addition(A=rack_length_5, B=multiplication_16)
actual_rack_length = Panel(addition_7)
neg_8 = Negative(Value=addition_6)
rack_cut_start_distance = Panel(neg_8)
X_3 = UnitX(Factor=rack_start_distance)
move_11 = Move(Geometry=move_6.Geometry, Motion=X_3)  # -> Geometry, Transform

# ---- group: Create rack by copying and offsetting rack tooth (continued)
division_12 = Division(A=actual_rack_length, B=tooth_spacing_4)
round_3 = Round(Number=division_12)  # -> Nearest, Floor, Ceiling
addition_8 = Addition(A=round_3.Ceiling, B="1")
series_4 = Series(Start=0, Step=tooth_spacing_4, Count=addition_8)
X_4 = UnitX(Factor=series_4)
move_12 = Move(Geometry=move_11.Geometry, Motion=X_4)  # -> Geometry, Transform
join_3 = JoinCurves(Curves=move_12.Geometry, Preserve=False)
offset = Offset(Curve=join_3, Distance=milling_it_radius, Plane=PlaneXY(0, 0, 0), Corners=2)
move_13 = Move(Geometry=offset, Motion=Y_4)  # -> Geometry, Transform
rack_toolpath = Curve(join_3)

# ----
rack_teeth = Curve(move_13.Geometry)
preview = CustomPreview(Geometry=rack_toolpath, Shader=ColourSwatch(SwatchColor=RGB(48, 112, 110)))

milling_bit_radius_3 = Panel(multiplication_3)
pinion_radius_7 = Panel(pinion_radius)
addition_9 = Addition(A=pinion_radius_7, B=milling_bit_radius_3)
cir_4 = Circle(Plane=move.Geometry, Radius=addition_9)

move_14 = Move(Geometry=cir_4, Motion=Y_2)  # -> Geometry, Transform

pinion_edge = Curve(move_14.Geometry)

pinion_edge_2 = Curve(pinion_edge)
pinion_edge_3 = ClusterOutput(pinion_edge_2)

# ---- group: Trim rack to specified length
rack_cut_start_distance_2 = Panel(rack_cut_start_distance)
actual_rack_length_2 = Panel(actual_rack_length)
pinion_diameter_2 = Panel(pinion_diameter)
rack_teeth_2 = Curve(rack_teeth)
neg_9 = Negative(Value=pinion_diameter_2)

# ----
pt_5 = ConstructPoint(XCoordinate=rack_cut_start_distance_2, YCoordinate=0, ZCoordinate=0)

# ---- group: Trim rack to specified length (continued)
xy_4 = XYPlane(Origin=pt_5)
rectangle = Rectangle(Plane=xy_4, XSize=actual_rack_length_2, YSize=neg_9, Radius=0)  # -> Rectangle, Length
trim_2 = TrimWithRegion(Curve=rack_teeth_2, Region=rectangle.Rectangle)  # -> Inside, Outside
bbox = BoundingBox(Content=trim_2.Inside, Plane=PlaneXY(0, 0, 0))  # -> Box, Box_2
edges = BrepEdges(Brep=bbox.Box)  # -> Naked, Interior, NonManifold
item_4 = ListItem(List=edges.Naked, Index="2", Wrap=True)
flip_3 = FlipCurve(Curve=item_4)  # -> Curve, Flag
rack_tooth_edge = Curve(flip_3.Curve)
trimmed_rack_teeth = Curve(trim_2.Inside)

# ----
rack_teeth_3 = Curve(trimmed_rack_teeth)
rack_edge = Curve(rack_tooth_edge)
rack_teeth_4 = ClusterOutput(rack_teeth_3)
rack_edge_2 = ClusterOutput(rack_edge)

# ==== cluster DivideCurveEvenLenght: Calculates approximate curve length for even division
crv = ClusterInput()
crv_2 = Curve(crv)
B = ClusterInput()
len = Length(Curve=crv_2)
division = Division(A=len, B=B)
round = Round(Number=division)  # -> Nearest, Floor, Ceiling
divide = DivideCurve(Curve=crv_2, Count=round.Ceiling, Kinks=False)  # -> Points, Tangents, Parameters
P = ClusterOutput(divide.Points)
