# Grasshopper definition simple axis mover.gh (Grasshopper 0.9.76)

speed = Slider(2879, range=0..10000)
panel = Panel("G1 X-100.0000 F6000")
number_slider = Slider(30000, range=0..100000)
number_slider_2 = Slider(20000, range=0..100000)
number_slider_3 = Slider(16000, range=0..100000)
position = Slider(-250, range=-500..500)
position_2 = Slider(150, range=-500..500)
int = Integer(speed)
int_2 = Integer(int)
merge = Merge(Data1="G1 X", Data2=position_2, Data3=" F", Data4=int_2)
merge_2 = Merge(Data1="G1 X", Data2=position, Data3=" F", Data4=int)
join = TextJoin(Text=merge)
join_2 = TextJoin(Text=merge_2)
merge_3 = Merge(Data1=join_2, Data2=join, Data3=join_2)
panel_2 = Panel(merge_3)
